# Grasshopper definition BuildingElements_Box ribbed metal panel.gh (Grasshopper 1.0.7)
# plug-ins: LunchBox

panel = Panel("BAKE")
panel_2 = Panel("RECTANGULAR 4 SIDED CURVE")
panel_3 = Panel("DIRECTION")
list = ValueList({"Option A": 0, "Option B": 1}, selected="Option B")

# ---- group: BOX RIB METAL PANEL
crv = Curve(<curve referenced from the Rhino model>)

# ----
explode = Explode(Curve=crv, Recursive=True)  # -> Segments, Vertices
item = ListItem(List=explode.Segments, Index=0, Wrap=True)  # -> Item, Item1, Item2, Item3
crv_2 = Curve(item.Item2)
crv_3 = Curve(item.Item)
crv_4 = Curve(item.Item1)
crv_5 = Curve(item.Item3)
merge = Merge(Data1=crv_3, Data2=crv_2)
merge_2 = Merge(Data1=crv_4, Data2=crv_5)
filter = StreamFilter(Gate=list, Stream0=merge, Stream1=merge_2)
rib_height = Slider(3, range=0..10)
rib_size = Slider(3, range=0..10)
item_2 = ListItem(List=filter, Index=0, Wrap=True)  # -> Item, Item1
cluster = Cluster(C_3=item_2.Item, C=item_2.Item, L=expr("x/12", rib_size), C_2=item_2.Item1)  # -> P, P_2
multiplication = Multiplication(A=rib_size, B=rib_height)
md_slider = MDSlider(SliderMode=0, slider_value=Point(0.5, 0.5, 0.5), x_domain=Domain(0, 1), y_domain=Domain(0, 1), z_domain=Domain(0, 1))
ln = Line(StartPoint=cluster.P, EndPoint=cluster.P_2)
evalsrf = EvaluateSurface(Surface=crv, Point=md_slider)  # -> Point, Normal, UDirection, VDirection, Frame
shift = ShiftList(List=ln, Shift=0, Wrap=False)
shift_2 = ShiftList(List=ln, Shift=1, Wrap=False)
merge_3 = Merge(Data1=simplify(graft(shift)), Data2=simplify(graft(shift_2)))
amp = Amplitude(Vector=evalsrf.Normal, Amplitude=rib_height)
loft = Loft(Curves=merge_3, Options={Adjust=False, Closed=False, LoftEnds=0, LoftSimp=0, LoftType=0, Rebuild=10, Refit=0.01})  # -> flatten(Loft)
cull = CullPattern(List=loft, CullPattern=[True, False])
cull_2 = CullPattern(List=loft, CullPattern=[False, True])
Z = UnitZ(Factor=rib_height)
Y = UnitY(Factor=1)
extr = Extrude(Base=cull_2, Direction=expr("-x/12", amp))
debrep = DeconstructBrep(Brep=extr)  # -> Faces, Edges, Vertices
python = GhPythonScript(x=debrep.Faces, f_area=multiplication, guid_crv=crv)  # -> out, a
# ---------- python: Python ----------
__author__ = "Brooks Scarpa"
__version__ = "2022.04.20"

import rhinoscriptsyntax as rs

center = rs.CurveAreaCentroid(guid_crv)
center = center[0][2]

value = rs.EvaluateSurface(x,0.5,0.5)
print(value[2])

area = round(rs.Area(x))
print(area)

if round(value[2],2) == round(center,2) or area == f_area: 
    a = 'False'
else:
    a = 'True'
    
print(a)
# ---------- end python ----------
panel_4 = Panel(python.a)
cull_3 = CullPattern(List=debrep.Faces, CullPattern=python.a)  # -> flatten(List)
merge_4 = Merge(Data1=cull, Data2=cull_3)
join = BrepJoin(Breps=merge_4)  # -> Breps, Closed
bake = ObjectBake(
    BakeToggle=Toggle(False),
    GeometryObjects=join.Breps,
    Layer="01_MTL PANELS",
    ObjectName="GH_Obj",
    ObjectColor=RGB(255, 255, 255),
    LayerColor=RGB(255, 255, 255))

# ==== cluster Cluster
C = ClusterInput()
L = ClusterInput()
C_2 = ClusterInput()
divlength = DivideLength(Curve=C, Length=L)  # -> Points, Tangents, Parameters
flip = FlipCurve(Curve=C_2)  # -> Curve, Flag
C_3 = ClusterInput()
lng = ListLength(List=divlength.Points)
divide = DivideCurve(Curve=C_3, Count=lng, Kinks=False)  # -> Points, Tangents, Parameters
divide_2 = DivideCurve(Curve=flip.Curve, Count=lng, Kinks=False)  # -> Points, Tangents, Parameters
P = ClusterOutput(divide.Points)
P_2 = ClusterOutput(divide_2.Points)
