# Grasshopper definition BuildingElements_ColumnFromPoints.gh (Grasshopper 1.0.7)

panel = Panel("CLOSED RECTANGULAR CURVE")
crv = Curve(<curve referenced from the Rhino model>)
width = Slider(2, range=0..100)
height = Slider(6, range=0..100)
height_2 = Slider(34, range=0..1000)
area = Area(Geometry=crv)  # -> Area, Centroid
neg = Negative(Value=width)
neg_2 = Negative(Value=height)
dom = ConstructDomain(DomainStart=width, DomainEnd=neg)
dom_2 = ConstructDomain(DomainStart=height, DomainEnd=neg_2)
line = LineSDL(Start=area.Centroid, Direction=Vector(0, 0, 1), Length=height_2)
rectangle = Rectangle(Plane=area.Centroid, XSize=dom, YSize=dom_2, Radius=0)  # -> Rectangle, Length
extr = Extrude(Base=rectangle.Rectangle, Direction=line)
