# Grasshopper definition BuildingElements_CurtainWallRandomizedFacade.gh (Grasshopper 1.0.7)
# plug-ins: Pufferfish

panel = Panel("SURFACES")

# ---- group: Input
glazing_surface_input = Surface(graft(<surface referenced from the Rhino model>))

# ----
start_elevation = Slider(0, range=0..100)

# ---- group: Commerical Floor Input
floor_height = Slider(13, range=0..100)
number_of_floors = Slider(1, range=0..10)

# ---- group: Non Commercial Floor input
floor_height_2 = Slider(14, range=0..100)
number_of_floors_2 = Slider(9, range=0..20)

# ----
random_seed_for_pattern = Slider(8, range=0..10)

# ---- group: Minimum Panel Size
number_slider = Slider(1, range=0..10)

# ----
density_percentage = Slider(60, range=0..100)

# ---- group: Creates Floor Datums
series = Series(Start=start_elevation, Step=floor_height, Count=expr("x+1", number_of_floors))
item = ListItem(List=series, Index=-1, Wrap=True)
series_2 = Series(Start=item, Step=floor_height_2, Count=number_of_floors_2)
merge = Merge(Data1=flatten(series), Data2=flatten(series_2))
cset = CreateSet(List=merge)  # -> Set, Map

# ----
panel_2 = Panel(cset.Set)

# ---- group: Feet to Meters converter
expression = Expression(x=cset.Set, Expression="x*0.3048")

# ----
pt = ConstructPoint(XCoordinate=0, YCoordinate=0, ZCoordinate=expression)

# ---- group: Intersection Plans
xy = XYPlane(Origin=pt)
sec = MeshPlane(Mesh=glazing_surface_input, Plane=xy)
trim = TrimTree(Tree=sec, Depth=1)

# ---- group: Get upper and Lower edges of vertical surface
debrep = DeconstructBrep(Brep=glazing_surface_input)  # -> Faces, simplify(Edges), Vertices
curvepoint = PointOnCurve(debrep.Edges, parameter=0.5)
pdecon = Deconstruct(Point=curvepoint)  # -> XComponent, YComponent, ZComponent
sort = SortList(Keys=pdecon.ZComponent, ValuesA=debrep.Edges)  # -> Keys, ValuesA
item_2 = ListItem(List=sort.ValuesA, Index=0, Wrap=True)  # -> Item1, Item

# ----
crv = Curve(item_2.Item1)
crv_2 = Curve(item_2.Item)

# ---- group: Replace Initial intersecttions with 0 = lower edge -1 = upper edge
replace = ReplaceItems(List=trim, Item=crv_2, Indices=0, Wrap=False)
lng = ListLength(List=replace)
replace_2 = ReplaceItems(List=replace, Item=crv, Indices=expr("x-1", lng), Wrap=False)
shift = ShiftList(List=replace_2, Shift=1, Wrap=False)
shift_2 = ShiftList(List=replace_2, Shift=-1, Wrap=False)

# ----
merge_2 = Merge(Data1=graft(shift_2), Data2=graft(shift))  # -> simplify(Result)
item_3 = ListItem(List=sort.ValuesA, Index=0, Wrap=True)  # -> Item1, Item, Item1_2, Item2

# ---- group: Generates Random Seeds to random engine
lng_2 = ListLength(List=replace_2)
series_3 = Series(Start=random_seed_for_pattern, Step=1, Count=lng_2)  # -> graft(Series)

# ---- group: Creates Vertical Mullions
item_4 = ListItem(List=merge_2, Index=0, Wrap=True)
item_5 = ListItem(List=merge_2, Index=1, Wrap=True)
divlength = DivideLength(Curve=item_4, Length=number_slider)  # -> Points, Tangents, Parameters
lng_3 = ListLength(List=divlength.Points)
expression_2 = Expression(x=lng_3, y=density_percentage, Expression="round(x*(y/100),0)")
reduce = RandomReduce(List=simplify(divlength.Points), Reduction=simplify(expression_2), Seed=simplify(series_3))  # -> simplify(List)
crv_cp = CurveClosestPoint(Point=reduce, Curve=item_5)  # -> Point, Parameter, Distance
ln = Line(StartPoint=reduce, EndPoint=crv_cp.Point)

# ----
crv_3 = Curve(item_3.Item1_2)
crv_4 = Curve(item_3.Item2)
boundary_vertical_mullions = Curve(simplify([crv_3, crv_4]))
horizontal_mullions = Curve(simplify(replace_2))
vertical_mullions = Curve(simplify(ln))
md_slider = MDSlider(SliderMode=0, slider_value=Point(0.5, 0.5, 0.5), x_domain=Domain(0, 1), y_domain=Domain(0, 1), z_domain=Domain(0, 1))
trim_2 = TrimTree(Tree=vertical_mullions, Depth=1)
flatten = FlattenTree(Tree=vertical_mullions, Path="{0}")
evalsrf = EvaluateSurface(Surface=reparameterize(glazing_surface_input), Point=md_slider)  # -> Point, Normal, UDirection, VDirection, Frame
merge_3 = Merge(Data1=boundary_vertical_mullions, Data2=horizontal_mullions, Data3=flatten)
amp = Amplitude(Vector=evalsrf.Normal, Amplitude=Slider(-0.25, range=-6..10))
extr = Extrude(Base=merge_3, Direction=amp)
offsrf = OffsetSurface(Surface=extr, Distance=1, BothSides=expr("-x", 0), CreateSolid=True)  # -> simplify(Offset)

# ---- group: Script Mullion thickness
srf = Surface(extr)

# ----
srfsplit = SurfaceSplit(Surface=glazing_surface_input, Curves=flatten(merge_3))
glazing_panes = Surface(srfsplit)
mullions = Brep(extr)
panel_3 = Panel(mullions)
panel_4 = Panel(glazing_panes)
