# Grasshopper definition BuildingElements_GetWallsFromMassing.gh (Grasshopper 1.0.7)

panel = Panel("BREP")

# ---- group: Input - Any type of Brep
brep = Brep([<brep referenced from the Rhino model> x53])

# ----
debrep = DeconstructBrep(Brep=brep)  # -> reparameterize(Faces), Edges, Vertices
md_slider = MDSlider(SliderMode=0, slider_value=Point(0.5, 0.5, 0.5), x_domain=Domain(0, 1), y_domain=Domain(0, 1), z_domain=Domain(0, 1))
evalsrf = EvaluateSurface(Surface=debrep.Faces, Point=md_slider)  # -> Point, Normal, UDirection, VDirection, Frame
devec = DeconstructVector(Vector=evalsrf.Normal)  # -> XComponent, YComponent, ZComponent
python = GhPythonScript(z=devec.ZComponent)  # -> a
# ---------- python: Python ----------
__author__ = "Brooks Scarpa"
__version__ = "2022.09.06"

import rhinoscriptsyntax as rs


z = round(z,0)

if abs(z) == 1: 
    a = False 
else: 
    a = True
# ---------- end python ----------
cull = CullPattern(List=debrep.Faces, CullPattern=python)
panel_2 = Panel(python)
glazin = Surface([<surface referenced from the Rhino model> x283])

# ---- group: Output - Surfaces
srf = Surface(cull)
