# Grasshopper definition BuildingElements_IPE slats GuardRail.gh (Grasshopper 1.0.7)

panel = Panel("SPACING")
panel_2 = Panel("OFFSET DISTANCE")
panel_4 = Panel("TOP RAIL")
number_slider = Slider(1, range=0..10)
number_slider_2 = Slider(2, range=0..10)
crv = Curve(<curve referenced from the Rhino model>)
crv_2 = Curve(<curve referenced from the Rhino model>)
xy = XYPlane(Origin=Point(0, 0, 0))
offset = OffsetCurve(Curve=crv_2, Distance=number_slider, Plane=xy, Corners=1)
offset_2 = OffsetCurve(Curve=crv, Distance=number_slider, Plane=xy, Corners=1)
divlength = DivideLength(Curve=offset, Length=number_slider_2)  # -> Points, Tangents, Parameters
divlength_2 = DivideLength(Curve=offset_2, Length=number_slider_2)  # -> Points, Tangents, Parameters
hframe = HorizontalFrame(Curve=offset, Parameter=divlength.Parameters)
hframe_2 = HorizontalFrame(Curve=offset_2, Parameter=divlength_2.Parameters)
ln = Line(StartPoint=divlength.Points, EndPoint=divlength_2.Points)
rectangle = Rectangle(Plane=hframe, XSize=Domain(-0.5, 0.5), YSize=Domain(-1, 1), Radius=0)  # -> Rectangle, Length
rectangle_2 = Rectangle(Plane=hframe_2, XSize=Domain(-0.5, 0.5), YSize=Domain(-1, 1), Radius=0)  # -> Rectangle, Length
merge = Merge(Data1=graft(rectangle.Rectangle), Data2=graft(rectangle_2.Rectangle))
loft = Loft(Curves=merge, Options={Adjust=False, Closed=False, LoftEnds=0, LoftSimp=0, LoftType=0, Rebuild=10, Refit=0.01})
cap = CapHoles(Brep=loft)
