# Grasshopper definition BuildingElements_MapGeometryOnSurfaceByRandomPoints.gh (Grasshopper 1.0.7)

# ---- group: Number of Surface Points
number_slider = Slider(50, range=0..10000)

# ---- group: Input Surface to Map Onto
input_surface = Surface(<surface referenced from the Rhino model>)

# ---- group: Input Brep to Map
geoto_map = Brep(<brep referenced from the Rhino model>)

# ---- group: Find Planes on Surface
input_surface_2 = Surface(input_surface)
popgeo = PopulateGeometry(Geometry=input_surface_2, Count=number_slider, Seed=1)
srf_cp = SurfaceClosestPoint(Point=popgeo, Surface=input_surface_2)  # -> Point, UVPoint, Distance
evalsrf = EvaluateSurface(Surface=input_surface_2, Point=srf_cp.UVPoint)  # -> Point, Normal, UDirection, VDirection, Frame

# ----
geoto_map_2 = Brep(geoto_map)

# ---- group: Find Plane to Orient Geometry to Surface
lowest_face_of_bb = LowestFaceOfBB(C=geoto_map_2)  # -> i, i_2
lowest_face_of_a_bb = Surface(lowest_face_of_bb.i)
center_point_of_lowest_face = Point(lowest_face_of_bb.i_2)
xy = XYPlane(Origin=center_point_of_lowest_face)

# ----
orient = Orient(Geometry=geoto_map_2, Source=xy, Target=evalsrf.Frame)  # -> Geometry, Transform

# ---- group: Output
brep = Brep(orient.Geometry)

# ==== cluster LowestFaceOfBB
C = ClusterInput()
bbox = BoundingBox(Content=C, Plane=PlaneXY(0, 0, 0))  # -> Box, Box_2
debrep = DeconstructBrep(Brep=bbox.Box)  # -> Faces, Edges, Vertices
md_slider = MDSlider(SliderMode=0, slider_value=Point(0.5, 0.5, 0.5), x_domain=Domain(0, 1), y_domain=Domain(0, 1), z_domain=Domain(0, 1))
evalsrf = EvaluateSurface(Surface=reparameterize(debrep.Faces), Point=md_slider)  # -> Point, Normal, UDirection, VDirection, Frame
pdecon = Deconstruct(Point=evalsrf.Point)  # -> XComponent, YComponent, ZComponent
sort = SortList(Keys=pdecon.ZComponent, ValuesA=evalsrf.Point)  # -> Keys, ValuesA
sort_2 = SortList(Keys=pdecon.ZComponent, ValuesA=debrep.Faces)  # -> Keys, ValuesA
item = ListItem(List=sort_2.ValuesA, Index=0, Wrap=True)
item_2 = ListItem(List=sort.ValuesA, Index=0, Wrap=True)
i = ClusterOutput(item)
i_2 = ClusterOutput(item_2)
