# Grasshopper definition BuildingElements_MassingBoxByArea (1).gh (Grasshopper 1.0.7)

length = Slider(110, range=0..1000)
area = Slider(40649, range=0..100000)
height = Slider(38, range=0..100)
division = Division(A=area, B=length)
width = Number(division)
Z = UnitZ(Factor=height)
dom = ConstructDomain(DomainStart=expr("X/2", length), DomainEnd=expr("-X/2", length))
dom_2 = ConstructDomain(DomainStart=expr("X/2", width), DomainEnd=expr("-X/2", width))
panel = Panel(width)
rectangle = Rectangle(Plane=PlaneXY(0, 0, 0), XSize=dom, YSize=dom_2, Radius=0)  # -> Rectangle, Length
extr = Extrude(Base=rectangle.Rectangle, Direction=Z)
box_solid = CapHoles(Brep=extr)
