# Grasshopper definition BuildingElements_Mesh Screens.gh (Grasshopper 1.0.7)

# MAKING MESH SCREEN OUT OF A BREP OBJECT IN X,Y,Z DIRECTIONS.
panel = Panel("ANY BREP OBJECT")
brep = Brep(<brep referenced from the Rhino model>)
brep_2 = Brep()
curve = Curve(<curve referenced from the Rhino model>)
curve_array = CurveArray(Geometry=brep_2, Curve=curve, Count=Slider(10, range=0..10))  # -> Geometry, Transform
contour = Contour(Shape=brep, Point=Point(0, 0, 0), Direction="0,0,1", Distance=Slider(6, range=0..6))
contour_2 = Contour(Shape=brep, Point=Point(0, 0, 0), Direction="1,1,0", Distance=Slider(6, range=0..6))
contour_3 = Contour(Shape=brep, Point=Point(0, 0, 0), Direction="1,0,0", Distance=Slider(6, range=0..6))
brep_3 = Brep(curve_array.Geometry)
curve_2 = Curve([contour, contour_2, contour_3])
pipe = Pipe(Curve=curve_2, Radius=Slider(0.063, range=0..2), Caps=0)
brep_4 = Brep(pipe)
