# Grasshopper definition BuildingElements_MoveGeometryOntoTopography.gh (Grasshopper 1.0.7)

panel = Panel("SOURCE BREP")

# ---- group: Random Value to Move Breps above Topographical Plane
number_slider = Slider(50, range=0..1000)

# ---- group: List of Brep to be move to a topography
brep = Brep(<brep referenced from the Rhino model>)

# ---- group: Toposurface
# SURFACE TO PROJECT TO
srf = Surface(<surface referenced from the Rhino model>)

# ----
Z = UnitZ(Factor=expr("x*12", number_slider))
move = Move(Geometry=brep, Motion=Z)  # -> Geometry, Transform

# ---- group: Get the lowest point of the Brep
debrep = DeconstructBrep(Brep=move.Geometry)  # -> Faces, Edges, Vertices
pdecon = Deconstruct(Point=debrep.Vertices)  # -> XComponent, YComponent, ZComponent
sort = SortList(Keys=pdecon.ZComponent, ValuesA=debrep.Vertices)  # -> Keys, ValuesA
item = ListItem(List=sort.ValuesA, Index=0, Wrap=True)

# ---- group: Calculates the required Z transition for the geometryr
project = ProjectPoint(Point=item, Direction=Vector(0, 0, -1), Geometry=srf)  # -> Point, Index
dist = Distance(PointA=item, PointB=project.Point)
neg = Negative(Value=dist)
Z_2 = UnitZ(Factor=neg)

# ----
move_2 = Move(Geometry=graft(move.Geometry), Motion=Z_2)  # -> Geometry, Transform

# ---- group: Output - Geometry on TopoSurface
brep_2 = Brep(move_2.Geometry)
