# Grasshopper definition BuildingElements_NonLinearVerticalBetweenTwoCurves.gh (Grasshopper 1.0.7)

# ---- group: Parameters to Control
# For smoothness, keep Amplitude at 6
amplitude = Slider(6, range=0..100)
width_of_rectangular_profile_crv = Slider(2, range=0..10)
height_of_rectangular_profile_crv = Slider(4, range=0..10)
division_count = Slider(20, range=0..50)

# ---- group: Input Higher Curve - Ensure Sim. Direction
head_curve = Curve(<curve referenced from the Rhino model>)

# ---- group: Input Lower Curve - Ensure Sim. Direction
sill_curve = Curve(<curve referenced from the Rhino model>)

# ---- group: Divide verticals and sets the domain
divide = DivideCurve(Curve=sill_curve, Count=division_count, Kinks=False)  # -> Points, Tangents, Parameters
divide_2 = DivideCurve(Curve=head_curve, Count=division_count, Kinks=False)  # -> Points, Tangents, Parameters
ln = Line(StartPoint=divide.Points, EndPoint=divide_2.Points)
divide_3 = DivideCurve(Curve=ln, Count=10, Kinks=False)  # -> Points, Tangents, Parameters
lng = ListLength(List=divide_3.Points)
range = Range(Domain=Domain(0, 1), Steps=expr("x-1", lng))

# ---- group: Controls the 'Smoothness' Of Verticals
graph = GraphMapper(
    range,
    x0=0,
    x1=-1,
    y0=0,
    y1=1,
    container_name="Sine Summation",
    Equation0_px=[0.2, 0.3],
    Equation0_py=[0.2, 0.3],
    Equation1_px=[0.6, 0.9],
    Equation1_py=[0.3, 0.5])

# ---- group: Move Points across the curve per pattern
Z = UnitZ(Factor=1)
bnd = Bounds(Numbers=graph)
neg = Negative(Value=amplitude)
dom = ConstructDomain(DomainStart=amplitude, DomainEnd=neg)
remap = RemapNumbers(Value=graph, Source=bnd, Target=dom)  # -> Mapped, Clipped
amp = Amplitude(Vector=Z, Amplitude=remap.Mapped)
move = Move(Geometry=divide_3.Points, Motion=amp)  # -> Geometry, Transform

# ----
xz = XZPlane(Origin=move.Geometry)
intcrv = Interpolate(Vertices=move.Geometry, Degree=3, Periodic=False, KnotStyle=1)  # -> Curve, Length, Domain
kinkcrv = KinkyCurve(Vertices=move.Geometry, Degree=3, Angle=0.1745329252)  # -> Curve, Length, Domain
rectangle = Rectangle(Plane=xz, XSize=width_of_rectangular_profile_crv, YSize=height_of_rectangular_profile_crv, Radius=0)  # -> Rectangle, Length
hieght = Slider(2, range=1..3)
swp1 = Sweep1(Rail=kinkcrv.Curve, Sections=rectangle.Rectangle, Miter=hieght)

# ---- group: Output - Verticals
verticals = Brep(swp1)
