# Grasshopper definition BuildingElements_OrientGeometryToCurve.gh (Grasshopper 1.0.7)

# POPULATING A CURVE WITH BREP
orienting_curve = Curve(<curve referenced from the Rhino model>)
brep_to_orient = Brep(<brep referenced from the Rhino model>)
group = Group(Objects=brep_to_orient)
bbox = BoundingBox(Content=group, Plane=PlaneXY(0, 0, 0), UnionBox=True)  # -> Box, Box_2
divdist = DivideDistance(Curve=orienting_curve, Distance=Slider(40, range=0..40))  # -> Points, Tangents, Parameters
hframe = HorizontalFrame(Curve=orienting_curve, Parameter=divdist.Parameters)
lowest_face_of_bb = LowestFaceOfBB(C=bbox.Box)  # -> i, i_2, i_3
xy = XYPlane(Origin=divdist.Points)
orient = Orient(Geometry=group, Source=lowest_face_of_bb.i_3, Target=hframe)  # -> Geometry, Transform

# ==== cluster LowestFaceOfBB
C = ClusterInput()
bbox = BoundingBox(Content=C, Plane=PlaneXY(0, 0, 0))  # -> Box, Box_2
debrep = DeconstructBrep(Brep=bbox.Box)  # -> Faces, Edges, Vertices
md_slider = MDSlider(SliderMode=0, slider_value=Point(0.5, 0.5, 0.5), x_domain=Domain(0, 1), y_domain=Domain(0, 1), z_domain=Domain(0, 1))
evalsrf = EvaluateSurface(Surface=reparameterize(debrep.Faces), Point=md_slider)  # -> Point, Normal, UDirection, VDirection, Frame
pdecon = Deconstruct(Point=evalsrf.Point)  # -> XComponent, YComponent, ZComponent
sort = SortList(Keys=pdecon.ZComponent, ValuesA=evalsrf.Frame)  # -> Keys, ValuesA
sort_2 = SortList(Keys=pdecon.ZComponent, ValuesA=evalsrf.Point)  # -> Keys, ValuesA
sort_3 = SortList(Keys=pdecon.ZComponent, ValuesA=debrep.Faces)  # -> Keys, ValuesA
item = ListItem(List=sort_3.ValuesA, Index=0, Wrap=True)
item_2 = ListItem(List=sort_2.ValuesA, Index=0, Wrap=True)
item_3 = ListItem(List=sort.ValuesA, Index=0, Wrap=True)
i = ClusterOutput(item)
i_2 = ClusterOutput(item_2)
i_3 = ClusterOutput(item_3)
