# Grasshopper definition BuildingElements_PlanterOnTopOfSlab.gh (Grasshopper 1.0.7)

# ---- group: Planter Wall Thicnkess
number_slider = Slider(6, range=0..10)

# ----
# CREATE PLANTER ON THE PERIPHERY OF A FLOOR SLAB
floor_slab = Brep(<brep referenced from the Rhino model>)

# ---- group: Planter Wall Height
number_slider_2 = Slider(24, range=0..24)

# ---- group: Planter Wall Above Surface
number_slider_3 = Slider(6, range=0..24)

# ----
highestfaceofbrep = HighestFaceOfBrep(B=floor_slab)
srf = Surface(highestfaceofbrep)

# ---- group: External Curve of surface
wires = BrepWireframe(Brep=srf, Density=-1)
join = JoinCurves(Curves=wires, Preserve=False)

# ----
crv = Curve(join)

# ---- group: Create Shell Walls
offset_inward = OffsetInward(C=crv, num=number_slider)
crv_2 = Curve([offset_inward, crv])
boundary = BoundarySurfaces(Edges=simplify(flatten(crv_2)))
Z = UnitZ(Factor=number_slider_2)
extr = Extrude(Base=boundary, Direction=Z)

# ---- group: Move Surface
crv_3 = Curve(offset_inward)
boundary_2 = BoundarySurfaces(Edges=simplify(flatten(crv_3)))
subtraction = Subtraction(A=number_slider_2, B=number_slider_3)
Z_2 = UnitZ(Factor=subtraction)
move = Move(Geometry=boundary_2, Motion=Z_2)  # -> Geometry, Transform

# ---- group: Output - Planter Walls
brep = Brep(extr)

# ---- group: Output - Planter Surface
brep_2 = Brep(move.Geometry)

# ==== cluster HighestFaceOfBrep
B = ClusterInput()
debrep = DeconstructBrep(Brep=B)  # -> Faces, Edges, Vertices
md_slider = MDSlider(SliderMode=0, slider_value=Point(0.5, 0.5, 0.5), x_domain=Domain(0, 1), y_domain=Domain(0, 1), z_domain=Domain(0, 1))
evalsrf = EvaluateSurface(Surface=reparameterize(debrep.Faces), Point=md_slider)  # -> Point, Normal, UDirection, VDirection, Frame
pdecon = Deconstruct(Point=evalsrf.Point)  # -> XComponent, YComponent, ZComponent
sort = SortList(Keys=pdecon.ZComponent, ValuesA=evalsrf.Point)  # -> Keys, ValuesA
sort_2 = SortList(Keys=pdecon.ZComponent, ValuesA=debrep.Faces)  # -> Keys, reverse(ValuesA)
item = ListItem(List=sort_2.ValuesA, Index=0, Wrap=True)
item_2 = ListItem(List=sort.ValuesA, Index=0, Wrap=True)
i = ClusterOutput(item)

# ==== cluster OffsetInward
num = ClusterInput()
C = ClusterInput()
num_2 = Number(num)
neg = Negative(Value=num_2)
offset = OffsetCurve(Curve=C, Distance=[num_2, neg], Corners=1)
area = Area(Geometry=flatten(offset))  # -> Area, Centroid
sort = SortList(Keys=area.Area, ValuesA=flatten(offset))  # -> Keys, ValuesA
item = ListItem(List=sort.ValuesA, Index=0, Wrap=True)
i = ClusterOutput(item)
