# Grasshopper definition BuildingElements_RoofCatenarySurfaceFromClosedCurve.gh (Grasshopper 1.0.7)

panel = Panel("RECTANGULAR CURVE")

# ---- group: Input - Switch Direction
toggle = BooleanToggle(True)

# ---- group: Catenary Depth
number_slider = Slider(1.5, range=0..10)

# ---- group: Input - Linear Curve
crv = Curve(<curve referenced from the Rhino model>)

# ----
crv_2 = Curve(crv)
explode = Explode(Curve=crv_2, Recursive=True)  # -> Segments, Vertices

disc = Discontinuity(Curve=crv_2, Level=1)  # -> Points, Parameters
xy = XYPlane(Origin=Point(0, 0, 0))
project = Project(Geometry=disc.Points, Plane=xy)  # -> Geometry, Transform
ln = Line(StartPoint=disc.Points, EndPoint=project.Geometry)

# ---- group: Construction of Swtich Mechanism
crv_3 = Curve(explode.Segments)
end = EndPoints(Curve=crv_3)  # -> Start, End
pdecon = Deconstruct(Point=end.Start)  # -> XComponent, YComponent, ZComponent
pdecon_2 = Deconstruct(Point=end.End)  # -> XComponent, YComponent, ZComponent
subtraction = Subtraction(A=pdecon.YComponent, B=pdecon_2.YComponent)
python = GhPythonScript(x=subtraction, bol=toggle)  # -> a; inputs x: list of Int32, bol: Boolean
# ---------- python: Python ----------
__author__ = "Brooks Scarpa"
__version__ = "2021.11.22"

import rhinoscriptsyntax as rs

a = []

for i in range(0,len(x)):
    
    if bol is False:
        
        if x[i] == 0: 
            a.append(True)
            
        else: 
            a.append(False)
            
    else:
        
        if x[i] == 0: 
            a.append(False)
            
        else: 
            a.append(True)
# ---------- end python ----------

# ----
not = GateNot(A=python)
cull = CullPattern(List=explode.Segments, CullPattern=not)
item = ListItem(List=cull, Index=0, Wrap=True)  # -> Item, Item1

# ---- group: Build Catenary Domain
lng = ListLength(List=flatten(item.Item1))
dom = ConstructDomain(DomainStart=Slider(1, range=0..10), DomainEnd=number_slider)
random = Random(Range=dom, Number=lng, Seed=Slider(3, range=0..10))  # -> graft(Random)

# ----
end_2 = EndPoints(Curve=item.Item)  # -> Start, End
end_3 = EndPoints(Curve=item.Item1)  # -> Start, End
dist = Distance(PointA=end_2.Start, PointB=end_2.End)
dist_2 = Distance(PointA=end_3.Start, PointB=end_3.End)

# ---- group: Construct Catenary Curves
expression = Expression(x=dist, y=random, Expression="round(x*y)")
expression_2 = Expression(x=dist_2, y=random, Expression="round(x*y)")
cat = Catenary(PointA=end_2.Start, PointB=end_2.End, Length=expr("x*1.25", expression), Gravity=Vector(0, 0, -1))
cat_2 = Catenary(PointA=end_3.Start, PointB=end_3.End, Length=expr("x*1.25", expression_2), Gravity=Vector(0, 0, -1))
reb = RebuildCurve(Curve=cat_2, Degree=3, Count=5, Tangents=False)
reb_2 = RebuildCurve(Curve=cat, Degree=3, Count=5, Tangents=False)

# ---- group: Linear Boundary Curves
cull_2 = CullPattern(List=explode.Segments, CullPattern=python)
item_2 = ListItem(List=cull_2, Index=0, Wrap=True)  # -> Item, Item1

# ----
edgesrf = EdgeSurface(CurveA=item_2.Item, CurveB=reb_2, CurveC=item_2.Item1, CurveD=reb)

# ---- group: Output - Line Diagram Columns
columns = Curve(ln)

# ---- group: Output - Catenary Roof
srf = Surface(edgesrf)
