# Grasshopper definition BuildingElements_RoofPaneling (MEWA).gh (Grasshopper 1.0.7)

# ---- group: V Value Divider
number_slider = Slider(24, range=0..200)

# ---- group: U Value Divider
number_slider_2 = Slider(48, range=0..200)

# ---- group: BASE SURFACE
# POPULATING A SURFACE WITH BREP AND ROTATING IT USING PATTERN MAPPER
surface = Surface(graft(<surface referenced from the Rhino model>))

# ---- group: Panel
mesh = Mesh(<mesh referenced from the Rhino model>)

# ----
dim = Dimensions(Surface=surface)  # -> UDimension, VDimension
expression = Expression(x=dim.UDimension, y=number_slider_2, Expression="round(x/y)")
expression_2 = Expression(x=dim.VDimension, y=number_slider, Expression="round(x/y)")
divide_domain² = DivideDomain²(Domain=surface, UCount=expression, VCount=expression_2)
isotrim = Isotrim(Surface=surface, Domain=divide_domain²)
md_slider = MDSlider(SliderMode=0, slider_value=Point(0.5, 0.5, 0.5), x_domain=Domain(0, 1), y_domain=Domain(0, 1), z_domain=Domain(0, 1))
evaluate_surface = EvaluateSurface(Surface=reparameterize(isotrim), Point=md_slider)  # -> Point, Normal, UDirection, VDirection, Frame

# ---- group: Get Center Point of Object To Orient
bbox = BoundingBox(Content=mesh, Plane=PlaneXY(0, 0, 0))  # -> Box, Box_2
volume = Volume(Geometry=bbox.Box)  # -> Volume, Centroid

# ----
Z = UnitZ(Factor=1)
move = Move(Geometry=evaluate_surface.Point, Motion=Z)  # -> Geometry, Transform
project = ProjectPoint(Point=move.Geometry, Direction=Vector(0, 0, -1), Geometry=surface)  # -> Point, Index
xy = XYPlane(Origin=project.Point)

# ---- group: SRF BASE POINT
point = Point(volume.Centroid)
xy_plane = XYPlane(Origin=point)

# ----
orient = Orient(Geometry=mesh, Source=xy_plane, Target=xy)  # -> Geometry, Transform
area = Area(Geometry=orient.Geometry)  # -> Area, Centroid

# ---- group: Mapping Patter
image_sampler = ImageSampler(area.Centroid, Filter="Value", Interpolate=True, Umax=150, Umin=0, Vmax=200, Vmin=0, Wrap=1)

# ----
dom = ConstructDomain(DomainStart=Slider(0, range=0..5), DomainEnd=Slider(2.5, range=0..5))
remap_numbers = RemapNumbers(Value=image_sampler, Source=Domain(0, 1), Target=dom)  # -> Mapped, Clipped
yz_plane = YZPlane(Origin=Point(0, 0, 0))
rotate_3d = Rotate3D(Geometry=orient.Geometry, Angle=remap_numbers.Mapped, Center=area.Centroid, Axis=yz_plane)  # -> Geometry, Transform

# ---- group: Output - Surface Meshes
mesh_2 = Mesh(rotate_3d.Geometry)
