# Grasshopper definition BuildingElements_RoofSolarPanelsBySurface.gh (Grasshopper 1.0.7)

# ---- group: Input - Surface
# POPULATE A RECTANGULAR SURFACE WITH SOLAR PANELS
srf = Surface(<surface referenced from the Rhino model>)

# ----
untrim = Untrim(Surface=srf)

dim = Dimensions(Surface=untrim)  # -> UDimension, VDimension
expression = Expression(x=dim.UDimension, Expression="round(x/1.2,0)")
expression_2 = Expression(x=dim.VDimension, Expression="round(x/3.2,0)")
divide = DivideDomain²(Domain=untrim, UCount=expression, VCount=expression_2)

Z = UnitZ(Factor=5)
Z_2 = UnitZ(Factor=2)
extr = Extrude(Base=srf, Direction=Z)
neg = Negative(Value=Z_2)
move = Move(Geometry=extr, Motion=neg)  # -> Geometry, Transform

subsrf = Isotrim(Surface=untrim, Domain=divide)

shapein = ShapeInBrep(Brep=move.Geometry, Shape=subsrf)
python = GhPythonScript(x=shapein)  # -> out, a
# ---------- python: Python ----------
__author__ = "Brooks Scarpa"
__version__ = "2022.08.30"

import rhinoscriptsyntax as rs

if x == 0: 
    a = True
else:
    a = False
# ---------- end python ----------
cull = CullPattern(List=subsrf, CullPattern=python.a)
area = Area(Geometry=cull)  # -> Area, Centroid

dim_2 = Dimensions(Surface=cull)  # -> UDimension, VDimension
item = ListItem(List=dim_2.UDimension, Index=0, Wrap=True)
item_2 = ListItem(List=dim_2.VDimension, Index=0, Wrap=True)
expression_3 = Expression(x=item, Expression="1/x")
expression_4 = Expression(x=item_2, Expression="3/x")

scale_nu = ScaleNU(Geometry=cull, Plane=area.Centroid, ScaleX=expression_3, ScaleY=expression_4, ScaleZ=1)  # -> Geometry, Transform
Z_3 = UnitZ(Factor=Slider(0.05, range=0..0.1))
extr_2 = Extrude(Base=scale_nu.Geometry, Direction=Z_3)
move_2 = Move(Geometry=extr_2, Motion=Z_3)  # -> Geometry, Transform

# ---- group: Output Solar Panels
mesh = Mesh(move_2.Geometry)
