# Grasshopper definition BuildingElements_SpaceTruss (MEWA).gh (Grasshopper 1.0.7)
# plug-ins: LunchBox, Pufferfish, Kangaroo2 Components

shrinktrimsrf = ShrinkTrimmedSurface()  # -> Shrunken, Underlying, R

# ---- group: Upper Surface
srf = Surface(<surface referenced from the Rhino model>)

# ---- group: Space Truss Spacing
spacing_dimension = Slider(3, range=0..10)

# ---- group: Buttom Surface/Polysurface
brep = Brep(<brep referenced from the Rhino model>)

# ----
dim = Dimensions(Surface=srf)  # -> UDimension, VDimension
expression = Expression(x=dim.UDimension, y=spacing_dimension, Expression="round(x/y,0)")
expression_2 = Expression(x=dim.VDimension, y=spacing_dimension, Expression="round(x/y,0)")
quads = QuadPanels(Surface=srf, UDivisions=expression, VDivisions=expression_2)

Z = UnitZ(Factor=5)
Z_2 = UnitZ(Factor=2)
extr = Extrude(Base=srf, Direction=Z)
neg = Negative(Value=Z_2)
move = Move(Geometry=extr, Motion=neg)  # -> Geometry, Transform

shapein = ShapeInBrep(Brep=move.Geometry, Shape=quads)
python = GhPythonScript(x=shapein)  # -> out, a
# ---------- python: Python ----------
__author__ = "Brooks Scarpa"
__version__ = "2022.08.30"

import rhinoscriptsyntax as rs

if x == 0: 
    a = True
else:
    a = False
# ---------- end python ----------
cull = CullPattern(List=quads, CullPattern=python.a)  # -> graft(List)
area = Area(Geometry=cull)  # -> Area, Centroid
debrep = DeconstructBrep(Brep=cull)  # -> Faces, Edges, simplify(Vertices)
item = ListItem(List=debrep.Vertices, Index=0, Wrap=True)  # -> Item, Item1, Item2, Item3
pt = Point(area.Centroid)
project = ProjectPoint(Point=debrep.Vertices, Direction=Vector(0, 0, -1), Geometry=brep)  # -> Point, Index
project_2 = ProjectPoint(Point=pt, Direction=Vector(0, 0, -1), Geometry=brep)  # -> Point, Index
item_2 = ListItem(List=project.Point, Index=0, Wrap=True)  # -> Item, Item1, Item2, Item3
pt_2 = Point(flatten(project_2.Point))
pt_3 = Point(flatten(project_2.Point))
pt_4 = Point(flatten(debrep.Vertices))
pt_5 = Point(flatten(debrep.Vertices))

ln = Line(StartPoint=item.Item, EndPoint=project_2.Point)
ln_2 = Line(StartPoint=project_2.Point, EndPoint=item.Item1)
ln_3 = Line(StartPoint=project_2.Point, EndPoint=item.Item2)
ln_4 = Line(StartPoint=project_2.Point, EndPoint=item.Item3)

ln_5 = Line(StartPoint=item_2.Item, EndPoint=item.Item)
ln_6 = Line(StartPoint=item_2.Item1, EndPoint=item.Item1)
ln_7 = Line(StartPoint=item_2.Item2, EndPoint=item.Item2)
ln_8 = Line(StartPoint=item_2.Item3, EndPoint=item.Item3)

merge = Merge(Data1=ln, Data2=ln_2, Data3=ln_3, Data4=ln_4)
merge_2 = Merge(Data1=ln_5, Data2=ln_6, Data3=ln_7, Data4=ln_8)

# ---- group: Group Points by X Value
pdecon = Deconstruct(Point=pt_2)  # -> XComponent, YComponent, ZComponent
pt_6 = ConstructPoint(XCoordinate=pdecon.XComponent, YCoordinate=0, ZCoordinate=0)
pgroups = PointGroups(Points=pt_6, Distance=Slider(1, range=0..1))  # -> Groups, Indices

# ----
pdecon_2 = Deconstruct(Point=pt_4)  # -> XComponent, YComponent, ZComponent
pt_7 = ConstructPoint(XCoordinate=pdecon_2.XComponent, YCoordinate=0, ZCoordinate=0)
pgroups_2 = PointGroups(Points=pt_7, Distance=Slider(1, range=0..1))  # -> Groups, Indices
item_3 = ListItem(List=pt_4, Index=pgroups_2.Indices, Wrap=True)

# ---- group: Group Points by X Value
pdecon_3 = Deconstruct(Point=pt_3)  # -> XComponent, YComponent, ZComponent
pt_8 = ConstructPoint(XCoordinate=0, YCoordinate=pdecon_3.YComponent, ZCoordinate=0)
pgroups_3 = PointGroups(Points=pt_8, Distance=Slider(1, range=0..1))  # -> Groups, Indices

# ----
pdecon_4 = Deconstruct(Point=pt_5)  # -> XComponent, YComponent, ZComponent
pt_9 = ConstructPoint(XCoordinate=0, YCoordinate=pdecon_4.YComponent, ZCoordinate=0)
pgroups_4 = PointGroups(Points=pt_9, Distance=Slider(1, range=0..1))  # -> Groups, Indices
item_4 = ListItem(List=pt_5, Index=pgroups_4.Indices, Wrap=True)

dupln = RemoveDuplicateLines(Lines=flatten(merge_2), Tolerance=0.01)
item_5 = ListItem(List=pt_2, Index=pgroups.Indices, Wrap=True)
item_6 = ListItem(List=pt_3, Index=pgroups_3.Indices, Wrap=True)

# ---- group: Sort Points by Y Value
pdecon_5 = Deconstruct(Point=item_5)  # -> XComponent, YComponent, ZComponent
sort = SortList(Keys=pdecon_5.YComponent, ValuesA=item_5)  # -> Keys, ValuesA

pdecon_6 = Deconstruct(Point=item_3)  # -> XComponent, YComponent, ZComponent
sort_2 = SortList(Keys=pdecon_6.YComponent, ValuesA=item_3)  # -> Keys, ValuesA

pdecon_7 = Deconstruct(Point=item_6)  # -> XComponent, YComponent, ZComponent
sort_3 = SortList(Keys=pdecon_7.XComponent, ValuesA=item_6)  # -> Keys, ValuesA

pdecon_8 = Deconstruct(Point=item_4)  # -> XComponent, YComponent, ZComponent
sort_4 = SortList(Keys=pdecon_8.XComponent, ValuesA=item_4)  # -> Keys, ValuesA

# ----
pline = PolyLine(Vertices=sort.ValuesA, Closed=False)
pline_2 = PolyLine(Vertices=sort_2.ValuesA, Closed=False)
pline_3 = PolyLine(Vertices=sort_3.ValuesA, Closed=False)
pline_4 = PolyLine(Vertices=sort_4.ValuesA, Closed=False)
space_truss_diagonal_chords = Curve(merge)
space_truss_vertical_chords = Curve(dupln)  # disabled
upper_x_truss_chord = Curve(pline_2)
upper_y_truss_chord = Curve(pline_4)
bottom_x_truss_chord = Curve(pline)
bottom_y_truss_chord = Curve(pline_3)
