# Grasshopper definition BuildingElements_StructuralFramingBetweenTwoCurves.gh (Grasshopper 1.0.7)

panel = Panel("TOP RAIL")
panel_2 = Panel("BOTTOM RAIL")
panel_3 = Panel("ORIENTING POINT")
panel_4 = Panel("CURVE PROFILE")

# ---- group: Input - Curve A
crv = Curve(<curve referenced from the Rhino model>)

# ---- group: Input - Curve B
crv_2 = Curve(<curve referenced from the Rhino model>)

# ---- group: Input O.C spacing
number_slider = Slider(16, range=0..100)

# ---- group: Input - Framing Profile
crv_3 = Curve(<curve referenced from the Rhino model>)

# ---- group: Input - Point to orient from
pt = Point(Point(449.6363366, -170.7334856, 0))

# ----
end = EndPoints(Curve=crv_2)  # -> Start, End
edgesrf = EdgeSurface(CurveA=crv, CurveB=crv_2)
vec2pt = Vector2Pt(PointA=end.Start, PointB=end.End, Unitize=False)  # -> Vector, Length
vec = Vector(vec2pt.Vector)
pt_2 = Point(end.Start)
srf = Surface(edgesrf)
contour = Contour(Shape=srf, Point=pt_2, Direction=vec, Distance=number_slider)
crv_4 = Curve(contour)
end_2 = EndPoints(Curve=crv_4)  # -> Start, End
ln = Line(StartPoint=end_2.Start, EndPoint=end_2.End)

# ---- group: Unclear if this connects to contour or the other Pt
pt_3 = Point(Point(-444, 4.636149242e-10, 158))

# ----
line = Line(ln)
end_3 = EndPoints(Curve=line)  # -> Start, End
pt_4 = Point(end_3.Start)
pcomp = PlaneComponents(Plane=pt_4)  # -> Origin, XAxis, YAxis, ZAxis
pcomp_2 = PlaneComponents(Plane=pt)  # -> Origin, XAxis, YAxis, ZAxis
pl = Plane(Origin=pcomp.Origin, XAxis=pcomp.XAxis, YAxis=expr("-x", pcomp.ZAxis))
pl_2 = Plane(Origin=pcomp_2.Origin, XAxis=pcomp_2.XAxis, YAxis=expr("-x", pcomp_2.ZAxis))
orient = Orient(Geometry=crv_3, Source=pl_2, Target=pl)  # -> Geometry, Transform
extrcrv = ExtrudeAlong(Base=orient.Geometry, Curve=line)
cap = CapHoles(Brep=extrcrv)

# ---- group: Output - Framing
brep = Brep(cap)
