# Grasshopper definition BuildingElements_StructuralFramingBySurface.gh (Grasshopper 1.0.7)

# ---- group: Input - Profile
profile = Curve(<curve referenced from the Rhino model>)

# ---- group: Input Surface
srf = Surface(<surface referenced from the Rhino model>)

# ---- group: Spacing
number_slider = Slider(12, range=0..100)

# ---- group: Toggle between by Profile and Std. Rec. Framing
toggle = BooleanToggle(True)

# ---- group: Toggle Directions
toggle_2 = BooleanToggle(True)

# ---- group: Height
member_height = Slider(11, range=0..24)

# ---- group: Width
member_width = Slider(2, range=0..10)

# ----
bbox = BoundingBox(Content=profile, Plane=PlaneXY(0, 0, 0))  # -> Box, Box_2
area = Area(Geometry=bbox.Box)  # -> Area, Centroid
xy = XYPlane(Origin=area.Centroid)
pln = Plane(xy)

srf_2 = Surface(srf)

wires = BrepWireframe(Brep=srf_2, Density=-1)
item = ListItem(List=wires, Index=0, Wrap=True)  # -> Item, Item1, Item2, Item3
crv = Curve(item.Item)
crv_2 = Curve(item.Item2)
crv_3 = Curve(item.Item1)
crv_4 = Curve(item.Item3)
flip = FlipCurve(Curve=crv_2)  # -> Curve, Flag
flip_2 = FlipCurve(Curve=crv_4)  # -> Curve, Flag
filter = StreamFilter(Gate=toggle_2, Stream0=[crv, crv_2], Stream1=[crv_3, crv_4])
item_2 = ListItem(List=filter, Index=0, Wrap=True)  # -> Item, Item1

len = Length(Curve=item_2.Item)
len_2 = Length(Curve=item_2.Item1)
expression = Expression(x=len, y=number_slider, Expression="Round(x/y,0)")
expression_2 = Expression(x=len_2, y=number_slider, Expression="Round(x/y,0)")
divide = DivideCurve(Curve=item_2.Item, Count=expression, Kinks=False)  # -> Points, Tangents, Parameters
divide_2 = DivideCurve(Curve=item_2.Item1, Count=expression_2, Kinks=False)  # -> reverse(Points), Tangents, Parameters

short = ShortestList(ListA=divide.Points, ListB=divide_2.Points, TrimMode=2)  # -> ListA, ListB
ln = Line(StartPoint=short.ListA, EndPoint=short.ListB)  # -> graft(Line)
pframe = PerpFrame(Curve=ln, Parameter=[0, 1])
gate = StreamGate(Stream=pframe, Gate=simplify(toggle))  # -> Target0, Target1

width = Number(expr("x/2", member_width))
height = Number(expr("x/2", member_height))
dom = ConstructDomain(DomainStart=height, DomainEnd=expr("-x", height))
dom_2 = ConstructDomain(DomainStart=width, DomainEnd=expr("-x", width))
rectangle = Rectangle(Plane=gate.Target1, XSize=dom, YSize=dom_2, Radius=0)  # -> Rectangle, Length
loft = Loft(
    Curves=rectangle.Rectangle,
    Options={Adjust=False, Closed=False, LoftEnds=0, LoftSimp=0, LoftType=0, Rebuild=10, Refit=0.01})
cap = CapHoles(Brep=loft)

profile_2 = Curve(profile)
pln_2 = Plane(pln)
orient = Orient(Geometry=profile_2, Source=pln_2, Target=gate.Target0)  # -> Geometry, Transform
loft_2 = Loft(Curves=orient.Geometry, Options={Adjust=False, Closed=False, LoftEnds=0, LoftSimp=0, LoftType=0, Rebuild=10, Refit=0.01})
cap_2 = CapHoles(Brep=loft_2)

# ---- group: Output - Framing
brep = Brep(cap_2)

brep_2 = Brep(cap)
