# Grasshopper definition BuildingElements_SweepProfileAlongCurve.gh (Grasshopper 1.0.7)

# ---- group: Rotate Stringer Profile
number_slider = Slider(0, range=0..1000)

# ---- group: Input - Curve
rail_curve = Curve(reparameterize(graft([<curve referenced from the Rhino model> x3])))

# ---- group: Input Stringer Profile
c_shape = Curve(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)

# ----
bbox = BoundingBox(Content=c_shape, Plane=PlaneXY(0, 0, 0))  # -> Box, Box_2
area = Area(Geometry=bbox.Box)  # -> Area, Centroid
xy = XYPlane(Origin=area.Centroid)

eval = EvaluateCurve(Curve=rail_curve, Parameter=0)  # -> Point, Tangent, Angle
pframe = PerpFrame(Curve=rail_curve, Parameter=eval.Tangent)
deplane = DeconstructPlane(Plane=pframe)  # -> Origin, XAxis, YAxis, ZAxis
orient = Orient(Geometry=c_shape, Source=xy, Target=pframe)  # -> Geometry, Transform
unit = UnitVector(Vector=deplane.ZAxis)

rot3d = Rotate3D(Geometry=orient.Geometry, Angle=degrees(number_slider), Center=pframe, Axis=unit)  # -> Geometry, Transform
swp1 = Sweep1(Rail=rail_curve, Sections=rot3d.Geometry, Miter=1)
cap = CapHoles(Brep=swp1)

output_geometry = Brep(cap)
