# Grasshopper definition BuildingElements_WindowByClosedCurve.gh (Grasshopper 1.0.7)

# ---- group: Input Thinkness of Frame
thickness_of_frame = Slider(2, range=0..10)

# ---- group: Input - Window horizontal Height
number_slider = Slider(36, range=0..36)

# ---- group: Input - Window Outline Curve
window_curve = Curve(<curve referenced from the Rhino model>)

# ----
offset_inward = OffsetInward(C=window_curve, num=thickness_of_frame)
interior_frame = Curve(offset_inward)
expression = Expression(x=number_slider, y=thickness_of_frame, Expression="x+y")
Z = UnitZ(Factor=[number_slider, expression])

getsrflowerupperedges = GetSrfLowerUpperEdges(B=interior_frame)  # -> i, item_3

lower_edge = Curve(getsrflowerupperedges.i)
move = Move(Geometry=lower_edge, Motion=Z)  # -> Geometry, Transform

boundary = BoundarySurfaces(Edges=interior_frame)
boundary_2 = BoundarySurfaces(Edges=[window_curve, interior_frame])
loft = Loft(Curves=move.Geometry, Options={Adjust=False, Closed=False, LoftEnds=0, LoftSimp=0, LoftType=0, Rebuild=10, Refit=0.01})
glass = Surface(boundary)

md_slider = MDSlider(SliderMode=0, slider_value=Point(0.5, 0.5, 0.5), x_domain=Domain(0, 1), y_domain=Domain(0, 1), z_domain=Domain(0, 1))
evalsrf = EvaluateSurface(Surface=reparameterize(glass), Point=md_slider)  # -> Point, Normal, UDirection, VDirection, Frame

amp = Amplitude(Vector=evalsrf.Normal, Amplitude=thickness_of_frame)
extr = Extrude(Base=[loft, boundary_2], Direction=amp)  # -> flatten(Extrusion)

glass_surface = Surface(glass)
window_frame = Brep(extr)

# ---- group: Output - Window Group
group = Group(Objects=[glass_surface, window_frame])

# ==== cluster OffsetInward
num = ClusterInput()
C = ClusterInput()
num_2 = Number(num)
neg = Negative(Value=num_2)
offset = OffsetCurve(Curve=C, Distance=[num_2, neg], Corners=1)
area = Area(Geometry=flatten(offset))  # -> Area, Centroid
sort = SortList(Keys=area.Area, ValuesA=flatten(offset))  # -> Keys, ValuesA
item = ListItem(List=sort.ValuesA, Index=0, Wrap=True)
i = ClusterOutput(item)

# ==== cluster GetSrfLowerUpperEdges
B = ClusterInput()
edges = BrepEdges(Brep=B)  # -> Naked, Interior, NonManifold
crv = Curve(edges.Naked)
midpt = CurveMiddle(Curve=crv)
pdecon = Deconstruct(Point=midpt)  # -> XComponent, YComponent, ZComponent
sort = SortList(Keys=pdecon.ZComponent, ValuesA=crv)  # -> Keys, ValuesA
item = ListItem(List=sort.ValuesA, Index=0, Wrap=True)  # -> Item, Item1, Item2, Item3
i = ClusterOutput(item.Item)
item_3 = ClusterOutput(item.Item3)
