# Grasshopper definition Data_BoundingBoxDimensioning.gh (Grasshopper 1.0.7)

brep = Brep([<brep referenced from the Rhino model> x9])
bbox = BoundingBox(Content=brep, Plane=PlaneXY(0, 0, 0))  # -> Box, Box_2

debrep = DeconstructBrep(Brep=brep)  # -> reparameterize(Faces), Edges, Vertices
bbox_2 = BoundingBox(Content=debrep.Faces, Plane=PlaneXY(0, 0, 0))  # -> Box, Box_2
volume = Volume(Geometry=bbox_2.Box)  # -> Volume, Centroid
sort = SortList(Keys=volume.Centroid, ValuesA=bbox_2.Box)  # -> Keys, reverse(ValuesA)
item = ListItem(List=sort.ValuesA, Index=0, Wrap=True)
debrep_2 = DeconstructBrep(Brep=item)  # -> reparameterize(Faces), Edges, Vertices
area = Area(Geometry=debrep_2.Faces)  # -> Area, Centroid
pdecon = Deconstruct(Point=area.Centroid)  # -> XComponent, YComponent, ZComponent
sort_2 = SortList(Keys=pdecon.ZComponent, ValuesA=debrep_2.Faces)  # -> Keys, ValuesA

box_corners = BoxCorners(Box=bbox.Box)  # -> CornerA, CornerB, CornerC, CornerD, CornerE, CornerF, CornerG, CornerH
number_slider = Slider(4, range=0..100)
ln = Line(StartPoint=box_corners.CornerA, EndPoint=box_corners.CornerE)
item_2 = ListItem(List=sort_2.ValuesA, Index=0, Wrap=True)
flatten = FlattenTree(Tree=item_2, Path="{0}")
brep_2 = Brep(<brep referenced from the Rhino model>)
area_2 = Area(Geometry=flatten)  # -> Area, Centroid
area_3 = Area(Geometry=brep_2)  # -> Area, Centroid
xy = XYPlane(Origin=area_3.Centroid)
project = Project(Geometry=area_2.Centroid, Plane=xy)  # -> Geometry, Transform
ln_2 = Line(StartPoint=area_2.Centroid, EndPoint=project.Geometry)
lineardim = LinearDimension(Line=ln, PointA=box_corners.CornerA, PointB=box_corners.CornerE, Text="Upper End{0:0.00}", Size=number_slider)
lineardim_2 = LinearDimension(Line=ln_2, PointA=area_2.Centroid, PointB=project.Geometry, Text="Lower End {0:0.00}", Size=number_slider)
