# Grasshopper definition Data_Floor Area CalculationsByFloor.gh (Grasshopper 1.0.7)

# FIRST FLOOR PROGRAM
multipurpose_hall_assembly = Brep(<brep referenced from the Rhino model>)
digital_modeling_fabrication = Brep(<brep referenced from the Rhino model>)
accessory_spaces = Brep([<brep referenced from the Rhino model> x2])
tele_comm = Brep(<brep referenced from the Rhino model>)
storage = Brep()
exterior_accessory_spaces = Brep([<brep referenced from the Rhino model> x4])
accessory_spaces_2 = Brep([<brep referenced from the Rhino model> x4])

# ---- group: Calculation of 1 floor mass
debrep = DeconstructBrep(Brep=digital_modeling_fabrication)  # -> Faces, Edges, Vertices
floor_slab_area = FloorSlabArea(S=debrep.Faces, L=debrep.Faces)  # -> A, C, L_2
center = Point(floor_slab_area.C)
floors = Surface(floor_slab_area.L_2)
panel = Panel(floor_slab_area.A)
flatten = FlattenTree(Tree=panel, Path="{0}")

# ---- group: Calculation 2 Floor mass
debrep_2 = DeconstructBrep(Brep=digital_modeling_fabrication)  # -> Faces, Edges, Vertices
_2_floor_area_calc = _2FloorAreaCalc(S=debrep_2.Faces, L=debrep_2.Faces)  # -> A, L_2, C
floors_2 = Surface(_2_floor_area_calc.L_2)
center_2 = Point(_2_floor_area_calc.C)
mass_addition = MassAddition(Input=_2_floor_area_calc.A)  # -> Result, PartialResults

# ---- group: Calculation of 1 floor mass
debrep_3 = DeconstructBrep(Brep=multipurpose_hall_assembly)  # -> Faces, Edges, Vertices
floor_slab_area_2 = FloorSlabArea(S=debrep_3.Faces, L=debrep_3.Faces)  # -> A, C, L_2
center_3 = Point(floor_slab_area_2.C)
floors_3 = Surface(floor_slab_area_2.L_2)
panel_2 = Panel(floor_slab_area_2.A)
flatten_2 = FlattenTree(Tree=panel_2, Path="{0}")

# ---- group: Calculation 2 Floor mass
debrep_4 = DeconstructBrep(Brep=multipurpose_hall_assembly)  # -> Faces, Edges, Vertices
_2_floor_area_calc_2 = _2FloorAreaCalc(S=debrep_4.Faces, L=debrep_4.Faces)  # -> A, L_2, C
center_4 = Point(_2_floor_area_calc_2.C)
floors_4 = Surface(_2_floor_area_calc_2.L_2)
mass_addition_2 = MassAddition(Input=_2_floor_area_calc_2.A)  # -> Result, PartialResults

# ---- group: Calculation of 1 floor mass
debrep_5 = DeconstructBrep(Brep=accessory_spaces)  # -> Faces, Edges, Vertices
floor_slab_area_3 = FloorSlabArea(S=debrep_5.Faces, L=debrep_5.Faces)  # -> A, C, L_2
center_5 = Point(floor_slab_area_3.C)
floors_5 = Surface(floor_slab_area_3.L_2)
panel_3 = Panel(floor_slab_area_3.A)
flatten_3 = FlattenTree(Tree=panel_3, Path="{0}")

# ---- group: Calculation 2 Floor mass
debrep_6 = DeconstructBrep(Brep=accessory_spaces)  # -> Faces, Edges, Vertices
_2_floor_area_calc_3 = _2FloorAreaCalc(S=debrep_6.Faces, L=debrep_6.Faces)  # -> A, L_2, C
floors_6 = Surface(_2_floor_area_calc_3.L_2)
center_6 = Point(_2_floor_area_calc_3.C)
mass_addition_3 = MassAddition(Input=_2_floor_area_calc_3.A)  # -> Result, PartialResults

# ---- group: Calculation of 1 floor mass
debrep_7 = DeconstructBrep(Brep=storage)  # -> Faces, Edges, Vertices
floor_slab_area_4 = FloorSlabArea(S=debrep_7.Faces, L=debrep_7.Faces)  # -> A, C, L_2
center_7 = Point(floor_slab_area_4.C)
floors_7 = Surface(floor_slab_area_4.L_2)
panel_4 = Panel(floor_slab_area_4.A)
flatten_4 = FlattenTree(Tree=panel_4, Path="{0}")

# ---- group: Calculation 2 Floor mass
debrep_8 = DeconstructBrep(Brep=storage)  # -> Faces, Edges, Vertices
_2_floor_area_calc_4 = _2FloorAreaCalc(S=debrep_8.Faces, L=debrep_8.Faces)  # -> A, L_2, C
floors_8 = Surface(_2_floor_area_calc_4.L_2)
center_8 = Point(_2_floor_area_calc_4.C)
mass_addition_4 = MassAddition(Input=_2_floor_area_calc_4.A)  # -> Result, PartialResults

# ---- group: Calculation of 1 floor mass
debrep_9 = DeconstructBrep(Brep=tele_comm)  # -> Faces, Edges, Vertices
floor_slab_area_5 = FloorSlabArea(S=debrep_9.Faces, L=debrep_9.Faces)  # -> A, C, L_2
floors_9 = Surface(floor_slab_area_5.L_2)
center_9 = Point(floor_slab_area_5.C)
panel_5 = Panel(floor_slab_area_5.A)
flatten_5 = FlattenTree(Tree=panel_5, Path="{0}")

# ---- group: Calculation 2 Floor mass
debrep_10 = DeconstructBrep(Brep=tele_comm)  # -> Faces, Edges, Vertices
_2_floor_area_calc_5 = _2FloorAreaCalc(S=debrep_10.Faces, L=debrep_10.Faces)  # -> A, L_2, C
center_10 = Point(_2_floor_area_calc_5.C)
floors_10 = Surface(_2_floor_area_calc_5.L_2)
mass_addition_5 = MassAddition(Input=_2_floor_area_calc_5.A)  # -> Result, PartialResults

# ---- group: Calculation of 1 floor mass
# EXTERIOR ACCESORY SPACES
debrep_11 = DeconstructBrep(Brep=exterior_accessory_spaces)  # -> Faces, Edges, Vertices
floor_slab_area_6 = FloorSlabArea(S=debrep_11.Faces, L=debrep_11.Faces)  # -> A, C, L_2
floors_11 = Surface(floor_slab_area_6.L_2)
center_11 = Point(floor_slab_area_6.C)
panel_6 = Panel(floor_slab_area_6.A)
flatten_6 = FlattenTree(Tree=panel_6, Path="{0}")

# ---- group: Calculation 2 Floor mass
debrep_12 = DeconstructBrep(Brep=exterior_accessory_spaces)  # -> Faces, Edges, Vertices
_2_floor_area_calc_6 = _2FloorAreaCalc(S=debrep_12.Faces, L=debrep_12.Faces)  # -> A, L_2, C
floors_12 = Surface(_2_floor_area_calc_6.L_2)
center_12 = Point(_2_floor_area_calc_6.C)
mass_addition_6 = MassAddition(Input=_2_floor_area_calc_6.A)  # -> Result, PartialResults

# ---- group: Calculation of 1 floor mass
# MECHANICAL
debrep_13 = DeconstructBrep(Brep=accessory_spaces_2)  # -> Faces, Edges, Vertices
floor_slab_area_7 = FloorSlabArea(S=debrep_13.Faces, L=debrep_13.Faces)  # -> A, C, L_2
floors_13 = Surface(floor_slab_area_7.L_2)
center_13 = Point(floor_slab_area_7.C)
panel_7 = Panel(floor_slab_area_7.A)
flatten_7 = FlattenTree(Tree=panel_7, Path="{0}")

# ---- group: Calculation 2 Floor mass
debrep_14 = DeconstructBrep(Brep=accessory_spaces_2)  # -> Faces, Edges, Vertices
_2_floor_area_calc_7 = _2FloorAreaCalc(S=debrep_14.Faces, L=debrep_14.Faces)  # -> A, L_2, C
floors_14 = Surface(_2_floor_area_calc_7.L_2)
center_14 = Point(_2_floor_area_calc_7.C)
mass_addition_7 = MassAddition(Input=_2_floor_area_calc_7.A)  # -> Result, PartialResults

# ----
value_list = ValueList({"1 Floor": 0, "2 Floors": 1}, selected="1 Floor")
value_list_2 = ValueList({"1 Floor": 0, "2 Floors": 1}, selected="1 Floor")
value_list_3 = ValueList({"1 Floor": 0, "2 Floors": 1}, selected="1 Floor")
value_list_4 = ValueList({"1 Floor": 0, "2 Floors": 1}, selected="1 Floor")
value_list_5 = ValueList({"1 Floor": 0, "2 Floors": 1}, selected="1 Floor")
value_list_6 = ValueList({"1 Floor": 0, "2 Floors": 1}, selected="1 Floor")
value_list_7 = ValueList({"1 Floor": 0, "2 Floors": 1}, selected="1 Floor")
stream_filter = StreamFilter(Gate=value_list, Stream0=flatten_4, Stream1=mass_addition_4.Result)
stream_filter_2 = StreamFilter(Gate=value_list_2, Stream0=flatten_2, Stream1=mass_addition_2.Result)
stream_filter_3 = StreamFilter(Gate=value_list_3, Stream0=flatten, Stream1=mass_addition.Result)
stream_filter_4 = StreamFilter(Gate=value_list_4, Stream0=flatten_3, Stream1=mass_addition_3.Result)
stream_filter_5 = StreamFilter(Gate=value_list_5, Stream0=flatten_5, Stream1=mass_addition_5.Result)
stream_filter_6 = StreamFilter(Gate=value_list_6, Stream0=flatten_6, Stream1=mass_addition_6.Result)
stream_filter_7 = StreamFilter(Gate=value_list_7, Stream0=flatten_7, Stream1=mass_addition_7.Result)
tag = TextTag(Location=center_3, Text=stream_filter_2)
mass_addition_8 = MassAddition(Input=stream_filter_2)  # -> Result, PartialResults
tag_2 = TextTag(Location=center, Text=stream_filter_3)
mass_addition_9 = MassAddition(Input=stream_filter_3)  # -> Result, PartialResults
tag_3 = TextTag(Location=center_5, Text=stream_filter_4)
mass_addition_10 = MassAddition(Input=stream_filter_4)  # -> Result, PartialResults
tag_4 = TextTag(Location=center_9, Text=stream_filter_5)
mass_addition_11 = MassAddition(Input=stream_filter_5)  # -> Result, PartialResults
tag_5 = TextTag(Location=center_7, Text=stream_filter)
mass_addition_12 = MassAddition(Input=stream_filter)  # -> Result, PartialResults
tag_6 = TextTag(Location=center_11, Text=stream_filter_6)
mass_addition_13 = MassAddition(Input=stream_filter_6)  # -> Result, PartialResults
tag_7 = TextTag(Location=center_13, Text=stream_filter_7)
mass_addition_14 = MassAddition(Input=stream_filter_7)  # -> Result, PartialResults
panel_8 = Panel(mass_addition_8.Result)
panel_9 = Panel(mass_addition_9.Result)
panel_10 = Panel(mass_addition_10.Result)
panel_11 = Panel(mass_addition_11.Result)
panel_12 = Panel(mass_addition_12.Result)
panel_13 = Panel(mass_addition_13.Result)
panel_14 = Panel(mass_addition_14.Result)
mass_addition_15 = MassAddition(Input=[panel_11, panel_10, panel_9, panel_8])  # -> Result, PartialResults
digital_modeling_fabrication_2 = Brep(<brep referenced from the Rhino model>)
research_hub = Brep([<brep referenced from the Rhino model> x2])
tele_comm_2 = Brep(<brep referenced from the Rhino model>)
storage_2 = Brep([<brep referenced from the Rhino model> x2])
accessory_spaces_3 = Brep([<brep referenced from the Rhino model> x2])
# SECOND FLOOR PROGRAM
educational_spaces_studios = Brep(<brep referenced from the Rhino model>)
creative_collisions_commons = Brep([<brep referenced from the Rhino model> x4])
mass_addition_16 = MassAddition(Input=panel_8)  # -> Result, PartialResults
mass_addition_17 = MassAddition(Input=panel_13)  # -> Result, PartialResults

# ---- group: Calculation of 1 floor mass
debrep_15 = DeconstructBrep(Brep=digital_modeling_fabrication_2)  # -> Faces, Edges, Vertices
floor_slab_area_8 = FloorSlabArea(S=debrep_15.Faces, L=debrep_15.Faces)  # -> A, C, L_2
floors_15 = Surface(floor_slab_area_8.L_2)
center_15 = Point(floor_slab_area_8.C)
panel_15 = Panel(floor_slab_area_8.A)
flatten_8 = FlattenTree(Tree=panel_15, Path="{0}")

# ---- group: Calculation 2 Floor mass
debrep_16 = DeconstructBrep(Brep=digital_modeling_fabrication_2)  # -> Faces, Edges, Vertices
_2_floor_area_calc_8 = _2FloorAreaCalc(S=debrep_16.Faces, L=debrep_16.Faces)  # -> A, L_2, C
center_16 = Point(_2_floor_area_calc_8.C)
floors_16 = Surface(_2_floor_area_calc_8.L_2)
mass_addition_18 = MassAddition(Input=_2_floor_area_calc_8.A)  # -> Result, PartialResults

# ---- group: Calculation of 1 floor mass
debrep_17 = DeconstructBrep(Brep=research_hub)  # -> Faces, Edges, Vertices
floor_slab_area_9 = FloorSlabArea(S=debrep_17.Faces, L=debrep_17.Faces)  # -> A, C, L_2
center_17 = Point(floor_slab_area_9.C)
floors_17 = Surface(floor_slab_area_9.L_2)
panel_16 = Panel(floor_slab_area_9.A)
flatten_9 = FlattenTree(Tree=panel_16, Path="{0}")

# ---- group: Calculation 2 Floor mass
debrep_18 = DeconstructBrep(Brep=research_hub)  # -> Faces, Edges, Vertices
_2_floor_area_calc_9 = _2FloorAreaCalc(S=debrep_18.Faces, L=debrep_18.Faces)  # -> A, L_2, C
center_18 = Point(_2_floor_area_calc_9.C)
floors_18 = Surface(_2_floor_area_calc_9.L_2)
mass_addition_19 = MassAddition(Input=_2_floor_area_calc_9.A)  # -> Result, PartialResults

# ---- group: Calculation of 1 floor mass
debrep_19 = DeconstructBrep(Brep=educational_spaces_studios)  # -> Faces, Edges, Vertices
floor_slab_area_10 = FloorSlabArea(S=debrep_19.Faces, L=debrep_19.Faces)  # -> A, C, L_2
center_19 = Point(floor_slab_area_10.C)
floors_19 = Surface(floor_slab_area_10.L_2)
panel_17 = Panel(floor_slab_area_10.A)
flatten_10 = FlattenTree(Tree=panel_17, Path="{0}")

# ---- group: Calculation 2 Floor mass
debrep_20 = DeconstructBrep(Brep=educational_spaces_studios)  # -> Faces, Edges, Vertices
_2_floor_area_calc_10 = _2FloorAreaCalc(S=debrep_20.Faces, L=debrep_20.Faces)  # -> A, L_2, C
center_20 = Point(_2_floor_area_calc_10.C)
floors_20 = Surface(_2_floor_area_calc_10.L_2)
mass_addition_20 = MassAddition(Input=_2_floor_area_calc_10.A)  # -> Result, PartialResults

# ---- group: Calculation of 1 floor mass
debrep_21 = DeconstructBrep(Brep=tele_comm_2)  # -> Faces, Edges, Vertices
floor_slab_area_11 = FloorSlabArea(S=debrep_21.Faces, L=debrep_21.Faces)  # -> A, C, L_2
center_21 = Point(floor_slab_area_11.C)
floors_21 = Surface(floor_slab_area_11.L_2)
panel_18 = Panel(floor_slab_area_11.A)
flatten_11 = FlattenTree(Tree=panel_18, Path="{0}")

# ---- group: Calculation 2 Floor mass
debrep_22 = DeconstructBrep(Brep=tele_comm_2)  # -> Faces, Edges, Vertices
_2_floor_area_calc_11 = _2FloorAreaCalc(S=debrep_22.Faces, L=debrep_22.Faces)  # -> A, L_2, C
floors_22 = Surface(_2_floor_area_calc_11.L_2)
center_22 = Point(_2_floor_area_calc_11.C)
mass_addition_21 = MassAddition(Input=_2_floor_area_calc_11.A)  # -> Result, PartialResults

# ---- group: Calculation of 1 floor mass
debrep_23 = DeconstructBrep(Brep=storage_2)  # -> Faces, Edges, Vertices
floor_slab_area_12 = FloorSlabArea(S=debrep_23.Faces, L=debrep_23.Faces)  # -> A, C, L_2
center_23 = Point(floor_slab_area_12.C)
floors_23 = Surface(floor_slab_area_12.L_2)
panel_19 = Panel(floor_slab_area_12.A)
flatten_12 = FlattenTree(Tree=panel_19, Path="{0}")

# ---- group: Calculation 2 Floor mass
debrep_24 = DeconstructBrep(Brep=storage_2)  # -> Faces, Edges, Vertices
_2_floor_area_calc_12 = _2FloorAreaCalc(S=debrep_24.Faces, L=debrep_24.Faces)  # -> A, L_2, C
floors_24 = Surface(_2_floor_area_calc_12.L_2)
center_24 = Point(_2_floor_area_calc_12.C)
mass_addition_22 = MassAddition(Input=_2_floor_area_calc_12.A)  # -> Result, PartialResults

# ---- group: Calculation of 1 floor mass
debrep_25 = DeconstructBrep(Brep=accessory_spaces_3)  # -> Faces, Edges, Vertices
floor_slab_area_13 = FloorSlabArea(S=debrep_25.Faces, L=debrep_25.Faces)  # -> A, C, L_2
center_25 = Point(floor_slab_area_13.C)
floors_25 = Surface(floor_slab_area_13.L_2)
panel_20 = Panel(floor_slab_area_13.A)
flatten_13 = FlattenTree(Tree=panel_20, Path="{0}")

# ---- group: Calculation 2 Floor mass
debrep_26 = DeconstructBrep(Brep=accessory_spaces_3)  # -> Faces, Edges, Vertices
_2_floor_area_calc_13 = _2FloorAreaCalc(S=debrep_26.Faces, L=debrep_26.Faces)  # -> A, L_2, C
floors_26 = Surface(_2_floor_area_calc_13.L_2)
center_26 = Point(_2_floor_area_calc_13.C)
mass_addition_23 = MassAddition(Input=_2_floor_area_calc_13.A)  # -> Result, PartialResults

# ---- group: Calculation of 1 floor mass
debrep_27 = DeconstructBrep(Brep=creative_collisions_commons)  # -> Faces, Edges, Vertices
floor_slab_area_14 = FloorSlabArea(S=debrep_27.Faces, L=debrep_27.Faces)  # -> A, C, L_2
center_27 = Point(floor_slab_area_14.C)
floors_27 = Surface(floor_slab_area_14.L_2)
panel_21 = Panel(floor_slab_area_14.A)
flatten_14 = FlattenTree(Tree=panel_21, Path="{0}")

# ---- group: Calculation 2 Floor mass
debrep_28 = DeconstructBrep(Brep=creative_collisions_commons)  # -> Faces, Edges, Vertices
_2_floor_area_calc_14 = _2FloorAreaCalc(S=debrep_28.Faces, L=debrep_28.Faces)  # -> A, L_2, C
center_28 = Point(_2_floor_area_calc_14.C)
floors_28 = Surface(_2_floor_area_calc_14.L_2)
mass_addition_24 = MassAddition(Input=_2_floor_area_calc_14.A)  # -> Result, PartialResults

# ----
multi_purpose_hall_sf = Panel(mass_addition_16.Result)
accessory_exterior_sf = Panel(mass_addition_17.Result)
accessory_exterior_sf_2 = Panel(accessory_exterior_sf)
mechanical_sf = Panel(panel_14)
value_list_8 = ValueList({"1 Floor": 0, "2 Floors": 1}, selected="1 Floor")
value_list_9 = ValueList({"1 Floor": 0, "2 Floors": 1}, selected="1 Floor")
value_list_10 = ValueList({"1 Floor": 0, "2 Floors": 1}, selected="1 Floor")
value_list_11 = ValueList({"1 Floor": 0, "2 Floors": 1}, selected="1 Floor")
value_list_12 = ValueList({"1 Floor": 0, "2 Floors": 1}, selected="1 Floor")
value_list_13 = ValueList({"1 Floor": 0, "2 Floors": 1}, selected="1 Floor")
value_list_14 = ValueList({"1 Floor": 0, "2 Floors": 1}, selected="1 Floor")
stream_filter_8 = StreamFilter(Gate=value_list_8, Stream0=flatten_10, Stream1=mass_addition_20.Result)
stream_filter_9 = StreamFilter(Gate=value_list_9, Stream0=flatten_8, Stream1=mass_addition_18.Result)
stream_filter_10 = StreamFilter(Gate=value_list_10, Stream0=flatten_14, Stream1=mass_addition_24.Result)
stream_filter_11 = StreamFilter(Gate=value_list_11, Stream0=flatten_9, Stream1=mass_addition_19.Result)
stream_filter_12 = StreamFilter(Gate=value_list_12, Stream0=flatten_11, Stream1=mass_addition_21.Result)
stream_filter_13 = StreamFilter(Gate=value_list_13, Stream0=flatten_12, Stream1=mass_addition_22.Result)
stream_filter_14 = StreamFilter(Gate=value_list_14, Stream0=flatten_13, Stream1=mass_addition_23.Result)
tag_8 = TextTag(Location=center_19, Text=stream_filter_8)
mass_addition_25 = MassAddition(Input=stream_filter_8)  # -> Result, PartialResults
tag_9 = TextTag(Location=center_15, Text=stream_filter_9)
mass_addition_26 = MassAddition(Input=stream_filter_9)  # -> Result, PartialResults
tag_10 = TextTag(Location=center_27, Text=stream_filter_10)
mass_addition_27 = MassAddition(Input=stream_filter_10)  # -> Result, PartialResults
tag_11 = TextTag(Location=center_17, Text=stream_filter_11)
mass_addition_28 = MassAddition(Input=stream_filter_11)  # -> Result, PartialResults
tag_12 = TextTag(Location=center_21, Text=stream_filter_12)
mass_addition_29 = MassAddition(Input=stream_filter_12)  # -> Result, PartialResults
tag_13 = TextTag(Location=center_23, Text=stream_filter_13)
mass_addition_30 = MassAddition(Input=stream_filter_13)  # -> Result, PartialResults
tag_14 = TextTag(Location=center_25, Text=stream_filter_14)
mass_addition_31 = MassAddition(Input=stream_filter_14)  # -> Result, PartialResults
panel_22 = Panel(mass_addition_25.Result)
panel_23 = Panel(mass_addition_26.Result)
panel_24 = Panel(mass_addition_27.Result)
# TOTAL PROGRAM AREAS
mass_addition_32 = MassAddition(Input=panel_24)  # -> Result, PartialResults
creative_commons_sf = Panel(mass_addition_32.Result)
panel_25 = Panel(mass_addition_28.Result)
panel_26 = Panel(mass_addition_29.Result)
panel_27 = Panel(mass_addition_30.Result)
mass_addition_33 = MassAddition(Input=panel_27)  # -> Result, PartialResults
storage_sf = Panel(mass_addition_33.Result)
panel_28 = Panel(mass_addition_31.Result)
mass_addition_34 = MassAddition(Input=[panel_22, panel_23, panel_24, panel_25, panel_26, panel_27, panel_28])  # -> Result, PartialResults
# THIRD FLOOR PROGRAM
educational_spaces_studios_2 = Brep(<brep referenced from the Rhino model>)
digital_modeling_fabrication_3 = Brep(<brep referenced from the Rhino model>)
research_hub_2 = Brep(<brep referenced from the Rhino model>)
tele_comm_3 = Brep(<brep referenced from the Rhino model>)
storage_3 = Brep()
accessory_spaces_4 = Brep([<brep referenced from the Rhino model> x2])

# ---- group: Calculation of 1 floor mass
debrep_29 = DeconstructBrep(Brep=digital_modeling_fabrication_3)  # -> Faces, Edges, Vertices
floor_slab_area_15 = FloorSlabArea(S=debrep_29.Faces, L=debrep_29.Faces)  # -> A, C, L_2
center_29 = Point(floor_slab_area_15.C)
floors_29 = Surface(floor_slab_area_15.L_2)
panel_29 = Panel(floor_slab_area_15.A)
flatten_15 = FlattenTree(Tree=panel_29, Path="{0}")

# ---- group: Calculation 2 Floor mass
debrep_30 = DeconstructBrep(Brep=digital_modeling_fabrication_3)  # -> Faces, Edges, Vertices
_2_floor_area_calc_15 = _2FloorAreaCalc(S=debrep_30.Faces, L=debrep_30.Faces)  # -> A, L_2, C
center_30 = Point(_2_floor_area_calc_15.C)
floors_30 = Surface(_2_floor_area_calc_15.L_2)
mass_addition_35 = MassAddition(Input=_2_floor_area_calc_15.A)  # -> Result, PartialResults

# ---- group: Calculation of 1 floor mass
debrep_31 = DeconstructBrep(Brep=research_hub_2)  # -> Faces, Edges, Vertices
floor_slab_area_16 = FloorSlabArea(S=debrep_31.Faces, L=debrep_31.Faces)  # -> A, C, L_2
center_31 = Point(floor_slab_area_16.C)
floors_31 = Surface(floor_slab_area_16.L_2)
panel_30 = Panel(floor_slab_area_16.A)
flatten_16 = FlattenTree(Tree=panel_30, Path="{0}")

# ---- group: Calculation 2 Floor mass
debrep_32 = DeconstructBrep(Brep=research_hub_2)  # -> Faces, Edges, Vertices
_2_floor_area_calc_16 = _2FloorAreaCalc(S=debrep_32.Faces, L=debrep_32.Faces)  # -> A, L_2, C
floors_32 = Surface(_2_floor_area_calc_16.L_2)
center_32 = Point(_2_floor_area_calc_16.C)
mass_addition_36 = MassAddition(Input=_2_floor_area_calc_16.A)  # -> Result, PartialResults

# ---- group: Calculation of 1 floor mass
debrep_33 = DeconstructBrep(Brep=educational_spaces_studios_2)  # -> Faces, Edges, Vertices
floor_slab_area_17 = FloorSlabArea(S=debrep_33.Faces, L=debrep_33.Faces)  # -> A, C, L_2
center_33 = Point(floor_slab_area_17.C)
floors_33 = Surface(floor_slab_area_17.L_2)
panel_31 = Panel(floor_slab_area_17.A)
flatten_17 = FlattenTree(Tree=panel_31, Path="{0}")

# ---- group: Calculation 2 Floor mass
debrep_34 = DeconstructBrep(Brep=educational_spaces_studios_2)  # -> Faces, Edges, Vertices
_2_floor_area_calc_17 = _2FloorAreaCalc(S=debrep_34.Faces, L=debrep_34.Faces)  # -> A, L_2, C
floors_34 = Surface(_2_floor_area_calc_17.L_2)
center_34 = Point(_2_floor_area_calc_17.C)
mass_addition_37 = MassAddition(Input=_2_floor_area_calc_17.A)  # -> Result, PartialResults

# ---- group: Calculation of 1 floor mass
debrep_35 = DeconstructBrep(Brep=tele_comm_3)  # -> Faces, Edges, Vertices
floor_slab_area_18 = FloorSlabArea(S=debrep_35.Faces, L=debrep_35.Faces)  # -> A, C, L_2
center_35 = Point(floor_slab_area_18.C)
floors_35 = Surface(floor_slab_area_18.L_2)
panel_32 = Panel(floor_slab_area_18.A)
flatten_18 = FlattenTree(Tree=panel_32, Path="{0}")

# ---- group: Calculation 2 Floor mass
debrep_36 = DeconstructBrep(Brep=tele_comm_3)  # -> Faces, Edges, Vertices
_2_floor_area_calc_18 = _2FloorAreaCalc(S=debrep_36.Faces, L=debrep_36.Faces)  # -> A, L_2, C
center_36 = Point(_2_floor_area_calc_18.C)
floors_36 = Surface(_2_floor_area_calc_18.L_2)
mass_addition_38 = MassAddition(Input=_2_floor_area_calc_18.A)  # -> Result, PartialResults

# ---- group: Calculation of 1 floor mass
debrep_37 = DeconstructBrep(Brep=storage_3)  # -> Faces, Edges, Vertices
floor_slab_area_19 = FloorSlabArea(S=debrep_37.Faces, L=debrep_37.Faces)  # -> A, C, L_2
center_37 = Point(floor_slab_area_19.C)
floors_37 = Surface(floor_slab_area_19.L_2)
panel_33 = Panel(floor_slab_area_19.A)
flatten_19 = FlattenTree(Tree=panel_33, Path="{0}")

# ---- group: Calculation 2 Floor mass
debrep_38 = DeconstructBrep(Brep=storage_3)  # -> Faces, Edges, Vertices
_2_floor_area_calc_19 = _2FloorAreaCalc(S=debrep_38.Faces, L=debrep_38.Faces)  # -> A, L_2, C
floors_38 = Surface(_2_floor_area_calc_19.L_2)
center_38 = Point(_2_floor_area_calc_19.C)
mass_addition_39 = MassAddition(Input=_2_floor_area_calc_19.A)  # -> Result, PartialResults

# ---- group: Calculation of 1 floor mass
debrep_39 = DeconstructBrep(Brep=accessory_spaces_4)  # -> Faces, Edges, Vertices
floor_slab_area_20 = FloorSlabArea(S=debrep_39.Faces, L=debrep_39.Faces)  # -> A, C, L_2
center_39 = Point(floor_slab_area_20.C)
floors_39 = Surface(floor_slab_area_20.L_2)
panel_34 = Panel(floor_slab_area_20.A)
flatten_20 = FlattenTree(Tree=panel_34, Path="{0}")

# ---- group: Calculation 2 Floor mass
debrep_40 = DeconstructBrep(Brep=accessory_spaces_4)  # -> Faces, Edges, Vertices
_2_floor_area_calc_20 = _2FloorAreaCalc(S=debrep_40.Faces, L=debrep_40.Faces)  # -> A, L_2, C
floors_40 = Surface(_2_floor_area_calc_20.L_2)
center_40 = Point(_2_floor_area_calc_20.C)
mass_addition_40 = MassAddition(Input=_2_floor_area_calc_20.A)  # -> Result, PartialResults

# ----
value_list_15 = ValueList({"1 Floor": 0, "2 Floors": 1}, selected="1 Floor")
value_list_16 = ValueList({"1 Floor": 0, "2 Floors": 1}, selected="1 Floor")
value_list_17 = ValueList({"1 Floor": 0, "2 Floors": 1}, selected="1 Floor")
value_list_18 = ValueList({"1 Floor": 0, "2 Floors": 1}, selected="1 Floor")
value_list_19 = ValueList({"1 Floor": 0, "2 Floors": 1}, selected="1 Floor")
value_list_20 = ValueList({"1 Floor": 0, "2 Floors": 1}, selected="1 Floor")
stream_filter_15 = StreamFilter(Gate=value_list_15, Stream0=flatten_17, Stream1=mass_addition_37.Result)
stream_filter_16 = StreamFilter(Gate=value_list_16, Stream0=flatten_15, Stream1=mass_addition_35.Result)
stream_filter_17 = StreamFilter(Gate=value_list_17, Stream0=flatten_16, Stream1=mass_addition_36.Result)
stream_filter_18 = StreamFilter(Gate=value_list_18, Stream0=flatten_18, Stream1=mass_addition_38.Result)
stream_filter_19 = StreamFilter(Gate=value_list_19, Stream0=flatten_19, Stream1=mass_addition_39.Result)
stream_filter_20 = StreamFilter(Gate=value_list_20, Stream0=flatten_20, Stream1=mass_addition_40.Result)
tag_15 = TextTag(Location=center_33, Text=stream_filter_15)
mass_addition_41 = MassAddition(Input=stream_filter_15)  # -> Result, PartialResults
tag_16 = TextTag(Location=center_29, Text=stream_filter_16)
mass_addition_42 = MassAddition(Input=stream_filter_16)  # -> Result, PartialResults
tag_17 = TextTag(Location=center_31, Text=stream_filter_17)
mass_addition_43 = MassAddition(Input=stream_filter_17)  # -> Result, PartialResults
tag_18 = TextTag(Location=center_35, Text=stream_filter_18)
mass_addition_44 = MassAddition(Input=stream_filter_18)  # -> Result, PartialResults
tag_19 = TextTag(Location=center_37, Text=stream_filter_19)
mass_addition_45 = MassAddition(Input=stream_filter_19)  # -> Result, PartialResults
tag_20 = TextTag(Location=center_39, Text=stream_filter_20)
mass_addition_46 = MassAddition(Input=stream_filter_20)  # -> Result, PartialResults
panel_35 = Panel(mass_addition_41.Result)
mass_addition_47 = MassAddition(Input=[panel_24, panel_22, panel_35])  # -> Result, PartialResults
educational_sf = Panel(mass_addition_47.Result)
panel_36 = Panel(mass_addition_42.Result)
mass_addition_48 = MassAddition(Input=[panel_9, panel_23, panel_36])  # -> Result, PartialResults
digitial_fabrication_sf = Panel(mass_addition_48.Result)
panel_37 = Panel(mass_addition_43.Result)
mass_addition_49 = MassAddition(Input=[panel_25, panel_37])  # -> Result, PartialResults
research_hub_sf = Panel(mass_addition_49.Result)
panel_38 = Panel(mass_addition_44.Result)
mass_addition_50 = MassAddition(Input=[panel_11, panel_26, panel_38])  # -> Result, PartialResults
telecom_sf = Panel(mass_addition_50.Result)
panel_39 = Panel(mass_addition_45.Result)
panel_40 = Panel(mass_addition_46.Result)
mass_addition_51 = MassAddition(Input=[panel_10, panel_28, panel_40])  # -> Result, PartialResults
accessory_interior_sf = Panel(mass_addition_51.Result)
mass_addition_52 = MassAddition(Input=[panel_35, panel_36, panel_37, panel_38, panel_40])  # -> Result, PartialResults

# ---- group: TOTAL AREA
# TOTAL GROSS PROGRAM AREA
first_floor_program_sf = Panel(mass_addition_15.Result)
second_floor_program_sf = Panel(mass_addition_34.Result)
thrid_floor_program_sf = Panel(mass_addition_52.Result)
mass_addition_53 = MassAddition(Input=[thrid_floor_program_sf, second_floor_program_sf, first_floor_program_sf, accessory_exterior_sf_2, mechanical_sf])  # -> Result, PartialResults
total_gross_program_area_sf = Panel(mass_addition_53.Result)

# ---- group: INTERIOR ATRIUM
circulation_atrium = Brep([<brep referenced from the Rhino model> x2])
value_list_21 = ValueList({"1 Floor": 0, "2 Floors": 1}, selected="1 Floor")

# ---- group: INTERIOR ATRIUM / Calculation of 1 floor mass
debrep_41 = DeconstructBrep(Brep=circulation_atrium)  # -> Faces, Edges, Vertices
# ATRIUM SPACE
floor_slab_area_21 = FloorSlabArea(S=debrep_41.Faces, L=debrep_41.Faces)  # -> A, C, L_2
floors_41 = Surface(floor_slab_area_21.L_2)
center_41 = Point(floor_slab_area_21.C)
panel_41 = Panel(floor_slab_area_21.A)
flatten_21 = FlattenTree(Tree=panel_41, Path="{0}")

# ---- group: INTERIOR ATRIUM / Calculation 2 Floor mass
debrep_42 = DeconstructBrep(Brep=circulation_atrium)  # -> Faces, Edges, Vertices
_2_floor_area_calc_21 = _2FloorAreaCalc(S=debrep_42.Faces, L=debrep_42.Faces)  # -> A, L_2, C
center_42 = Point(_2_floor_area_calc_21.C)
floors_42 = Surface(_2_floor_area_calc_21.L_2)
mass_addition_54 = MassAddition(Input=_2_floor_area_calc_21.A)  # -> Result, PartialResults

# ---- group: INTERIOR ATRIUM (continued)
stream_filter_21 = StreamFilter(Gate=value_list_21, Stream0=flatten_21, Stream1=mass_addition_54.Result)
tag_21 = TextTag(Location=center_41, Text=stream_filter_21)
mass_addition_55 = MassAddition(Input=stream_filter_21)  # -> Result, PartialResults
panel_42 = Panel(mass_addition_55.Result)

# ==== cluster FloorSlabArea
S = ClusterInput()
md_slider = MDSlider(SliderMode=0, slider_value=Point(0.5, 0.5, 0.5), x_domain=Domain(0, 1), y_domain=Domain(0, 1), z_domain=Domain(0, 1))
evalsrf = EvaluateSurface(Surface=reparameterize(S), Point=md_slider)  # -> Point, Normal, UDirection, VDirection, Frame
devec = DeconstructVector(Vector=evalsrf.Normal)  # -> XComponent, YComponent, ZComponent
expression = Expression(x=devec.ZComponent, Expression="round(X,2)")
python = GhPythonScript(zVector=expression)  # -> a; inputs zVector: list
# ---------- python: Python ----------
__author__ = "Brooks Scarpa"
__version__ = "2021.11.15"

import rhinoscriptsyntax as rs

a = []
options = [-1]

for i in range (0,len(zVector)):
    if zVector[i] in options: 
        a.append(True)
    else: 
        a.append(False)
# ---------- end python ----------
panel = Panel(python)
panel_2 = Panel(devec.ZComponent)
L = ClusterInput()
cull = CullPattern(List=L, CullPattern=python)
area = Area(Geometry=cull)  # -> expr("round(x)", flatten(Area)), Centroid
rev = ReverseList(List=area.Area)
A = ClusterOutput(area.Area)
L_2 = ClusterOutput(cull)
C = ClusterOutput(area.Centroid)

# ==== cluster _2FloorAreaCalc
S = ClusterInput()
md_slider = MDSlider(SliderMode=0, slider_value=Point(0.5, 0.5, 0.5), x_domain=Domain(0, 1), y_domain=Domain(0, 1), z_domain=Domain(0, 1))
evalsrf = EvaluateSurface(Surface=reparameterize(S), Point=md_slider)  # -> Point, Normal, UDirection, VDirection, Frame
devec = DeconstructVector(Vector=evalsrf.Normal)  # -> XComponent, YComponent, ZComponent
expression = Expression(x=devec.ZComponent, Expression="round(X,2)")
python = GhPythonScript(zVector=expression)  # -> a; inputs zVector: list
# ---------- python: Python ----------
__author__ = "Brooks Scarpa"
__version__ = "2021.11.15"

import rhinoscriptsyntax as rs

a = []
options = [-1,1]

for i in range (0,len(zVector)):
    if zVector[i] in options: 
        a.append(True)
    else: 
        a.append(False)
# ---------- end python ----------
panel = Panel(python)
panel_2 = Panel(devec.ZComponent)
L = ClusterInput()
cull = CullPattern(List=L, CullPattern=python)
area = Area(Geometry=cull)  # -> expr("round(x)", flatten(Area)), Centroid
rev = ReverseList(List=area.Area)
L_2 = ClusterOutput(cull)
A = ClusterOutput(area.Area)
C = ClusterOutput(area.Centroid)
