# Grasshopper definition Data_Floor Area CalculationsByProgram.gh (Grasshopper 1.0.7)

telecommunications = Brep()
exterior_maker_space = Brep()
digital_fabrication = Brep()
mutli_purpose = Brep()
lobby_atrium = Brep()
accessory = Brep()
research_hub = Brep()
educational = Brep()
# PROGRAM AREAS
exhibition = Brep()
storage = Brep()

xy_plane = XYPlane(Origin=Point(0, 0, 0))
bounding_box = BoundingBox(Content=accessory, Plane=xy_plane)  # -> Box, Box_2
volume = Volume(Geometry=accessory)  # -> Volume, Centroid
box_corners = BoxCorners(Box=bounding_box.Box)  # -> CornerA, CornerB, CornerC, CornerD, CornerE, CornerF, CornerG, CornerH
distance = Distance(PointA=box_corners.CornerA, PointB=box_corners.CornerE)
expression = Expression(x=volume.Volume, y=distance, Expression="round(x/y,2)")  # -> flatten(Result)
mass_addition = MassAddition(Input=expression)  # -> Result, PartialResults

xy_plane_2 = XYPlane(Origin=Point(0, 0, 0))
bounding_box_2 = BoundingBox(Content=telecommunications, Plane=xy_plane_2)  # -> Box, Box_2
volume_2 = Volume(Geometry=telecommunications)  # -> Volume, Centroid
box_corners_2 = BoxCorners(Box=bounding_box_2.Box)  # -> CornerA, CornerB, CornerC, CornerD, CornerE, CornerF, CornerG, CornerH
distance_2 = Distance(PointA=box_corners_2.CornerA, PointB=box_corners_2.CornerE)
expression_2 = Expression(x=volume_2.Volume, y=distance_2, Expression="round(x/y,2)")  # -> flatten(Result)
mass_addition_2 = MassAddition(Input=expression_2)  # -> Result, PartialResults

xy_plane_3 = XYPlane(Origin=Point(0, 0, 0))
bounding_box_3 = BoundingBox(Content=storage, Plane=xy_plane_3)  # -> Box, Box_2
volume_3 = Volume(Geometry=storage)  # -> Volume, Centroid
box_corners_3 = BoxCorners(Box=bounding_box_3.Box)  # -> CornerA, CornerB, CornerC, CornerD, CornerE, CornerF, CornerG, CornerH
distance_3 = Distance(PointA=box_corners_3.CornerA, PointB=box_corners_3.CornerE)
expression_3 = Expression(x=volume_3.Volume, y=distance_3, Expression="round(x/y,2)")  # -> flatten(Result)
mass_addition_3 = MassAddition(Input=expression_3)  # -> Result, PartialResults

xy_plane_4 = XYPlane(Origin=Point(0, 0, 0))
bounding_box_4 = BoundingBox(Content=educational, Plane=xy_plane_4)  # -> Box, Box_2
volume_4 = Volume(Geometry=educational)  # -> Volume, Centroid
box_corners_4 = BoxCorners(Box=bounding_box_4.Box)  # -> CornerA, CornerB, CornerC, CornerD, CornerE, CornerF, CornerG, CornerH
distance_4 = Distance(PointA=box_corners_4.CornerA, PointB=box_corners_4.CornerE)
expression_4 = Expression(x=volume_4.Volume, y=distance_4, Expression="round(x/y,2)")  # -> flatten(Result)
mass_addition_4 = MassAddition(Input=expression_4)  # -> Result, PartialResults

xy_plane_5 = XYPlane(Origin=Point(0, 0, 0))
bounding_box_5 = BoundingBox(Content=lobby_atrium, Plane=xy_plane_5)  # -> Box, Box_2
volume_5 = Volume(Geometry=lobby_atrium)  # -> Volume, Centroid
box_corners_5 = BoxCorners(Box=bounding_box_5.Box)  # -> CornerA, CornerB, CornerC, CornerD, CornerE, CornerF, CornerG, CornerH
distance_5 = Distance(PointA=box_corners_5.CornerA, PointB=box_corners_5.CornerE)
expression_5 = Expression(x=volume_5.Volume, y=distance_5, Expression="round(x/y,2)")  # -> flatten(Result)
mass_addition_5 = MassAddition(Input=expression_5)  # -> Result, PartialResults

xy_plane_6 = XYPlane(Origin=Point(0, 0, 0))
bounding_box_6 = BoundingBox(Content=exhibition, Plane=xy_plane_6)  # -> Box, Box_2
volume_6 = Volume(Geometry=exhibition)  # -> Volume, Centroid
box_corners_6 = BoxCorners(Box=bounding_box_6.Box)  # -> CornerA, CornerB, CornerC, CornerD, CornerE, CornerF, CornerG, CornerH
distance_6 = Distance(PointA=box_corners_6.CornerA, PointB=box_corners_6.CornerE)
expression_6 = Expression(x=volume_6.Volume, y=distance_6, Expression="round(x/y,2)")  # -> flatten(Result)
mass_addition_6 = MassAddition(Input=expression_6)  # -> Result, PartialResults

xy_plane_7 = XYPlane(Origin=Point(0, 0, 0))
bounding_box_7 = BoundingBox(Content=research_hub, Plane=xy_plane_7)  # -> Box, Box_2
volume_7 = Volume(Geometry=research_hub)  # -> Volume, Centroid
box_corners_7 = BoxCorners(Box=bounding_box_7.Box)  # -> CornerA, CornerB, CornerC, CornerD, CornerE, CornerF, CornerG, CornerH
distance_7 = Distance(PointA=box_corners_7.CornerA, PointB=box_corners_7.CornerE)
expression_7 = Expression(x=volume_7.Volume, y=distance_7, Expression="round(x/y,2)")  # -> flatten(Result)
mass_addition_7 = MassAddition(Input=expression_7)  # -> Result, PartialResults

xy_plane_8 = XYPlane(Origin=Point(0, 0, 0))
bounding_box_8 = BoundingBox(Content=digital_fabrication, Plane=xy_plane_8)  # -> Box, Box_2
volume_8 = Volume(Geometry=digital_fabrication)  # -> Volume, Centroid
box_corners_8 = BoxCorners(Box=bounding_box_8.Box)  # -> CornerA, CornerB, CornerC, CornerD, CornerE, CornerF, CornerG, CornerH
distance_8 = Distance(PointA=box_corners_8.CornerA, PointB=box_corners_8.CornerE)
expression_8 = Expression(x=volume_8.Volume, y=distance_8, Expression="round(x/y,2)")  # -> flatten(Result)
mass_addition_8 = MassAddition(Input=expression_8)  # -> Result, PartialResults

xy_plane_9 = XYPlane(Origin=Point(0, 0, 0))
bounding_box_9 = BoundingBox(Content=mutli_purpose, Plane=xy_plane_9)  # -> Box, Box_2
volume_9 = Volume(Geometry=mutli_purpose)  # -> Volume, Centroid
box_corners_9 = BoxCorners(Box=bounding_box_9.Box)  # -> CornerA, CornerB, CornerC, CornerD, CornerE, CornerF, CornerG, CornerH
distance_9 = Distance(PointA=box_corners_9.CornerA, PointB=box_corners_9.CornerE)
expression_9 = Expression(x=volume_9.Volume, y=distance_9, Expression="round(x/y,2)")  # -> flatten(Result)
mass_addition_9 = MassAddition(Input=expression_9)  # -> Result, PartialResults

# ----
# LOBBY / ATRIUM
xy_plane_10 = XYPlane(Origin=Point(0, 0, 0))
bounding_box_10 = BoundingBox(Content=exterior_maker_space, Plane=xy_plane_10)  # -> Box, Box_2
volume_10 = Volume(Geometry=exterior_maker_space)  # -> Volume, Centroid
box_corners_10 = BoxCorners(Box=bounding_box_10.Box)  # -> CornerA, CornerB, CornerC, CornerD, CornerE, CornerF, CornerG, CornerH
distance_10 = Distance(PointA=box_corners_10.CornerA, PointB=box_corners_10.CornerE)
expression_10 = Expression(x=volume_10.Volume, y=distance_10, Expression="round(x/y,2)")  # -> flatten(Result)
mass_addition_10 = MassAddition(Input=expression_10)  # -> Result, PartialResults

# ----
# EXTERIOR AREAS
mechanical = Brep()

# ----
# MECHANICAL
xy_plane_11 = XYPlane(Origin=Point(0, 0, 0))
bounding_box_11 = BoundingBox(Content=mechanical, Plane=xy_plane_11)  # -> Box, Box_2
volume_11 = Volume(Geometry=mechanical)  # -> Volume, Centroid
box_corners_11 = BoxCorners(Box=bounding_box_11.Box)  # -> CornerA, CornerB, CornerC, CornerD, CornerE, CornerF, CornerG, CornerH
distance_11 = Distance(PointA=box_corners_11.CornerA, PointB=box_corners_11.CornerE)
expression_11 = Expression(x=volume_11.Volume, y=distance_11, Expression="round(x/y,2)")  # -> flatten(Result)
mass_addition_11 = MassAddition(Input=expression_11)  # -> Result, PartialResults

panel = Panel(expression)
panel_2 = Panel(expression_2)
panel_3 = Panel(expression_3)
panel_4 = Panel(expression_4)
panel_5 = Panel(expression_6)
panel_6 = Panel(expression_7)
panel_7 = Panel(expression_8)
panel_8 = Panel(expression_9)
panel_9 = Panel(expression_10)
panel_10 = Panel(expression_5)
panel_11 = Panel(expression_11)
panel_12 = Panel(mass_addition.Result)
panel_13 = Panel(mass_addition_2.Result)
panel_14 = Panel(mass_addition_3.Result)
panel_15 = Panel(mass_addition_5.Result)
panel_16 = Panel(mass_addition_10.Result)
panel_17 = Panel(mass_addition_7.Result)
panel_18 = Panel(mass_addition_8.Result)
panel_19 = Panel(mass_addition_4.Result)
panel_20 = Panel(mass_addition_6.Result)
panel_21 = Panel(mass_addition_9.Result)
panel_22 = Panel(mass_addition_11.Result)
# TOTAL PROGRAM AREA
mass_addition_12 = MassAddition()  # -> Result, PartialResults
# TOTAL GROSS FLOOR AREA
mass_addition_13 = MassAddition()  # -> Result, PartialResults
total_gross_program_area_sf = Panel(mass_addition_12.Result)
total_gross_program_area_sf_2 = Panel(mass_addition_13.Result)
