# Grasshopper definition Data_SolidOpenSurfaceAreaTakeoffs.gh (Grasshopper 1.0.7)

# ---- group: Input - Brep
solid_surfaces = Brep([<brep referenced from the Rhino model> x30])

glazed_surfaces = Brep([<brep referenced from the Rhino model> x2])

# ----
debrep = DeconstructBrep(Brep=glazed_surfaces)  # -> flatten(Faces), Edges, Vertices
debrep_2 = DeconstructBrep(Brep=solid_surfaces)  # -> flatten(Faces), Edges, Vertices
solid = Surface(debrep.Faces)
solid_2 = Surface(debrep_2.Faces)

area = Area(Geometry=solid_2)  # -> Area, Centroid
ma = MassAddition(Input=area.Area)  # -> Result, PartialResults

area_2 = Area(Geometry=solid)  # -> Area, Centroid
ma_2 = MassAddition(Input=area_2.Area)  # -> Result, PartialResults

bbox = BoundingBox(Content=glazed_surfaces, Plane=PlaneXY(0, 0, 0), UnionBox=True)  # -> Box, Box_2
bbox_2 = BoundingBox(Content=solid_surfaces, Plane=PlaneXY(0, 0, 0), UnionBox=True)  # -> Box, Box_2
box_corners = BoxCorners(Box=bbox.Box)  # -> CornerA, CornerB, CornerC, CornerD, CornerE, CornerF, CornerG, CornerH
python = GhPythonScript(surface=solid, Overall_Area=ma_2.Result)  # -> areas, centers, Overall_Area; inputs surface: list
# ---------- python: Python ----------
__author__ = "Brooks Scarpa"
__version__ = "2020.04.14"

import rhinoscriptsyntax as rs

def intWithCommas(x):
    if type(x) not in [type(0), type(0L)]:
        raise TypeError("Parameter must be an integer.")
    if x < 0:
        return '-' + intWithCommas(-x)
    result = ''
    while x >= 1000:
        x, r = divmod(x, 1000)
        result = ",%03d%s" % (r, result)
    return "%d%s" % (x, result)
    
    
areas = []
centers = []

for i in range(0,len(surface)):
    
    area = rs.SurfaceArea(surface[i])
    area = round(area[0]/144,0)
    
    area = '{} SF'.format(intWithCommas(int(area)))
    
    
    areas.append(area) 
    
    center = rs.SurfaceAreaCentroid(surface[i])
    center = center[0]
    
    centers.append(center)
    
Overall_Area = 'Overall Glazed Surface Area : {} SF'.format(intWithCommas(int(Overall_Area)))
# ---------- end python ----------
box_corners_2 = BoxCorners(Box=bbox_2.Box)  # -> CornerA, CornerB, CornerC, CornerD, CornerE, CornerF, CornerG, CornerH
python_2 = GhPythonScript(surface=solid_2, Overall_Area=ma.Result)  # -> areas, centers, Overall_Area; inputs surface: list
# ---------- python_2: Python ----------
__author__ = "Brooks Scarpa"
__version__ = "2020.04.14"

import rhinoscriptsyntax as rs

def intWithCommas(x):
    if type(x) not in [type(0), type(0L)]:
        raise TypeError("Parameter must be an integer.")
    if x < 0:
        return '-' + intWithCommas(-x)
    result = ''
    while x >= 1000:
        x, r = divmod(x, 1000)
        result = ",%03d%s" % (r, result)
    return "%d%s" % (x, result)
    
    
areas = []
centers = []

for i in range(0,len(surface)):
    
    area = rs.SurfaceArea(surface[i])
    area = round(area[0]/144,0)
    
    area = '{} SF'.format(intWithCommas(int(area)))
    
    
    areas.append(area) 
    
    center = rs.SurfaceAreaCentroid(surface[i])
    center = center[0]
    
    centers.append(center)
    
Overall_Area = 'Overall Solid Surface Area : {} SF'.format(intWithCommas(int(Overall_Area)))
# ---------- end python_2 ----------
pt = Point(box_corners.CornerD)
pt_2 = Point(box_corners_2.CornerA)
overall_surface_area = Text(python_2.Overall_Area)
overall_surface_area_2 = Text(python.Overall_Area)
open_solid_ratio = Division(A=ma_2.Result, B=ma.Result)
expression = Expression(x=open_solid_ratio, Expression="Round(x,2)")
tag = TextTag(Location=python_2.centers, Text=python_2.areas)
tag_2 = TextTag(Location=pt_2, Text=overall_surface_area)
tag_3 = TextTag(Location=python.centers, Text=python.areas)
tag_4 = TextTag(Location=pt, Text=overall_surface_area_2)
panel = Panel(expression)
