# Grasshopper definition Data_SurfaceSlopeAnalysis.gh (Grasshopper 1.0.7)

# ---- group: Set Testing UV Resolution
number_slider = Slider(5, range=0..10)
number_slider_2 = Slider(5, range=0..10)

# ----
srf = Surface(<surface referenced from the Rhino model>)

divide = DivideDomain²(Domain=srf, UCount=number_slider_2, VCount=number_slider)
subsrf = Isotrim(Surface=srf, Domain=divide)
debrep = DeconstructBrep(Brep=subsrf)  # -> Faces, Edges, Vertices
item = ListItem(List=debrep.Edges, Index=2, Wrap=True)  # -> Item, Item1, Item2, Item3

crv = Curve([item.Item1, item.Item3])
crv_2 = Curve([item.Item, item.Item2])

curvepoint = PointOnCurve(crv, parameter=0.5)
pdecon = Deconstruct(Point=curvepoint)  # -> XComponent, YComponent, simplify(ZComponent)
item_2 = ListItem(List=curvepoint, Index=0, Wrap=True)  # -> Item, Item1
vec2pt = Vector2Pt(PointA=item_2.Item, PointB=item_2.Item1, Unitize=False)  # -> Vector, Length
ln = Line(StartPoint=item_2.Item, EndPoint=item_2.Item1)
sort = SortList(Keys=pdecon.ZComponent, ValuesA=crv)  # -> reverse(Keys), reverse(ValuesA)
midpt = CurveMiddle(Curve=ln)
len = Length(Curve=ln)
item_3 = ListItem(List=sort.Keys, Index=0, Wrap=True)  # -> Item, Item1
subtraction = Subtraction(A=item_3.Item, B=item_3.Item1)
expression = Expression(x=subtraction, y=len, Expression="round((x/y)*100,2)")
concat = Concatenate(FragmentA=expression, FragmentB=" %")  # -> simplify(Result)

curvepoint_2 = PointOnCurve(crv_2, parameter=0.5)
pdecon_2 = Deconstruct(Point=curvepoint_2)  # -> XComponent, YComponent, simplify(ZComponent)
item_4 = ListItem(List=curvepoint_2, Index=0, Wrap=True)  # -> Item, Item1
vec2pt_2 = Vector2Pt(PointA=item_4.Item1, PointB=item_4.Item, Unitize=False)  # -> Vector, Length
ln_2 = Line(StartPoint=item_4.Item, EndPoint=item_4.Item1)
sort_2 = SortList(Keys=pdecon_2.ZComponent, ValuesA=crv_2)  # -> reverse(Keys), reverse(ValuesA)
midpt_2 = CurveMiddle(Curve=ln_2)
len_2 = Length(Curve=ln_2)
item_5 = ListItem(List=sort_2.Keys, Index=0, Wrap=True)  # -> Item, Item1
subtraction_2 = Subtraction(A=item_5.Item, B=item_5.Item1)
expression_2 = Expression(x=subtraction_2, y=len_2, Expression="round((x/y)*100,2)")
concat_2 = Concatenate(FragmentA=expression_2, FragmentB=" %")  # -> simplify(Result)

tag = TextTag(Location=midpt_2, Text=concat_2)
vdis = VectorDisplay(Anchor=midpt_2, Vector=vec2pt_2.Vector)
tag_2 = TextTag(Location=midpt, Text=concat)
vdis_2 = VectorDisplay(Anchor=midpt, Vector=vec2pt.Vector)
