# Grasshopper definition Example Script.gh (Grasshopper 1.0.7)

# ---- group: Define Floor to Floor Height
floor_height = Slider(4, range=0..10)

# ----
# CALCULATING FLOOR AREA OF A BREP
# Inputs shall always be located on the left side
mass_to_calculate = Brep(<brep referenced from the Rhino model>)

# ---- group: Toggle Units between Feet & Inches
toggle = BooleanToggle(False)

# ----
mass_to_calculate_2 = Brep(mass_to_calculate)

# ---- group: Footprint Area Calculation
# Group components in order to clarify functions and 'break' the definition so it could be read by others.
# Name each group according to the function it is designed to
debrep = DeconstructBrep(Brep=mass_to_calculate_2)  # -> Faces, Edges, Vertices
floor_slab_area = FloorSlabArea(S=debrep.Faces, L=debrep.Faces)  # -> A, C, L_2
panel = Panel(floor_slab_area.A)
flatten = FlattenTree(Tree=panel, Path="{0}")

# ---- group: Setting Up Text Location
mass_to_calculate_3 = Brep(mass_to_calculate)
expression = Expression(x=floor_height, Expression="x*12")
lowestfaceofbrep = LowestFaceOfBrep(B=mass_to_calculate_3)  # -> i, i_2
filter = StreamFilter(Gate=toggle, Stream0=expression, Stream1=floor_height)
bbox = BoundingBox(Content=mass_to_calculate_3, Plane=PlaneXY(0, 0, 0))  # -> Box, Box_2
contour = Contour(Shape=mass_to_calculate_3, Point=lowestfaceofbrep.i_2, Direction=Vector(0, 0, 1), Distance=filter)  # -> simplify(Contours)
box_corners = BoxCorners(Box=bbox.Box)  # -> CornerA, CornerB, CornerC, CornerD, CornerE, CornerF, CornerG, CornerH
area = Area(Geometry=contour)  # -> expr("round(x,2)", flatten(Area)), Centroid
lng = ListLength(List=flatten(contour))
pt = Point(box_corners.CornerA)
series = Series(Start=0, Step=filter, Count=lng)
ma = MassAddition(Input=area.Area)  # -> Result, PartialResults
Z = UnitZ(Factor=series)
move = Move(Geometry=pt, Motion=Z)  # -> Geometry, Transform

# ---- group: Text Formatting
python = GhPythonScript(flrs=area.Area, mass_add=ma.Result, bldg_ftprint=flatten)  # -> floor_names, overall_bldg_area, bldg_footprint; inputs flrs: list of Int32
# ---------- python: Python ----------
__author__ = "Brooks Scarpa"
__version__ = "2022.06.15"

import rhinoscriptsyntax as rs

def intWithCommas(x):
    if type(x) not in [type(0), type(0L)]:
        raise TypeError("Parameter must be an integer.")
    if x < 0:
        return '-' + intWithCommas(-x)
    result = ''
    while x >= 1000:
        x, r = divmod(x, 1000)
        result = ",%03d%s" % (r, result)
    return "%d%s" % (x, result)
    

floor_names = []

for i in range(0,len(flrs)):
    
    
    area = intWithCommas(flrs[i])
    flr_name = 'Floor {} Area: {}'.format(i,area)
    floor_names.append(flr_name)
    


bldg_footprint = 'Building Footprint {}'.format(intWithCommas(int(bldg_ftprint)))
overall_bldg_area = 'Overall Bldg Area {}'.format(intWithCommas(int(mass_add)))
# ---------- end python ----------

# ----
panel_2 = Panel(python.floor_names)
panel_3 = Panel(python.bldg_footprint)
panel_4 = Panel(python.overall_bldg_area)

# ---- group: Building Floor Plate Areas
# Outputs shall always be located on the left side
tag = TextTag(Location=move.Geometry, Text=panel_2)

# ---- group: Building Overall Area
tag_2 = TextTag(Location=box_corners.CornerD, Text=panel_4)

# ---- group: Building Footprint
tag_3 = TextTag(Location=box_corners.CornerC, Text=panel_3)

# ==== cluster FloorSlabArea
S = ClusterInput()
md_slider = MDSlider(SliderMode=0, slider_value=Point(0.5, 0.5, 0.5), x_domain=Domain(0, 1), y_domain=Domain(0, 1), z_domain=Domain(0, 1))
evalsrf = EvaluateSurface(Surface=reparameterize(S), Point=md_slider)  # -> Point, Normal, UDirection, VDirection, Frame
devec = DeconstructVector(Vector=evalsrf.Normal)  # -> XComponent, YComponent, ZComponent
expression = Expression(x=devec.ZComponent, Expression="round(X,2)")
python = GhPythonScript(zVector=expression)  # -> a; inputs zVector: list
# ---------- python: Python ----------
__author__ = "Brooks Scarpa"
__version__ = "2021.11.15"

import rhinoscriptsyntax as rs

a = []
options = [-1]

for i in range (0,len(zVector)):
    if zVector[i] in options: 
        a.append(True)
    else: 
        a.append(False)
# ---------- end python ----------
panel = Panel(python)
panel_2 = Panel(devec.ZComponent)
L = ClusterInput()
cull = CullPattern(List=L, CullPattern=python)
area = Area(Geometry=cull)  # -> expr("round(x)", flatten(Area)), Centroid
rev = ReverseList(List=area.Area)
A = ClusterOutput(area.Area)
L_2 = ClusterOutput(cull)
C = ClusterOutput(area.Centroid)

# ==== cluster LowestFaceOfBrep
B = ClusterInput()
debrep = DeconstructBrep(Brep=B)  # -> Faces, Edges, Vertices
md_slider = MDSlider(SliderMode=0, slider_value=Point(0.5, 0.5, 0.5), x_domain=Domain(0, 1), y_domain=Domain(0, 1), z_domain=Domain(0, 1))
evalsrf = EvaluateSurface(Surface=reparameterize(debrep.Faces), Point=md_slider)  # -> Point, Normal, UDirection, VDirection, Frame
pdecon = Deconstruct(Point=evalsrf.Point)  # -> XComponent, YComponent, ZComponent
sort = SortList(Keys=pdecon.ZComponent, ValuesA=evalsrf.Point)  # -> Keys, ValuesA
sort_2 = SortList(Keys=pdecon.ZComponent, ValuesA=debrep.Faces)  # -> Keys, ValuesA
item = ListItem(List=sort_2.ValuesA, Index=0, Wrap=True)
item_2 = ListItem(List=sort.ValuesA, Index=0, Wrap=True)
i = ClusterOutput(item)
i_2 = ClusterOutput(item_2)
