# Grasshopper definition Facade_AngledFins.gh (Grasshopper 1.0.7)

inside_line = Curve(<curve referenced from the Rhino model>)
outside_line = Curve(<curve referenced from the Rhino model>)
panel_division = Slider(11, range=0..20)

pframes = PerpFrames(Curve=outside_line, Count=panel_division, Align=True)  # -> Frames, Parameters
pcx = CurvePlane(Curve=inside_line, Plane=pframes.Frames)  # -> flatten(Points), ParamsC, ParamsP
point = Point(pframes.Frames)
shift_list = ShiftList(List=pcx.Points, Shift=1, Wrap=True)  # -> flatten(List)
cull_index = CullIndex(List=shift_list, Indices=14, Wrap=True)
ln = Line(StartPoint=cull_index, EndPoint=point)

brep = Brep(<brep referenced from the Rhino model>)
bounding_box = BoundingBox(Content=brep, Plane=PlaneXY(0, 0, 0))  # -> Box, Box_2
box_corners = BoxCorners(Box=bounding_box.Box)  # -> CornerA, CornerB, CornerC, CornerD, CornerE, CornerF, CornerG, CornerH
distance = Distance(PointA=box_corners.CornerA, PointB=box_corners.CornerE)
subtraction = Subtraction(A=1, B=2)
multiplication = Multiplication(A=distance, B=subtraction)

unit_z = UnitZ(Factor=multiplication)

point_on_curve = PointOnCurve(ln, parameter=1)
number_slider = Slider(1, range=-5..5)
extrude = Extrude(Base=ln, Direction=unit_z)
shift_list_2 = ShiftList(List=point_on_curve, Shift=number_slider, Wrap=False)
subtraction_2 = Subtraction(A=number_slider, B=1)
surface = Surface(extrude)
shift_list_3 = ShiftList(List=ln, Shift=subtraction_2, Wrap=False)
curve_closest_point = CurveClosestPoint(Point=graft(shift_list_2), Curve=graft(shift_list_3))  # -> Point, Parameter, Distance
cull_index_2 = CullIndex(List=surface, Indices=14, Wrap=True)
ln_2 = Line(StartPoint=curve_closest_point.Point, EndPoint=graft(shift_list_2))
extrude_2 = Extrude(Base=ln_2, Direction=unit_z)

surface_2 = Surface(extrude_2)
