# Grasshopper definition Facade_BoxMorphingPanelization.gh (Grasshopper 1.0.7)
# plug-ins: LunchBox

brep = Brep(<brep referenced from the Rhino model>)
brep_2 = Brep(<brep referenced from the Rhino model>)
brep_3 = Brep(<brep referenced from the Rhino model>)
srf = Surface(<surface referenced from the Rhino model>)
facade_panel_size = Slider(8, range=0..10)
extrusion_distance = Slider(5, range=0..10)
extrusion_distance_2 = Slider(2, range=0..10)
random_seed = Slider(3, range=0..10)
dim = Dimensions(Surface=srf)  # -> UDimension, VDimension
expression = Expression(x=dim.UDimension, y=facade_panel_size, Expression="Round((X/Y)/2)")
expression_2 = Expression(x=dim.VDimension, y=facade_panel_size, Expression="Round((X/Y))")
quads = QuadPanels(Surface=srf, UDivisions=expression, VDivisions=expression_2)
randomsplit = RandomSplitList(MasterList=quads, Seed=random_seed, Split=Slider(0.6, range=0..1))  # -> ListA, ListB
srf_2 = Surface(randomsplit.ListB)
srf_3 = Surface(randomsplit.ListA)
quads_2 = QuadPanels(Surface=srf_2, UDivisions=2, VDivisions=1)  # -> simplify(Panels)
quads_3 = QuadPanels(Surface=srf_3, UDivisions=2, VDivisions=1)  # -> simplify(Panels)
item = ListItem(List=quads_3, Index=0, Wrap=True)  # -> Item, Item1
cluster = Cluster(B=quads_2, x=extrusion_distance_2)
surface_a = Surface(item.Item)
surface_b = Surface(item.Item1)
brep_4 = Brep(cluster)
cluster_2 = Cluster(B=surface_a, x=extrusion_distance)
cluster_3 = Cluster(B=surface_b, x=extrusion_distance)
brep_5 = Brep(cluster_3)
brep_6 = Brep(cluster_2)
bbox = BoundingBox(Content=brep, Plane=PlaneXY(0, 0, 0))  # -> Box, Box_2
bbox_2 = BoundingBox(Content=brep_2, Plane=PlaneXY(0, 0, 0))  # -> Box, Box_2
bbox_3 = BoundingBox(Content=brep_3, Plane=PlaneXY(0, 0, 0))  # -> Box, Box_2
morph = BoxMorph(Geometry=brep, Reference=bbox.Box, Target=brep_6)
morph_2 = BoxMorph(Geometry=brep_2, Reference=bbox_2.Box, Target=brep_5)
morph_3 = BoxMorph(Geometry=brep_3, Reference=bbox_3.Box, Target=brep_4)
merge = Merge(Data1=morph, Data2=morph_2, Data3=morph_3)  # -> flatten(Result)

# ---- group: Output - Morphsed Facade
brep_7 = Brep(merge)

# ==== cluster Cluster
x = ClusterInput()
neg = Negative(Value=x)
B = ClusterInput()
X = UnitX(Factor=neg)
extr = Extrude(Base=B, Direction=X)
E = ClusterOutput(extr)
