# Grasshopper definition Facade_FacadeFrameExtrusionByBitmap.gh (Grasshopper 1.0.7)
# plug-ins: Pufferfish

offset_multiplier = Slider(7, range=0..10)
max_rotation = Slider(34, range=0..100)
# LAKE & KEDZIE
# Rotated facade based on bitmap mapping
# 221116 - pietra
input_surface = Brep([<brep referenced from the Rhino model> x30])

bbox = BoundingBox(Content=input_surface, Plane=PlaneXY(0, 0, 0), UnionBox=True)  # -> Box, Box_2
debrep = DeconstructBrep(Brep=bbox.Box)  # -> Faces, Edges, Vertices
item = ListItem(List=debrep.Faces, Index=Slider(1, range=0..10), Wrap=True)
srf = Surface(item)
divide = DivideDomain²(Domain=srf, UCount=Slider(20, range=0..100), VCount=Slider(20, range=0..100))
area = Area(Geometry=input_surface)  # -> Area, Centroid
subsrf = Isotrim(Surface=srf, Domain=divide)
area_2 = Area(Geometry=subsrf)  # -> Area, Centroid
cp = ClosestPoint(Point=area.Centroid, Cloud=area_2.Centroid)  # -> ClosestPoint, CPIndex, Distance
image = ImageSampler(
    cp.ClosestPoint,
    FilePath="C:\Users\Brooks Scarpa\Desktop\Untitled-1.jpg",
    Filter="Value",
    Interpolate=False,
    Umax=1,
    Umin=0,
    Vmax=1,
    Vmin=0,
    Wrap=1)

md_slider = MDSlider(SliderMode=0, slider_value=Point(0.5, 0.5, 0.5), x_domain=Domain(0, 1), y_domain=Domain(0, 1), z_domain=Domain(0, 1))
reparamsrf = ReparameterizeSurface(Surface=input_surface)  # -> Reparameterized, Original
evalsrf = EvaluateSurface(Surface=reparamsrf.Reparameterized, Point=md_slider)  # -> Point, Normal, UDirection, VDirection, Frame

debrep_2 = DeconstructBrep(Brep=input_surface)  # -> Faces, Edges, Vertices
item_2 = ListItem(List=debrep_2.Edges, Index=0, Wrap=True)  # -> flatten(Item)
reparamnums = ReparameterizeNumbers(Numbers=image, Invert=False)  # -> Reparameterized, Original
multiplication = Multiplication(A=image, B=offset_multiplier)
multiplication_2 = Multiplication(A=reparamnums.Reparameterized, B=max_rotation)
amp = Amplitude(Vector=evalsrf.Normal, Amplitude=multiplication)
rotax = RotateAxis(Geometry=input_surface, Angle=degrees(multiplication_2), Axis=item_2)  # -> Geometry, Transform
move = Move(Geometry=rotax.Geometry, Motion=amp)  # -> Geometry, Transform

panel = Panel(image)
brep = Brep(input_surface)
panel_2 = Panel(brep)
debrep_3 = DeconstructBrep(Brep=brep)  # -> Faces, Edges, Vertices
panel_3 = Panel(move.Geometry)
debrep_4 = DeconstructBrep(Brep=move.Geometry)  # -> Faces, Edges, Vertices

item_3 = ListItem(List=debrep_4.Edges, Index=0, Wrap=True)  # -> simplify(Item)
item_4 = ListItem(List=debrep_3.Edges, Index=0, Wrap=True)  # -> simplify(Item)
item_5 = ListItem(List=debrep_4.Edges, Index=1, Wrap=True)  # -> simplify(Item)
item_6 = ListItem(List=debrep_3.Edges, Index=1, Wrap=True)  # -> simplify(Item)
item_7 = ListItem(List=debrep_4.Edges, Index=2, Wrap=True)  # -> simplify(Item)
item_8 = ListItem(List=debrep_3.Edges, Index=2, Wrap=True)  # -> simplify(Item)
item_9 = ListItem(List=debrep_4.Edges, Index=3, Wrap=True)  # -> simplify(Item)
item_10 = ListItem(List=debrep_3.Edges, Index=3, Wrap=True)  # -> simplify(Item)
merge = Merge(Data1=item_3, Data2=item_4)
merge_2 = Merge(Data1=item_5, Data2=item_6)
merge_3 = Merge(Data1=item_7, Data2=item_8)
merge_4 = Merge(Data1=item_9, Data2=item_10)
loft = Loft(Curves=merge, Options={Adjust=False, Closed=False, LoftEnds=0, LoftSimp=0, LoftType=0, Rebuild=10, Refit=0.01})
loft_2 = Loft(Curves=merge_2, Options={Adjust=False, Closed=False, LoftEnds=0, LoftSimp=0, LoftType=0, Rebuild=10, Refit=0.01})
loft_3 = Loft(Curves=merge_3, Options={Adjust=False, Closed=False, LoftEnds=0, LoftSimp=0, LoftType=0, Rebuild=10, Refit=0.01})
loft_4 = Loft(Curves=merge_4, Options={Adjust=False, Closed=False, LoftEnds=0, LoftSimp=0, LoftType=0, Rebuild=10, Refit=0.01})

panel_4 = Panel(item_3)
brep_2 = Brep([loft, loft_2, loft_3, loft_4])
