# Grasshopper definition Facade_MappingShapesOnSurface.gh (Grasshopper 1.0.7)

panel = Panel("PANEL DIVISION")
facade_panel_size = Slider(8, range=0..50)

# ---- group: Input Polysurface
brep = Brep(<brep referenced from the Rhino model>)

# ---- group: Input Surface
srf = Surface(<surface referenced from the Rhino model>)

# ----
divide = DivideDomain²(Domain=srf, UCount=facade_panel_size, VCount=facade_panel_size)
subsrf = Isotrim(Surface=srf, Domain=divide)
md_slider = MDSlider(SliderMode=0, slider_value=Point(0.5, 0.5, 0.5), x_domain=Domain(0, 1), y_domain=Domain(0, 1), z_domain=Domain(0, 1))
evalsrf = EvaluateSurface(Surface=reparameterize(subsrf), Point=md_slider)  # -> Point, Normal, UDirection, VDirection, Frame
bbox = BoundingBox(Content=brep, Plane=PlaneXY(0, 0, 0))  # -> Box, Box_2
volume = Volume(Geometry=bbox.Box)  # -> Volume, Centroid
xy = XYPlane(Origin=volume.Centroid)
orient = Orient(Geometry=brep, Source=xy, Target=evalsrf.Frame)  # -> Geometry, Transform
bbox_2 = BoundingBox(Content=subsrf, Plane=PlaneXY(0, 0, 0))  # -> Box, Box_2
bbox_3 = BoundingBox(Content=orient.Geometry, Plane=PlaneXY(0, 0, 0))  # -> Box, Box_2
morph = BoxMorph(Geometry=orient.Geometry, Reference=bbox_3.Box, Target=bbox_2.Box)

# ---- group: Output - Pattern
brep_2 = Brep(morph)
