# Grasshopper definition Facade_RandomHorizontalSlatPattern.gh (Grasshopper 1.0.7)

srf = Surface(<surface referenced from the Rhino model>)

debrep = DeconstructBrep(Brep=srf)  # -> Faces, Edges, Vertices
item = ListItem(List=debrep.Edges, Index=0, Wrap=True)  # -> Item, Item1, Item2, Item3
crv = Curve(item.Item2)
crv_2 = Curve(item.Item)
number_slider = Slider(35, range=0..200)
flip = FlipCurve(Curve=crv_2)  # -> Curve, Flag
divide = DivideCurve(Curve=flip.Curve, Count=number_slider, Kinks=False)  # -> Points, Tangents, Parameters
divide_2 = DivideCurve(Curve=crv, Count=number_slider, Kinks=False)  # -> Points, Tangents, Parameters
expression = Expression(x=number_slider, y=Slider(10, range=0..100), Expression="(y/100*x)")
ln = Line(StartPoint=divide.Points, EndPoint=divide_2.Points)
shift = ShiftList(List=ln, Shift=1, Wrap=False)  # -> flatten(List)
merge = Merge(Data1=simplify(graft(ln)), Data2=simplify(graft(shift)))
offset_of_frame_for_pattern = Slider(0.4, range=0..1)
item_2 = ListItem(List=merge, Index=0, Wrap=True)  # -> Item, Item1
tweencrv = TweenCurve(CurveA=item_2.Item, CurveB=item_2.Item1, Factor=offset_of_frame_for_pattern, BlendType=0)
lng = ListLength(List=flatten(tweencrv))  # -> flatten(Length)
series = Series(Start=0, Step=1, Count=lng)
random = Random(Range=Domain(0, 1), Number=Slider(12, range=0..100), Seed=series)  # -> simplify(Random)
random_2 = Random(Range=Domain(0, 1), Number=number_slider, Seed=2, Integers=True)  # -> flatten(Random)
python = GhPythonScript(x=random_2)  # -> boolean_1, boolean_2; inputs x: Int32
# ---------- python: Python ----------
__author__ = "ilouh"
__version__ = "2020.04.22"

import rhinoscriptsyntax as rs


boolean_1 = []
boolean_2 = []

if x == 1:
    boolean_1.append('True')
    boolean_2.append('False')
    
else: 
    boolean_1.append('False')
    boolean_2.append('True')
# ---------- end python ----------
shatter = Shatter(Curve=tweencrv, Parameters=expr("round(x,1)", random))
merge_2 = Merge(Data1=python.boolean_1, Data2=python.boolean_2)
cull = CullPattern(List=shatter, CullPattern=merge_2)
crv_3 = Curve([cull, merge])
number_slider_2 = Slider(0.7, range=0..1)
number_slider_3 = Slider(1.75, range=0..10)
flatten = FlattenTree(Tree=crv_3, Path="{0}")
neg = Negative(Value=number_slider_3)
neg_2 = Negative(Value=number_slider_2)
pframe = PerpFrame(Curve=reparameterize(graft(flatten)), Parameter=[0, 1])
dom = ConstructDomain(DomainStart=number_slider_3, DomainEnd=neg)
dom_2 = ConstructDomain(DomainStart=number_slider_2, DomainEnd=neg_2)
rectangle = Rectangle(Plane=pframe, XSize=dom_2, YSize=dom, Radius=0)  # -> Rectangle, Length
loft = Loft(
    Curves=rectangle.Rectangle,
    Options={Adjust=False, Closed=False, LoftEnds=0, LoftSimp=0, LoftType=0, Rebuild=10, Refit=0.01})

cap = CapHoles(Brep=loft)
