# Grasshopper definition Facade_RandomMullionsAndPanelsWithColoring.gh (Grasshopper 1.0.7)

# ---- group: Distance Between Verticals
number_of_verticals = Slider(1, range=0..60)

# ----
vertical_width = Slider(0.5, range=0..36)

# ---- group: Vertical Depth
number_slider = Slider(1, range=0..36)

# ---- group: Base Surface
# REGULATED SPACING
base_surface = Geometry(graft(<brep referenced from the Rhino model>))

# ----
expression = Expression(x=vertical_width, Expression="(X/12)/2")
expression_2 = Expression(x=number_slider, Expression="(X/12)/2")

edges = BrepEdges(Brep=base_surface)  # -> Naked, Interior, NonManifold
curvepoint = PointOnCurve(edges.Naked, parameter=0.5)
pdecon = Deconstruct(Point=curvepoint)  # -> XComponent, YComponent, ZComponent
sort = SortList(Keys=pdecon.ZComponent, ValuesA=edges.Naked)  # -> Keys, ValuesA
item = ListItem(List=reverse(sort.ValuesA), Index=0, Wrap=True)  # -> Item, Item1, Item2, Item3

divlength = DivideLength(Curve=item.Item, Length=number_of_verticals)  # -> Points, Tangents, Parameters
lng = ListLength(List=divlength.Points)  # -> simplify(Length)

midpt = CurveMiddle(Curve=item.Item)
midpt_2 = CurveMiddle(Curve=item.Item3)
dist = Distance(PointA=midpt, PointB=midpt_2)
neg = Negative(Value=dist)

divide = DivideCurve(Curve=reparameterize(simplify(item.Item3)), Count=lng, Kinks=False)  # -> Points, Tangents, Parameters

divide_2 = DivideCurve(Curve=reparameterize(simplify(item.Item)), Count=lng, Kinks=False)  # -> Points, Tangents, Parameters
hframe = HorizontalFrame(Curve=reparameterize(item.Item), Parameter=divide_2.Parameters)

Z = UnitZ(Factor=neg)
move = Move(Geometry=hframe, Motion=Z)  # -> Geometry, Transform

dom = ConstructDomain(DomainStart=expression, DomainEnd=expr("-x", expression))
dom_2 = ConstructDomain(DomainStart=expression_2, DomainEnd=expr("-x", expression_2))

rectangle = Rectangle(Plane=move.Geometry, XSize=dom, YSize=dom_2, Radius=0)  # -> simplify(graft(Rectangle)), Length
rectangle_2 = Rectangle(Plane=hframe, XSize=dom, YSize=dom_2, Radius=0)  # -> simplify(graft(Rectangle)), Length

loft = Loft(
    Curves=[rectangle_2.Rectangle, rectangle.Rectangle],
    Options={Adjust=False, Closed=False, LoftEnds=0, LoftSimp=0, LoftType=0, Rebuild=10, Refit=0.01})
trim = TrimTree(Depth=1)

seed = Slider(4, range=0..10)
ln = Line(StartPoint=divide_2.Points, EndPoint=divide.Points)  # -> simplify(Line)
tstat = TreeStatistics(Tree=ln)  # -> Paths, Length, Count
series = Series(Start=seed, Step=1, Count=tstat.Count)  # -> graft(Series)
jitter = Jitter(List=ln, Jitter=1, Seed=series)  # -> Values, Indices

lng_2 = ListLength(List=ln)
expression_3 = Expression(x=lng_2, y=Slider(0.6, range=0..1), Expression="x*y")

reduce = RandomReduce(List=jitter.Values, Reduction=expression_3, Seed=Slider(6, range=0..10))  # -> simplify(List)
srfsplit = SurfaceSplit(Surface=base_surface, Curves=reduce)  # -> simplify(Fragments)
jitter_2 = Jitter(List=srfsplit, Jitter=1, Seed=series)  # -> Values, Indices
jitter_3 = Jitter(List=jitter_2.Values, Jitter=1, Seed=series)  # -> Values, Indices
dispatch = Dispatch(List=jitter_3.Values, DispatchPattern=[True, False])  # -> ListA, ListB
dispatch_2 = Dispatch(List=dispatch.ListB, DispatchPattern=[True, False])  # -> ListA, ListB
srf = Surface(dispatch.ListA)
srf_2 = Surface(dispatch_2.ListB)
srf_3 = Surface(dispatch_2.ListA)
preview = CustomPreview(Geometry=srf, Material=ColourSwatch(SwatchColor=RGB(68, 86, 255)))
preview_2 = CustomPreview(Geometry=srf_2, Material=ColourSwatch(SwatchColor=RGB(146, 56, 156)))
preview_3 = CustomPreview(Geometry=srf_3, Material=ColourSwatch(SwatchColor=RGB(95, 241, 156)))
