# Grasshopper definition Facade_RandomReduce_ScalePanelSubdivision.gh (Grasshopper 1.0.7)
# plug-ins: LunchBox

srf = Surface(reparameterize(<surface referenced from the Rhino model>))

random_seed = Slider(5, range=0..10)
reduction_percentage = Slider(51, range=0..100)

quads = QuadPanels(Surface=srf, UDivisions=Slider(20, range=0..200), VDivisions=Slider(40, range=0..1000))
lng = ListLength(List=quads)
expression = Expression(x=lng, y=reduction_percentage, Expression="X*(Y/100)")
round = Round(Number=expression)  # -> Nearest, Floor, Ceiling
reduce = RandomReduce(List=quads, Reduction=round.Nearest, Seed=random_seed)
area = Area(Geometry=reduce)  # -> Area, Centroid
srf_cp = SurfaceClosestPoint(Point=area.Centroid, Surface=srf)  # -> Point, UVPoint, Distance

sort = SortList(Keys=srf_cp.Distance)  # -> Keys, ValuesA
int = Integer(srf_cp.Distance)
equals = Equality(FirstNumber=int, SecondNumber=0)  # -> Equality, Inequality
xy = XYPlane(Origin=area.Centroid)
scale_nu = ScaleNU(Geometry=reduce, Plane=xy, ScaleX=1, ScaleY=1, ScaleZ=Slider(0.7, range=0..1))  # -> Geometry, Transform
cull = CullPattern(List=scale_nu.Geometry, CullPattern=equals.Equality)

srf_2 = Surface(cull)
