# Grasshopper definition Facade_RectanglePackingVBAlgorithem.gh (Grasshopper 1.0.7)

list = ValueList({"1: Make Rectangles": 1, "2: Divide surfList": 2, "3: Divide proportional surfList": 3}, selected="1: Make Rectangles")
list_2 = ValueList({"1: Module pieces": 1, "2: Module regions": 2}, selected="1: Module pieces")
c_script = CSharpScript(
    enable=Toggle(True),
    Width=Slider(25, range=10..100),
    Height=Slider(30, range=10..100),
    maxRW=Slider(4, range=2..5),
    maxRH=Slider(3, range=2..5),
    rollTheBones=Slider(601, range=555..666),
    x=Slider(4.3, range=1..5),
    y=Slider(3.7, range=1..5),
    mode=list,
    result=list_2)  # -> out, DucatiumAmamusDumSpiramus, Elapsed, matrixResult, rectanglesTree, branches, surfacesTree; inputs enable: Boolean, Width: Int32, Height: Int32, maxRW: Int32, maxRH: Int32, rollTheBones: Int32, x: Double, y: Double, mode: Int32, surfList: list of Surface, result: Int32
# ---------- c_script: C# usings ----------
using System.IO;
using System.Linq;
using System.Data;
using System.Drawing;
using System.Reflection;
using System.Windows.Forms;
using System.Xml;
using System.Xml.Linq;
using System.Runtime.InteropServices;

using Rhino.DocObjects;
using Rhino.Collections;
using GH_IO;
using GH_IO.Serialization;
# ---------- c_script: C# ----------
    // by The Lord of Darkness due to critical Jack Daniels overdose issues

    if(!enable){ Print(" "); Print("Go date a proper girl ASAP"); return;}

    System.Diagnostics.Stopwatch sw = new System.Diagnostics.Stopwatch();
    sw.Start();

    Matrix matrix = GenerateGrid(Width, Height, maxRW, maxRH);
    matrixResult = matrix;           //>> out

    surfList = surfList.Where(s => s != null).ToList();
    if(!surfList.Any()) mode = 1;

    switch(mode){
      case 1:
        DataTree<Rectangle3d> rTree = new DataTree<Rectangle3d>();
        Point3d orig = new Point3d(0, 0, 0);
        MakeRectanglesTree(matrix, ref rTree, x, y, orig);
        Print(" "); Print("Made: {0} rectangle branches", rTree.BranchCount);
        rectanglesTree = rTree;          //>> out
        branches = rTree.BranchCount;    //>> out
        break;
      case 2:
        DataTree<Surface> sTree = new DataTree<Surface>();
        MakeSurfaceDivisionsTree(surfList, matrix, ref sTree);
        Print(" "); Print("Made: {0} surface branches", sTree.BranchCount);
        surfacesTree = sTree;            //>> out
        branches = sTree.BranchCount;    //>> out
        break;
    }

    Print(" "); Print("For sale: Blade '17, RC8R '16 (hurry!)");

    sw.Stop();
    Elapsed = (string.Format("Elapsed: {0}ms", sw.Elapsed.TotalMilliseconds));
# ---------- c_script: C# additional code ----------
  private Matrix GenerateGrid(int  totalWidth, int totalHeight, int maxRegionWidth, int maxRegionHeight){

    Matrix gridMatrix = new Matrix(totalHeight, totalWidth); //do you know that in the Matrix there's a Ducati 996?
    gridMatrix.Zero(); // ---------this means that any cell is available to play ball (i.e. belongs in some region)

    Random random = new Random();
    byte cellNumber = 1;

    for (int y = 0; y < totalHeight; y++)
      for (int x = 0; x < totalWidth; x++){
        if (gridMatrix[y, x] != 0) continue; // Cell is already included in some region (i.e. go date another girl)

        int cellWidth; int cellHeight;  bool isInRegion;
        do {
          cellWidth = random.Next(0, maxRegionWidth) + 1;
          cellHeight = random.Next(0, maxRegionHeight) + 1;

          // ----------------------------------------------------------- Check whether the cell fits in the region
          isInRegion = totalWidth - x < cellWidth || totalHeight - y < cellHeight;
          if (isInRegion) continue;

          // -------------------------------- Check whether the (free [i.e. matrix cell = 0]) space isn't occupied
          for (var yOffset = 0; yOffset < cellHeight; yOffset++)
            for (var xOffset = 0; xOffset < cellWidth; xOffset++)
              isInRegion |= gridMatrix[y + yOffset, x + xOffset] != 0;

        } while (isInRegion);

        // ------------------------------------------------------------------ Assign the cell number to the matrix
        for (int yOffset = 0; yOffset < cellHeight; yOffset++)
          for (int xOffset = 0; xOffset < cellWidth; xOffset++)
            gridMatrix[y + yOffset, x + xOffset] = cellNumber;

        cellNumber++;
      }
    return gridMatrix;
  }

  public void MakeRectanglesTree(Matrix matrix, ref  DataTree<Rectangle3d> rTree, double x, double y, Point3d orig){

    //---------------------------------Note: a Matrix starts from up left ends to bottom right (unlike a tree)
    Interval intvX = new Interval(-x / 2.0, x / 2.0);
    Interval intvY = new Interval(-y / 2.0, y / 2.0);

    for(int c = 0; c < matrix.ColumnCount;c++){
      int rowCount = 0;
      for(int r = matrix.RowCount - 1;r >= 0; r--){    // since the above is true ... when at Rome blah, blah
        int branch = (int) matrix[r, c];
        Vector3d dir = new Vector3d(c * x, rowCount * y, 0);
        Plane plane = new Plane(orig + dir, Plane.WorldXY.ZAxis);
        Rectangle3d module = new Rectangle3d(plane, intvX, intvY);
        rTree.Add(module, new GH_Path(branch));
        rowCount++;
      }
    }
  }

  public void MakeSurfaceDivisionsTree(List<Surface> sList, Matrix matrix, ref  DataTree<Surface> sTree){

    //--------------------------------Note: a Matrix starts from up left ends to bottom right (unlike a tree)
    Interval intv = new Interval(0, 1);
    double stepU = 1 / (double) matrix.ColumnCount;
    double stepV = 1 / (double) matrix.RowCount;

    for(int s = 0; s < sList.Count;s++){
      Surface srf = sList[s];
      srf.SetDomain(0, new Interval(0, 1)); srf.SetDomain(1, new Interval(0, 1));
      for(int u = 0; u < matrix.ColumnCount;u++){
        double u0 = intv.ParameterAt(u * stepU);
        double u1 = intv.ParameterAt((u + 1) * stepU);
        Interval U = new Interval(u0, u1);
        for(int v = matrix.RowCount - 1;v >= 0; v--){ // since the above is true ... when at Rome blah, blah
          int branch = (int) matrix[v, u];
          double v0 = intv.ParameterAt(v * stepV);
          double v1 = intv.ParameterAt((v + 1) * stepV);
          Interval V = new Interval(v0, v1);
          Surface piece = srf.Trim(U, V);
          sTree.Add(piece, new GH_Path(s, branch));
        }
      }
    }
  }
# ---------- end c_script ----------
time_flies = Panel(c_script.Elapsed)
boundary = BoundarySurfaces(Edges=c_script.rectanglesTree)
panel = Panel(boundary)
bbox = BoundingBox(Content=boundary, Plane=PlaneXY(0, 0, 0), UnionBox=True)  # -> Box, Box_2
