# Grasshopper definition Facade_RotatingBrickScreen.gh (Grasshopper 1.0.7)

# ---- group: Rotation Multiplier
number_slider = Slider(2, range=1..10)

# ----
srf = Surface(<surface referenced from the Rhino model>)
spacing = Slider(9, range=0..10)

# ---- group: Get Surface Edges
getsrflowerupperedges = GetSrfLowerUpperEdges(B=srf)  # -> i, item_3
loweredge = Curve(getsrflowerupperedges.i)
upperedge = Curve(getsrflowerupperedges.item_3)

# ----
len = Length(Curve=loweredge)
expression = Expression(x=len, y=spacing, Expression="Floor(Round(x/y))")
Z = UnitZ(Factor=1)
divide = DivideCurve(Curve=loweredge, Count=expression, Kinks=False)  # -> Points, Tangents, Parameters
project = ProjectPoint(Point=divide.Points, Direction=Z, Geometry=upperedge)  # -> Point, Index
ln = Line(StartPoint=divide.Points, EndPoint=project.Point)

rotating_brick_axis_lines = Curve(ln)
preview = CustomPreview()

# ---- group: mul
loft = Loft(
    Curves=rotating_brick_axis_lines,
    Options={Adjust=False, Closed=False, LoftEnds=0, LoftSimp=0, LoftType=0, Rebuild=10, Refit=0.01})
python = GhPythonScript(x=rotating_brick_axis_lines)  # -> li_points, curves; inputs x: list of Curve
# ---------- python: Python ----------
__author__ = "Brooks Scarpa"
__version__ = "2020.06.22"

import rhinoscriptsyntax as rs
import ghpythonlib as gh

curves = x 
t = 0.5

li_points = []

for curve in curves:
    midpoints = gh.components.EvaluateCurve(curve,t)
    midpoints = midpoints[0]
    crv_midpoint = midpoints[1]
    
    li_points.append(crv_midpoint)
# ---------- end python ----------
sort = SortList(Keys=python.li_points, ValuesA=python.curves)  # -> Keys, ValuesA
brep = Brep(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)
python_2 = GhPythonScript(curves=graft(sort.ValuesA))  # -> points; inputs curves: list of Curve
# ---------- python_2: Python ----------
__author__ = "Brooks Scarpa"
__version__ = "2020.06.22"

import rhinoscriptsyntax as rs
import ghpythonlib as gh


li_points = []
segment = 2.25 + 0.5
for curve in curves:
    
    points = rs.DivideCurveLength(curve,segment,create_points = True)
    
    print(points)
# ---------- end python_2 ----------
mesh = Mesh(brep)
xy = XYPlane(Origin=Point(0, 0, 0))
python_3 = GhPythonScript(mesh=mesh, x=xy)  # -> center; inputs mesh: Mesh, x: Plane
# ---------- python_3: Python ----------
__author__ = "Brooks Scarpa"
__version__ = "2020.06.22"

import rhinoscriptsyntax as rs
import ghpythonlib as gh

bbox = gh.components.BoundingBox(mesh,x)
bbox = bbox[0]

center = gh.components.Volume(bbox)
center = center[1]
# ---------- end python_3 ----------
panel = Panel(python_2)
xy_2 = XYPlane(Origin=python_3)
xy_3 = XYPlane(Origin=panel)
orient = Orient(Geometry=mesh, Source=xy_2, Target=xy_3)  # -> Geometry, Transform

surface_points_where_bricks_rotate = Point(simplify(python_2))
input_surface = Surface(loft)
srf_cp = SurfaceClosestPoint(Point=surface_points_where_bricks_rotate, Surface=reparameterize(input_surface))  # -> Point, UVPoint, Distance

# ----
image = ImageSampler(srf_cp.UVPoint, Filter="Colour", Interpolate=False, Umax=1, Umin=0, Vmax=1, Vmin=0, Wrap=0)

# ---- group: mul (continued)
panel_2 = Panel(image)
python_4 = GhPythonScript(x=panel_2, mul=number_slider)  # -> x
# ---------- python_4: Python ----------
__author__ = "Brooks Scarpa"
__version__ = "2020.06.22"

import rhinoscriptsyntax as rs
import math
import ghpythonlib as gh
print(type(x))

str = x 

x = str.split(',')
x = [int(x) for x in x]
x = gh.components.Average(x)

x = gh.components.RemapNumbers(x,[0,255],[0,45])

x = math.floor(x[1])

x = x*mul
# ---------- end python_4 ----------
panel_3 = Panel(python_4)
rotate = Rotate(Geometry=orient.Geometry, Angle=degrees(panel_3), Plane=xy_3)  # -> Geometry, Transform

# ---- group: Output - Bricks
bricks_mesh = Mesh(rotate.Geometry)

# ---- group: Rotation Angles
tag = TextTag(Location=panel, Text=python_4)

# ==== cluster GetSrfLowerUpperEdges
B = ClusterInput()
edges = BrepEdges(Brep=B)  # -> Naked, Interior, NonManifold
crv = Curve(edges.Naked)
midpt = CurveMiddle(Curve=crv)
pdecon = Deconstruct(Point=midpt)  # -> XComponent, YComponent, ZComponent
sort = SortList(Keys=pdecon.ZComponent, ValuesA=crv)  # -> Keys, ValuesA
item = ListItem(List=sort.ValuesA, Index=0, Wrap=True)  # -> Item, Item1, Item2, Item3
i = ClusterOutput(item.Item)
item_3 = ClusterOutput(item.Item3)
