# Grasshopper definition Facade_ScallopFacadeScript.gh (Grasshopper 1.0.7)

# Ensure curves are parallel to X axis
sill_curve = Curve(<curve referenced from the Rhino model>)
head_curve = Curve(<curve referenced from the Rhino model>)

# ---- group: Random Seed
seed = Slider(2, range=0..10)

# ---- group: Dimension Criteria
min_width = Slider(50, range=0..100)
max_width = Slider(120, range=0..200)

# ----
crv = Curve(sill_curve)
crv_2 = Curve(head_curve)

flip = FlipCurve(Curve=crv)  # -> Curve, Flag
len = Length(Curve=crv_2)
crv_3 = Curve(crv)
len_2 = Length(Curve=crv_3)
panel = Panel(len_2)
panel_2 = Panel(len)
round = Round(Number=panel)  # -> Nearest, Floor, Ceiling
round_2 = Round(Number=panel_2)  # -> Nearest, Floor, Ceiling
panel_3 = Panel(round.Nearest)
panel_4 = Panel(round_2.Nearest)
python = GhPythonScript(Crv_Len=panel_4, Seed=seed, Min_Width=min_width, Max_Width=max_width)  # -> t_parameter; inputs Crv_Len: Int32
# ---------- python: Python ----------
__author__ = "Brooks Scarpa"
__version__ = "2021.06.14"

import rhinoscriptsyntax as rs
import random

t_parameter = []
sum = 0 

random.seed(a=Seed)

for i in range (0,1000):
    
    if sum < Crv_Len:
        a = random.randrange(Min_Width, stop=Max_Width, step=6)
        print(a)
        sum = sum + a
        t = sum/Crv_Len
        t_parameter.append(t)
    
    else: 
        break
# ---------- end python ----------
lng = ListLength(List=python)
python_2 = GhPythonScript(Crv_Len=panel_3, Max_Values=lng, Min_Width=min_width, Max_Width=max_width, Seed=seed)  # -> t_parameter; inputs Crv_Len: Int32
# ---------- python_2: Python ----------
__author__ = "Brooks Scarpa"
__version__ = "2021.06.14"

import rhinoscriptsyntax as rs
import random

t_parameter = []
sum = 0 
Seed = Seed * 2
random.seed(a=Seed)

for i in range (0,Max_Values):
    

    a = random.randrange(Min_Width, stop=Max_Width, step=6)
    print(a)
    sum = sum + a
    t = sum/Crv_Len
    t_parameter.append(t)
# ---------- end python_2 ----------
bnd = Bounds(Numbers=python_2)
remap = RemapNumbers(Value=python_2, Source=bnd, Target=Domain(0, 1))  # -> Mapped, Clipped
bnd_2 = Bounds(Numbers=python)
remap_2 = RemapNumbers(Value=python, Source=bnd_2, Target=Domain(0, 1))  # -> Mapped, Clipped
eval = EvaluateCurve(Curve=reparameterize(crv_3), Parameter=remap.Mapped)  # -> Point, Tangent, Angle
eval_2 = EvaluateCurve(Curve=reparameterize(crv_2), Parameter=remap_2.Mapped)  # -> Point, Tangent, Angle
lng_2 = ListLength(List=eval_2.Point)
python_3 = GhPythonScript(li_Len=lng_2, Seed=Slider(10, range=0..10), Ran=Slider(7, range=0..10))  # -> values; inputs Ran: Int32
# ---------- python_3: Python ----------
__author__ = "Brooks Scarpa"
__version__ = "2021.06.14"

import rhinoscriptsyntax as rs
import random

random.seed(a=Seed)
values = []

for i in range (0,Ran):
    
    a = random.choice(range(0, li_Len))
    values.append(a)
# ---------- end python_3 ----------
ln = Line(StartPoint=eval.Point, EndPoint=eval_2.Point)
sort = SortList(Keys=python_3)  # -> Keys, ValuesA
series = Series(Start=0, Step=1, Count=lng_2)
dcon = DeleteConsecutive(Set=sort.Keys, Wrap=False)  # -> Set, Count
panel_5 = Panel(dcon.Set)
python_4 = GhPythonScript(idxs=panel_5, li=series)  # -> bol_pattern; inputs idxs: list, li: list
# ---------- python_4: Python ----------
__author__ = "Brooks Scarpa"
__version__ = "2021.06.14"

import rhinoscriptsyntax as rs
import random


bol_pattern = []

for i in range (0,len(li)):
    print(li[i])
    if li[i] in idxs:
        print(li[i])
        Value = 'False'
    
    else:
        Value = 'True'
        
    bol_pattern.append(Value)
# ---------- end python_4 ----------
panel_6 = Panel(python_4)
dispatch = Dispatch(List=ln, DispatchPattern=panel_6)  # -> ListA, ListB

_3_0_max = Curve(dispatch.ListB)
_12_max = Curve(dispatch.ListA)

dispatch_2 = Dispatch(List=_3_0_max, DispatchPattern=[True, False])  # -> ListA, ListB
dispatch_3 = Dispatch(List=_12_max, DispatchPattern=[True, False])  # -> ListA, ListB
flip_2 = FlipCurve(Curve=dispatch_2.ListB)  # -> Curve, Flag
flip_3 = FlipCurve(Curve=dispatch_3.ListB)  # -> Curve, Flag
merge = Merge(Data1=dispatch_2.ListA, Data2=flip_2.Curve)
merge_2 = Merge(Data1=dispatch_3.ListA, Data2=flip_3.Curve)
end = EndPoints(Curve=merge)  # -> Start, End
end_2 = EndPoints(Curve=merge_2)  # -> Start, End
Y = UnitY(Factor=Slider(8, range=0..100))
Y_2 = UnitY(Factor=Slider(8, range=0..100))
Y_3 = UnitY(Factor=Slider(8, range=0..100))
neg = Negative(Value=Y)
Y_4 = UnitY(Factor=Slider(8, range=0..100))
neg_2 = Negative(Value=Y_2)
move = Move(Geometry=end.Start, Motion=Y)  # -> Geometry, Transform
neg_3 = Negative(Value=Y_3)
move_2 = Move(Geometry=end.End, Motion=Y_2)  # -> Geometry, Transform
neg_4 = Negative(Value=Y_4)
move_3 = Move(Geometry=end_2.Start, Motion=Y_3)  # -> Geometry, Transform
move_4 = Move(Geometry=end_2.End, Motion=Y_4)  # -> Geometry, Transform

ln_2 = Line(StartPoint=move_3.Geometry, EndPoint=move_4.Geometry)
ln_3 = Line(StartPoint=move.Geometry, EndPoint=move_2.Geometry)
weave = Weave(Pattern=panel_6, Stream0=ln_2, Stream1=ln_3, NullGaps=False)

midpt = CurveMiddle(Curve=weave)
pdecon = Deconstruct(Point=midpt)  # -> XComponent, YComponent, ZComponent
panel_7 = Panel(pdecon.XComponent)
sort_2 = SortList(Keys=panel_7, ValuesA=weave)  # -> Keys, ValuesA
crv_4 = Curve(sort_2.ValuesA)
item = ListItem(List=crv_4, Index=0, Wrap=True)
flip_4 = FlipCurve(Curve=crv_4, Guide=item)  # -> Curve, Flag
shift = ShiftList(List=flip_4.Curve, Shift=1, Wrap=False)
merge_3 = Merge(Data1=simplify(graft(flip_4.Curve)), Data2=simplify(graft(shift)))
loft = Loft(Curves=merge_3, Options={Adjust=False, Closed=False, LoftEnds=0, LoftSimp=0, LoftType=0, Rebuild=10, Refit=0.01})

srf = Surface(loft)
md_slider = MDSlider(SliderMode=0, slider_value=Point(0.5, 0.5, 0.5), x_domain=Domain(0, 1), y_domain=Domain(0, 1), z_domain=Domain(0, 1))
debrep = DeconstructBrep(Brep=srf)  # -> Faces, Edges, Vertices
iso = IsoCurve(Surface=reparameterize(srf), UVPoint=md_slider)  # -> UIsocurve, VIsocurve
Y_5 = UnitY(Factor=Slider(10, range=0..10))
item_2 = ListItem(List=debrep.Edges, Index=0, Wrap=True)  # -> Item, Item1, Item2, Item3
neg_5 = Negative(Value=Y_5)
crv_5 = Curve(item_2.Item1)
crv_6 = Curve(item_2.Item3)
crv_7 = Curve(iso.VIsocurve)
move_5 = Move(Geometry=crv_7, Motion=neg_5)  # -> Geometry, Transform
merge_4 = Merge(Data1=crv_5, Data2=move_5.Geometry, Data3=crv_6)
flip_5 = FlipCurve(Curve=merge_4, Guide=crv_7)  # -> Curve, Flag
loft_2 = Loft(Curves=flip_5.Curve, Options={Adjust=False, Closed=False, LoftEnds=0, LoftSimp=0, LoftType=0, Rebuild=10, Refit=0.01})

# ---- group: Output Surfaces
srf_2 = Surface(flatten(loft_2))
