# Grasshopper definition Facade_VerticalMullions.gh (Grasshopper 1.0.7)

number_of_verticals = Slider(4, range=0..60)
vertical_width = Slider(2, range=0..36)

# ---- group: Vertical Depth
number_slider = Slider(10, range=0..36)

# ---- group: Base Surface
# REGULATED SPACING
base_surface = Geometry(graft([<brep referenced from the Rhino model> x15]))

# ----
expression = Expression(x=vertical_width, Expression="(X/12)/2")
expression_2 = Expression(x=number_slider, Expression="(X/12)/2")

edges = BrepEdges(Brep=base_surface)  # -> Naked, Interior, NonManifold
curvepoint = PointOnCurve(edges.Naked, parameter=0.5)
pdecon = Deconstruct(Point=curvepoint)  # -> XComponent, YComponent, ZComponent
sort = SortList(Keys=pdecon.ZComponent, ValuesA=edges.Naked)  # -> Keys, ValuesA
item = ListItem(List=reverse(sort.ValuesA), Index=0, Wrap=True)  # -> Item, Item1, Item2, Item3

divlength = DivideLength(Curve=item.Item, Length=number_of_verticals)  # -> Points, Tangents, Parameters
lng = ListLength(List=divlength.Points)  # -> simplify(Length)

midpt = CurveMiddle(Curve=item.Item)
midpt_2 = CurveMiddle(Curve=item.Item3)
dist = Distance(PointA=midpt, PointB=midpt_2)
neg = Negative(Value=dist)

divide = DivideCurve(Curve=reparameterize(simplify(item.Item)), Count=lng, Kinks=False)  # -> Points, Tangents, Parameters
hframe = HorizontalFrame(Curve=reparameterize(item.Item), Parameter=divide.Parameters)

Z = UnitZ(Factor=neg)
move = Move(Geometry=hframe, Motion=Z)  # -> Geometry, Transform

dom = ConstructDomain(DomainStart=expression, DomainEnd=expr("-x", expression))
dom_2 = ConstructDomain(DomainStart=expression_2, DomainEnd=expr("-x", expression_2))

rectangle = Rectangle(Plane=move.Geometry, XSize=dom, YSize=dom_2, Radius=0)  # -> simplify(graft(Rectangle)), Length
rectangle_2 = Rectangle(Plane=hframe, XSize=dom, YSize=dom_2, Radius=0)  # -> simplify(graft(Rectangle)), Length

loft = Loft(
    Curves=[rectangle_2.Rectangle, rectangle.Rectangle],
    Options={Adjust=False, Closed=False, LoftEnds=0, LoftSimp=0, LoftType=0, Rebuild=10, Refit=0.01})
