# Grasshopper definition Facade_VerticalSlats.gh (Grasshopper 1.0.7)

# ---- group: Input - Rec. Profile Dimensions
slider = Slider(2, range=0..12)
slider_2 = Slider(4, range=-12..12)

# ---- group: Input - Vertical Extrusion Dimension
number_slider = Slider(40, range=0..100)

# ---- group: Input - Base Curve
facade_base_curve = Curve(<curve referenced from the Rhino model>)

# ---- group: Input - O.C dimension
number_slider_2 = Slider(5, range=0..100)

# ----
divlength = DivideLength(Curve=facade_base_curve, Length=number_slider_2)  # -> Points, Tangents, Parameters
crv_cp = CurveCP(Point=divlength.Points, Curve=facade_base_curve)  # -> Point, Parameter, Distance
hframe = HorizontalFrame(Curve=facade_base_curve, Parameter=crv_cp.Parameter)
pcomp = PlaneComponents(Plane=hframe)  # -> Origin, XAxis, YAxis, ZAxis
pl = Plane(Origin=pcomp.Origin, XAxis=pcomp.XAxis, YAxis=expr("-x", pcomp.YAxis))
dom = Domain(DomainStart=expr("-x/2", slider), DomainEnd=expr("x/2", slider))
dom_2 = Domain(DomainStart=expr("-x/2", slider_2), DomainEnd=expr("x/2", slider_2))
rectangle = Rectangle(Plane=pl, XSize=dom, YSize=dom_2, Radius=0)  # -> Rectangle, Length
Z = UnitZ(Factor=number_slider)
extr = Extrude(Base=rectangle.Rectangle, Direction=Z)
cap = CapHoles(Brep=extr)

# ---- group: Output - Vertical Slats
brep = Brep(cap)
