# Grasshopper definition Graphics_PopulateEntourageOnSurface.gh (Grasshopper 1.0.7)

# ---- group: Input - Boundary Area for Entourage Population
crv = Curve(<curve referenced from the Rhino model>)

# ---- group: Input - subdivision of Region
surface_resolution = Slider(10, range=0..100)

# ---- group: Input - Entourage
geo = Geometry(simplify([<brep referenced from the Rhino model> x2]))

# ---- group: Population Percentage Reduction
reduction_percentage = Slider(72, range=0..100)

# ----
random_seed = Slider(81, range=0..100)

# ---- group: Min/Max Angle of Rotation
min_angle = Slider(0, range=0..100)
max_angle = Slider(463, range=0..1000)

# ---- group: Min/Max Scale Factor
min_scale_factor = Slider(0.2, range=0..1)
max_scale_factor = Slider(1, range=0..1)

# ----
boundary = BoundarySurfaces(Edges=crv)
divide = DivideDomain²(Domain=boundary, UCount=surface_resolution, VCount=surface_resolution)
subsrf = Isotrim(Surface=boundary, Domain=divide)
area = Area(Geometry=subsrf)  # -> Area, Centroid

group = Group(Objects=geo)

bbox = BoundingBox(Content=group, Plane=PlaneXY(0, 0, 0), UnionBox=True)  # -> Box, Box_2
lowestfaceofbrep = LowestFaceOfBrep(B=bbox.Box)  # -> i, i_2

pt = Point(lowestfaceofbrep.i_2)
geo_2 = Geometry(simplify(group))
orient = Orient(Geometry=geo_2, Source=pt, Target=area.Centroid)  # -> Geometry, Transform
lng = ListLength(List=orient.Geometry)
expression = Expression(x=lng, y=reduction_percentage, Expression="round(x*(y/100),0)")
reduce = RandomReduce(List=orient.Geometry, Reduction=expression, Seed=random_seed)
geo_3 = Geometry(simplify(graft(reduce)))

bbox_2 = BoundingBox(Content=reduce, Plane=PlaneXY(0, 0, 0), UnionBox=False)  # -> Box, Box_2
lowestfaceofbrep_2 = LowestFaceOfBrep(B=bbox_2.Box)  # -> i, i_2

lng_2 = ListLength(List=flatten(geo_3))
dom = ConstructDomain(DomainStart=min_angle, DomainEnd=max_angle)
random = Random(Range=dom, Number=lng_2, Seed=random_seed, Integers=True)  # -> graft(Random)

dom_2 = ConstructDomain(DomainStart=min_scale_factor, DomainEnd=max_scale_factor)
random_2 = Random(Range=dom_2, Number=lng_2, Seed=random_seed, Integers=False)  # -> graft(Random)

pt_2 = Point(simplify(lowestfaceofbrep_2.i_2))

rotate = Rotate(Geometry=geo_3, Angle=degrees(random), Plane=pt_2)  # -> Geometry, Transform
scale = Scale(Geometry=rotate.Geometry, Center=pt_2, Factor=expr("round(x,1)", random_2))  # -> Geometry, Transform

# ---- group: Output - Geometry
preview = CustomPreview(
    Geometry=scale.Geometry,
    Material={diffuse=RGB(221, 160, 221), emission=RGB(66, 48, 66), shine=0.5, specular=RGB(255, 255, 255), transparency=0})

# ==== cluster LowestFaceOfBrep
B = ClusterInput()
debrep = DeconstructBrep(Brep=B)  # -> Faces, Edges, Vertices
md_slider = MDSlider(SliderMode=0, slider_value=Point(0.5, 0.5, 0.5), x_domain=Domain(0, 1), y_domain=Domain(0, 1), z_domain=Domain(0, 1))
evalsrf = EvaluateSurface(Surface=reparameterize(debrep.Faces), Point=md_slider)  # -> Point, Normal, UDirection, VDirection, Frame
pdecon = Deconstruct(Point=evalsrf.Point)  # -> XComponent, YComponent, ZComponent
sort = SortList(Keys=pdecon.ZComponent, ValuesA=evalsrf.Point)  # -> Keys, ValuesA
sort_2 = SortList(Keys=pdecon.ZComponent, ValuesA=debrep.Faces)  # -> Keys, ValuesA
item = ListItem(List=sort_2.ValuesA, Index=0, Wrap=True)
item_2 = ListItem(List=sort.ValuesA, Index=0, Wrap=True)
i = ClusterOutput(item)
i_2 = ClusterOutput(item_2)
