# Grasshopper definition Graphics_RandomColorGroupofBreps.gh (Grasshopper 1.0.7)

# ---- group: Input - Multiple Breps
brep = Brep([<brep referenced from the Rhino model> x2])

# ---- group: Input - Color Swatches
swatch = ColourSwatch(SwatchColor=RGB(242, 231, 12))
swatch_2 = ColourSwatch(SwatchColor=RGB(0, 103, 176))
swatch_3 = ColourSwatch(SwatchColor=RGB(212, 109, 30))

# ----
lng = ListLength(List=brep)
random = Random(Range=Domain(0, 2), Number=lng, Seed=Slider(100, range=0..100))
int = Integer(random)
sift = SiftPattern(List=brep, SiftPattern=int)  # -> Output0, Output1, Output2
geo = Geometry(sift.Output1)
geo_2 = Geometry(sift.Output0)
geo_3 = Geometry(sift.Output2)

preview = CustomPreview(Geometry=geo_2, Shader=swatch)
preview_2 = CustomPreview(Geometry=geo, Shader=swatch_2)
preview_3 = CustomPreview(Geometry=geo_3, Shader=swatch_3)
