# Grasshopper definition Interoperable_RevitWallsFromCenterline&Brep.gh (Grasshopper 1.0.7)
# plug-ins: Rhino.Inside for Autodesk Revit, Pufferfish

list = ValueList({"On": 0, "Off": 1}, selected="On")

# ---- group: Storefronts
wll = WallLocationLine({"Wall Centerline": 0, "Core Centerline": 1, "Finish (Exterior Face)": 2, "Finish (Interior Face)": 3, "Core (Exterior Face)": 4, "Core (Interior Face)": 5}, selected="Wall Centerline")  # disabled

# ---- group: 1st Floor
select_type = Slider(0, range=0..10)  # disabled
levels = LevelsPicker(<levels picker referenced from the Revit model>)  # disabled
_1st_floor_plate = Brep(<brep referenced from the Rhino model>)  # disabled
types = QueryTypes(Kind=3, Category=<geometry referenced from the Revit model>)  # disabled
item = ListItem(List=types, Index=select_type, Wrap=True)  # disabled
panel = Panel(item)  # disabled
identity = LevelIdentity(Level=levels)  # -> Name, Elevation, Structural, BuildingStory; disabled
pt = ConstructPoint(XCoordinate=0, YCoordinate=0, ZCoordinate=identity.Elevation)  # disabled
xy = XYPlane(Origin=pt)  # disabled

# ----
gate = StreamGate(Stream=_1st_floor_plate, Gate=list)  # -> Target0, Target1; disabled

# ---- group: 1st Floor (continued)
brep_top_boundary = BrepTopBoundary(B=gate.Target0)  # disabled
movetoplane = MoveToPlane(Geometry=brep_top_boundary, Plane=xy, Above=True, Below=True)  # -> Geometry, Transform; disabled
floor = AddFloor(Boundary=movetoplane.Geometry, Type=item, Level=levels, TrackingMode=2)  # disabled

# ---- group: 2nd Floor
levels_2 = LevelsPicker(<levels picker referenced from the Revit model>)  # disabled
_2nd_floor_plate = Brep([<brep referenced from the Rhino model> x11])  # disabled
identity_2 = LevelIdentity(Level=levels_2)  # -> Name, Elevation, Structural, BuildingStory; disabled
pt_2 = ConstructPoint(XCoordinate=0, YCoordinate=0, ZCoordinate=identity_2.Elevation)  # disabled
xy_2 = XYPlane(Origin=pt_2)  # disabled

# ----
gate_2 = StreamGate(Stream=_2nd_floor_plate, Gate=list)  # -> Target0, Target1; disabled

# ---- group: 3rd Floor
levels_3 = LevelsPicker(<levels picker referenced from the Revit model>)  # disabled
_3rd_floor_plate = Brep([<brep referenced from the Rhino model> x15])  # disabled
identity_3 = LevelIdentity(Level=levels_3)  # -> Name, Elevation, Structural, BuildingStory; disabled
pt_3 = ConstructPoint(XCoordinate=0, YCoordinate=0, ZCoordinate=identity_3.Elevation)  # disabled
xy_3 = XYPlane(Origin=pt_3)  # disabled

# ----
gate_3 = StreamGate(Stream=_3rd_floor_plate, Gate=list)  # -> Target0, Target1; disabled

# ---- group: Roof
levels_4 = LevelsPicker(<levels picker referenced from the Revit model>)
roof_type = Slider(3, range=0..10)
roof_outline = Brep([<brep referenced from the Rhino model> x2])
identity_4 = LevelIdentity(Level=levels_4)  # -> Name, Elevation, Structural, BuildingStory
pt_4 = ConstructPoint(XCoordinate=0, YCoordinate=0, ZCoordinate=identity_4.Elevation)
xy_4 = XYPlane(Origin=pt_4)

# ----
gate_4 = StreamGate(Stream=roof_outline, Gate=list)  # -> Target0, Target1

# ---- group: Roof (continued)
brep_top_boundary_2 = BrepTopBoundary(B=gate_4.Target0)  # -> flatten(C)
panel_2 = Panel(brep_top_boundary_2)
movetoplane_2 = MoveToPlane(Geometry=brep_top_boundary_2, Plane=xy_4, Above=True, Below=True)  # -> Geometry, Transform
roof = AddRoof(Boundary=movetoplane_2.Geometry, Type=<hostobjecttype referenced from the Revit model>, Level=levels_4, TrackingMode=2)

# ---- group: 2nd Floor (continued)
brep_top_boundary_3 = BrepTopBoundary(B=gate_2.Target0)  # disabled
movetoplane_3 = MoveToPlane(Geometry=brep_top_boundary_3, Plane=xy_2, Above=True, Below=True)  # -> Geometry, Transform; disabled

# ----
simplify = SimplifyCurve(Curve=movetoplane_3.Geometry)  # -> simplify(Curve), Simplified; disabled

# ---- group: 2nd Floor (continued)
floor_2 = AddFloor(Boundary=simplify.Curve, Type=<hostobjecttype referenced from the Revit model>, Level=levels_2, TrackingMode=2)  # disabled

# ---- group: 3rd Floor (continued)
brep_top_boundary_4 = BrepTopBoundary(B=gate_3.Target0)  # disabled
movetoplane_4 = MoveToPlane(Geometry=brep_top_boundary_4, Plane=xy_3, Above=True, Below=True)  # -> Geometry, Transform; disabled

# ----
simplify_2 = SimplifyCurve(Curve=movetoplane_4.Geometry)  # -> simplify(Curve), Simplified; disabled

# ---- group: 3rd Floor (continued)
floor_3 = AddFloor(Boundary=simplify_2.Curve, Type=<hostobjecttype referenced from the Revit model>, Level=levels_3, TrackingMode=2)  # disabled

# ---- group: Stairs
categories = DirectShapeCategories("autodesk.revit.category.local:stairs-1.0.0", SearchPattern="stairs")  # disabled
stair = Brep(graft([<brep referenced from the Rhino model> x2]))  # disabled
panel_3 = Panel("Stair")  # disabled

# ----
gate_5 = StreamGate(Stream=stair, Gate=list)  # -> Target0, Target1; disabled

# ---- group: Stairs (continued)
geodshape = AddGeometryDirectShape(Name=panel_3, Category=categories, Geometry=gate_5.Target0, TrackingMode=2)  # disabled

# ---- group: 1st Floor
categories_2 = DirectShapeCategories("autodesk.revit.category.local:floors-1.0.0", SearchPattern="Floors")  # disabled
_1st_floor = Brep(graft([<brep referenced from the Rhino model> x15]))  # disabled
panel_4 = Panel("1st Floor")  # disabled

# ----
gate_6 = StreamGate(Stream=_1st_floor, Gate=list)  # -> Target0, Target1; disabled

# ---- group: 1st Floor (continued)
geodshape_2 = AddGeometryDirectShape(Name=panel_4, Category=categories_2, Geometry=gate_6.Target0, TrackingMode=2)  # disabled

# ---- group: Wall
categories_3 = DirectShapeCategories("autodesk.revit.category.local:walls-1.0.0", SearchPattern="Wall")  # disabled
wall = Brep(graft(<brep referenced from the Rhino model>))  # disabled
panel_5 = Panel("Slanted Roof")  # disabled

# ----
gate_7 = StreamGate(Stream=wall, Gate=list)  # -> Target0, Target1; disabled

# ---- group: Wall (continued)
geodshape_3 = AddGeometryDirectShape(Name=panel_5, Category=categories_3, Geometry=gate_7.Target0, TrackingMode=2)  # disabled

# ---- group: Railing
categories_4 = DirectShapeCategories("autodesk.revit.category.family:stairsRailing-1.0.0", SearchPattern="Rails")  # disabled
railing = Brep(graft([<brep referenced from the Rhino model> x8]))  # disabled
panel_6 = Panel("Slanted Roof")  # disabled

# ----
gate_8 = StreamGate(Stream=railing, Gate=list)  # -> Target0, Target1; disabled

# ---- group: Railing (continued)
geodshape_4 = AddGeometryDirectShape(Name=panel_6, Category=categories_4, Geometry=gate_8.Target0, TrackingMode=2)  # disabled

# ---- group: Generic Models
categories_5 = DirectShapeCategories("autodesk.revit.category.family:genericModel-1.0.0", SearchPattern="Generic")  # disabled
fins = Brep(graft([<brep referenced from the Rhino model> x5]))  # disabled
panel_7 = Panel("Slanted Roof")  # disabled

# ----
gate_9 = StreamGate(Stream=fins, Gate=list)  # -> Target0, Target1; disabled

# ---- group: Generic Models (continued)
geodshape_5 = AddGeometryDirectShape(Name=panel_7, Category=categories_5, Geometry=gate_9.Target0, TrackingMode=2)  # disabled

# ---- group: Custom Roofs
categories_6 = DirectShapeCategories("autodesk.revit.category.local:roofs-1.0.0", SearchPattern="Roof")  # disabled
roofs = Brep(graft([<brep referenced from the Rhino model> x22]))  # disabled
panel_8 = Panel("Slanted Roof")  # disabled

# ----
gate_10 = StreamGate(Stream=roofs, Gate=list)  # -> Target0, Target1; disabled

# ---- group: Custom Roofs (continued)
geodshape_6 = AddGeometryDirectShape(Name=panel_8, Category=categories_6, Geometry=gate_10.Target0, TrackingMode=2)  # disabled

# ---- group: Mass
categories_7 = DirectShapeCategories("autodesk.revit.category.family:mass-1.0.0", SearchPattern="Mass")  # disabled
mass = Brep(graft([<brep referenced from the Rhino model> x2]))  # disabled
panel_9 = Panel("Slanted Roof")  # disabled

# ----
gate_11 = StreamGate(Stream=mass, Gate=list)  # -> Target0, Target1; disabled

# ---- group: Mass (continued)
geodshape_7 = AddGeometryDirectShape(Name=panel_9, Category=categories_7, Geometry=gate_11.Target0, TrackingMode=2)  # disabled

# ---- group: Exterior Walls - Brick
panel_10 = Panel("/")  # disabled
wall_type = Slider(30, range=0..30)  # disabled
walls = Brep([<brep referenced from the Rhino model> x33])  # disabled
md_slider = MDSlider(SliderMode=0, slider_value=Point(0.5, 0.5, 0.5), x_domain=Domain(0, 1), y_domain=Domain(0, 1), z_domain=Domain(0, 1))  # disabled
slider = Slider(3, range=1..100)  # disabled

# ----
gate_12 = StreamGate(Stream=walls, Gate=list)  # -> Target0, Target1; disabled

# ---- group: Exterior Walls - Brick
debrep = DeconstructBrep(Brep=gate_12.Target0)  # -> Faces, Edges, Vertices; disabled
area = Area(Geometry=debrep.Faces)  # -> Area, Centroid; disabled
sort = SortList(Keys=area.Area, ValuesA=debrep.Faces)  # -> Keys, ValuesA; disabled
rev = ReverseList(List=sort.ValuesA)  # disabled
item_2 = ListItem(List=rev, Index=0, Wrap=True)  # disabled

md_slider_2 = MDSlider(SliderMode=0, slider_value=Point(0.5, 0.5, 0.5), x_domain=Domain(0, 1), y_domain=Domain(0, 1), z_domain=Domain(0, 1))  # disabled
curvature = SurfaceCurvature(Surface=reparameterize(item_2), Point=md_slider_2)  # -> Frame, Gaussian, Mean; disabled
expression = Expression(x=curvature.Mean, Expression="abs(round(x,4))")  # disabled
python = GhPythonScript(x=expression, srf=item_2)  # -> flatten(c_srf), flatten(s_srf); disabled
# ---------- python: Python ----------
__author__ = "ilouh"
__version__ = "2022.05.14"

import rhinoscriptsyntax as rs

if x != 0: 
    c_srf = srf
else: 
    s_srf = srf
# ---------- end python ----------

# ---- group: Storefronts
storefront = Brep([<brep referenced from the Rhino model> x32])  # disabled
wall_type_2 = Slider(1, range=0..10)  # disabled

# ----
gate_13 = StreamGate(Stream=storefront, Gate=list)  # -> Target0, Target1; disabled

# ---- group: CurtainWalls
storefront_2 = Brep([<brep referenced from the Rhino model> x27])  # disabled
wall_type_3 = Slider(31, range=0..31)  # disabled

# ----
gate_14 = StreamGate(Stream=storefront_2, Gate=list)  # -> Target0, Target1; disabled

# ---- group: Storefronts (continued)
srf = Surface(gate_13.Target0)  # disabled

md_slider_3 = MDSlider(SliderMode=0, slider_value=Point(0.5, 0.5, 0.5), x_domain=Domain(0, 1), y_domain=Domain(0, 1), z_domain=Domain(0, 1))  # disabled
curvature_2 = SurfaceCurvature(Surface=reparameterize(srf), Point=md_slider_3)  # -> Frame, Gaussian, Mean; disabled
expression_2 = Expression(x=curvature_2.Mean, Expression="abs(round(x,4))")  # disabled
python_2 = GhPythonScript(x=expression_2, srf=srf)  # -> flatten(c_srf), flatten(s_srf); disabled; same code as python
clean = CleanTree(RemoveNulls=True, RemoveInvalid=True, RemoveEmpty=False, Tree=python_2.c_srf)  # disabled
clean_2 = CleanTree(RemoveNulls=True, RemoveInvalid=True, RemoveEmpty=False, Tree=python_2.s_srf)  # disabled

python_3 = GhPythonScript(srf=clean_2)  # -> out; disabled
# ---------- python_3: Python ----------
__author__ = "ilouh"
__version__ = "2022.05.14"

import rhinoscriptsyntax as rs

test = rs.ShrinkTrimmedSurface(srf,True)


if test is not None: 

    out = test 
    
else: 

    out = srf
# ---------- end python_3 ----------
walls_by_profile = Brep(graft(python_3))  # disabled

explode = Explode(Curve=clean, Recursive=True)  # -> Segments, Vertices; disabled
curvepoint = PointOnCurve(explode.Segments, parameter=0.5)  # disabled
pdecon = Deconstruct(Point=curvepoint)  # -> XComponent, YComponent, ZComponent; disabled
sort_2 = SortList(Keys=pdecon.ZComponent, ValuesA=explode.Segments)  # -> Keys, ValuesA; disabled
item_3 = ListItem(List=sort_2.Keys, Index=0, Wrap=True)  # -> Item1, Item; disabled
item_4 = ListItem(List=sort_2.ValuesA, Index=0, Wrap=True)  # disabled
subtraction = Subtraction(A=item_3.Item1, B=item_3.Item)  # disabled
end = EndPoints(Curve=item_4)  # -> Start, End; disabled
curvepoint_2 = PointOnCurve(item_4, parameter=0.5)  # disabled
expression_3 = Expression(x=subtraction, Expression="round(x,2)")  # disabled
arc = Arc3Pt(PointA=end.Start, PointB=curvepoint_2, PointC=end.End)  # -> Arc, Plane, Radius; disabled
height = Number(expression_3)  # disabled
wall_by_curve = Curve(arc.Arc)  # disabled

md_slider_4 = MDSlider(SliderMode=0, slider_value=Point(0.5, 0.5, 0.5), x_domain=Domain(0, 1), y_domain=Domain(0, 1), z_domain=Domain(0, 1))  # disabled
evalsrf = EvaluateSurface(Surface=reparameterize(walls_by_profile), Point=md_slider_4)  # -> Point, Normal, UDirection, VDirection, Frame; disabled
project = Project(Geometry=walls_by_profile, Plane=evalsrf.Frame)  # -> Geometry, Transform; disabled

number_slider = Slider(0, range=-10..10)  # disabled
amp = Amplitude(Vector=evalsrf.Normal, Amplitude=expr("x/12", number_slider))  # disabled
move = Move(Geometry=project.Geometry, Motion=amp)  # -> Geometry, Transform; disabled
edges = BrepEdges(Brep=move.Geometry)  # -> Naked, Interior, NonManifold; disabled
join = JoinCurves(Curves=edges.Naked, Preserve=False)  # -> simplify(Curves); disabled
wll_2 = WallLocationLine({"Wall Centerline": 0, "Core Centerline": 1, "Finish (Exterior Face)": 2, "Finish (Interior Face)": 3, "Core (Exterior Face)": 4, "Core (Interior Face)": 5}, selected="Core Centerline")  # disabled

len = Length(Curve=wall_by_curve)  # disabled
larger = LargerThan(FirstNumber=len, SecondNumber=1)  # -> LargerThan, OrEqualTo; disabled
cull = CullPattern(List=wall_by_curve, CullPattern=larger.LargerThan)  # disabled

# ----
simplify_3 = SimplifyCurve(Curve=join)  # -> simplify(Curve), Simplified; disabled
simplify_4 = SimplifyCurve(Curve=cull)  # -> simplify(Curve), Simplified; disabled

# ---- group: Storefronts (continued)
wallcrv = AddWallCurve(
    Curve=simplify_4.Curve,
    Type=<hostobjecttype referenced from the Revit model>,
    Height=height,
    LocationLine=wll,
    TrackingMode=2)  # disabled
wallprfl = AddWallProfile(Profile=simplify_3.Curve, Type=<hostobjecttype referenced from the Revit model>, LocationLine=wll, TrackingMode=2)  # disabled

# ---- group: CurtainWalls (continued)
srf_2 = Surface(gate_14.Target0)  # disabled

md_slider_5 = MDSlider(SliderMode=0, slider_value=Point(0.5, 0.5, 0.5), x_domain=Domain(0, 1), y_domain=Domain(0, 1), z_domain=Domain(0, 1))  # disabled
curvature_3 = SurfaceCurvature(Surface=reparameterize(srf_2), Point=md_slider_5)  # -> Frame, Gaussian, Mean; disabled
expression_4 = Expression(x=curvature_3.Mean, Expression="abs(round(x,4))")  # disabled
python_4 = GhPythonScript(x=expression_4, srf=srf_2)  # -> flatten(c_srf), flatten(s_srf); disabled; same code as python
clean_3 = CleanTree(RemoveNulls=True, RemoveInvalid=True, RemoveEmpty=False, Tree=python_4.c_srf)  # disabled
clean_4 = CleanTree(RemoveNulls=True, RemoveInvalid=True, RemoveEmpty=False, Tree=python_4.s_srf)  # disabled

python_5 = GhPythonScript(srf=clean_4)  # -> out; disabled; same code as python_3
walls_by_profile_2 = Brep(graft(python_5))  # disabled

explode_2 = Explode(Curve=clean_3, Recursive=True)  # -> Segments, Vertices; disabled
curvepoint_3 = PointOnCurve(explode_2.Segments, parameter=0.5)  # disabled
pdecon_2 = Deconstruct(Point=curvepoint_3)  # -> XComponent, YComponent, ZComponent; disabled
sort_3 = SortList(Keys=pdecon_2.ZComponent, ValuesA=explode_2.Segments)  # -> Keys, ValuesA; disabled
item_5 = ListItem(List=sort_3.Keys, Index=0, Wrap=True)  # -> Item1, Item; disabled
item_6 = ListItem(List=sort_3.ValuesA, Index=0, Wrap=True)  # disabled
subtraction_2 = Subtraction(A=item_5.Item1, B=item_5.Item)  # disabled
end_2 = EndPoints(Curve=item_6)  # -> Start, End; disabled
curvepoint_4 = PointOnCurve(item_6, parameter=0.5)  # disabled
expression_5 = Expression(x=subtraction_2, Expression="round(x,2)")  # disabled
arc_2 = Arc3Pt(PointA=end_2.Start, PointB=curvepoint_4, PointC=end_2.End)  # -> Arc, Plane, Radius; disabled
height_2 = Number(expression_5)  # disabled
wall_by_curve_2 = Curve(arc_2.Arc)  # disabled

md_slider_6 = MDSlider(SliderMode=0, slider_value=Point(0.5, 0.5, 0.5), x_domain=Domain(0, 1), y_domain=Domain(0, 1), z_domain=Domain(0, 1))  # disabled
evalsrf_2 = EvaluateSurface(Surface=reparameterize(walls_by_profile_2), Point=md_slider_6)  # -> Point, Normal, UDirection, VDirection, Frame; disabled
project_2 = Project(Geometry=walls_by_profile_2, Plane=evalsrf_2.Frame)  # -> Geometry, Transform; disabled

number_slider_2 = Slider(0, range=-10..10)  # disabled
amp_2 = Amplitude(Vector=evalsrf_2.Normal, Amplitude=expr("x/12", number_slider_2))  # disabled
move_2 = Move(Geometry=project_2.Geometry, Motion=amp_2)  # -> Geometry, Transform; disabled
edges_2 = BrepEdges(Brep=move_2.Geometry)  # -> Naked, Interior, NonManifold; disabled
join_2 = JoinCurves(Curves=edges_2.Naked, Preserve=False)  # -> simplify(Curves); disabled
wll_3 = WallLocationLine({"Wall Centerline": 0, "Core Centerline": 1, "Finish (Exterior Face)": 2, "Finish (Interior Face)": 3, "Core (Exterior Face)": 4, "Core (Interior Face)": 5}, selected="Core Centerline")  # disabled

len_2 = Length(Curve=wall_by_curve_2)  # disabled
larger_2 = LargerThan(FirstNumber=len_2, SecondNumber=1)  # -> LargerThan, OrEqualTo; disabled
cull_2 = CullPattern(List=wall_by_curve_2, CullPattern=larger_2.LargerThan)  # disabled

# ----
simplify_5 = SimplifyCurve(Curve=join_2)  # -> simplify(Curve), Simplified; disabled
simplify_6 = SimplifyCurve(Curve=height_2)  # -> simplify(Curve), Simplified; disabled

# ---- group: CurtainWalls (continued)
wallcrv_2 = AddWallCurve(
    Curve=simplify_6.Curve,
    Type=<hostobjecttype referenced from the Revit model>,
    Height=height_2,
    LocationLine=wll_3,
    TrackingMode=2)  # disabled
wallprfl_2 = AddWallProfile(Profile=simplify_5.Curve, Type=<hostobjecttype referenced from the Revit model>, LocationLine=wll_3, TrackingMode=2)  # disabled

# ---- group: Exterior Walls - Brick (continued)
panel_14 = Panel(curvature.Mean)  # disabled
python_6 = GhPythonScript(x=expression, srf=item_2)  # -> flatten(out); disabled
# ---------- python_6: Python ----------
__author__ = "ilouh"
__version__ = "2022.05.14"

import rhinoscriptsyntax as rs

if x != 0: 
    out = True
else: 
    out = False
# ---------- end python_6 ----------
not = GateNot(A=python_6)  # disabled
straight_walls = CullPattern(List=gate_12.Target0, CullPattern=not)  # disabled
get_largest_faces = GetLargestFaces(B=straight_walls)  # -> i, item_1; disabled
srf_3 = Surface(get_largest_faces.item_1)  # disabled
srf_4 = Surface(get_largest_faces.i)  # disabled
twn2srfs = TweenTwoSurfaces(SurfaceA=srf_4, SurfaceB=srf_3, Factor=0.5, Refit=0, PointSample=0)
curved_wall = CullPattern(List=gate_12.Target0, CullPattern=python_6)  # disabled
getbottomface = GetBottomFace(B=curved_wall)  # disabled
bottom_face = Surface(flatten(getbottomface))  # disabled
get_longest_edge_curves = GetLongestEdgeCurves(B=bottom_face)  # -> i, item_1; disabled
getwallheight = GetWallHeight(C=curved_wall)  # disabled
crv = Curve(get_longest_edge_curves.i)  # disabled
crv_2 = Curve(get_longest_edge_curves.item_1)  # disabled
disc = Discontinuity(Curve=crv_2, Level=1)  # -> Points, Parameters; disabled
height_3 = Number(getwallheight)  # disabled
convert2arc = Convert2Arc(C=crv)  # disabled
convert2arc_2 = Convert2Arc(C=crv_2)  # disabled
rebuildmidarc = RebuildMidArc(C=convert2arc, C_2=convert2arc_2)  # -> i, item_1, item_2; disabled
arc_3 = Arc3Pt(PointA=rebuildmidarc.i, PointB=rebuildmidarc.item_1, PointC=rebuildmidarc.item_2)  # -> Arc, Plane, Radius; disabled

# ----
tweensurface = TweenSurface(G=srf_4, G_2=srf_3)  # disabled
srf_5 = Surface(tweensurface)  # disabled

# ---- group: Exterior Walls - Brick
python_7 = GhPythonScript(srf=srf_5)  # -> out; disabled
# ---------- python_7: Python ----------
__author__ = "ilouh"
__version__ = "2022.05.14"

import rhinoscriptsyntax as rs

test = rs.ShrinkTrimmedSurface(srf,True)

if test is not None: 

    out = test 

else: 

    out = srf
print(out)
# ---------- end python_7 ----------
walls_by_profile_3 = Brep(graft(python_7))  # disabled

edges_3 = BrepEdges(Brep=walls_by_profile_3)  # -> simplify(Naked), Interior, NonManifold; disabled
join_3 = JoinCurves(Curves=edges_3.Naked, Preserve=False)  # disabled
wll_4 = WallLocationLine({"Wall Centerline": 0, "Core Centerline": 1, "Finish (Exterior Face)": 2, "Finish (Interior Face)": 3, "Core (Exterior Face)": 4, "Core (Interior Face)": 5}, selected="Core Centerline")  # disabled

# ----
simplify_7 = SimplifyCurve(Curve=arc_3.Arc)  # -> simplify(Curve), Simplified; disabled

# ---- group: Exterior Concrete Walls
exterior_concrete_walls = Brep([<brep referenced from the Rhino model> x31])  # disabled
gate_15 = StreamGate(Stream=exterior_concrete_walls, Gate=list)  # -> Target0, Target1; disabled
getbottomface_2 = GetBottomFace(B=gate_15.Target0)  # disabled
bottom_face_2 = Surface(flatten(getbottomface_2))  # disabled
get_longest_edge_curves_2 = GetLongestEdgeCurves(B=bottom_face_2)  # -> i, item_1; disabled
getwallheight_2 = GetWallHeight(C=gate_15.Target0)  # disabled
crv_3 = Curve(flatten(get_longest_edge_curves_2.item_1))  # disabled
crv_4 = Curve(flatten(get_longest_edge_curves_2.i))  # disabled
height_4 = Number(getwallheight_2)  # disabled
wll_5 = WallLocationLine({"Wall Centerline": 0, "Core Centerline": 1, "Finish (Exterior Face)": 2, "Finish (Interior Face)": 3, "Core (Exterior Face)": 4, "Core (Interior Face)": 5}, selected="Core Centerline")  # disabled
toggle = BooleanToggle(False)  # disabled

# ---- group: Exterior Concrete Walls / Evaluate Arc/Line
len_3 = Length(Curve=crv_4)  # disabled
end_3 = EndPoints(Curve=crv_4)  # -> Start, End; disabled
dist = Distance(PointA=end_3.Start, PointB=end_3.End)  # disabled
smaller = SmallerThan(FirstNumber=expr("round(x,2)", dist), SecondNumber=expr("round(x,2)", len_3))  # -> SmallerThan, OrEqualTo; disabled

# ---- group: Exterior Concrete Walls
cull_3 = CullPattern(List=crv_4, CullPattern=smaller.SmallerThan)  # disabled
cull_4 = CullPattern(List=crv_3, CullPattern=smaller.SmallerThan)  # disabled
arc_4 = Curve(graft(cull_3))  # disabled
arc_5 = Curve(graft(cull_4))  # disabled
eval = EvaluateCurve(Curve=reparameterize(arc_4), Parameter=[0, 0.5, 1])  # -> Point, Tangent, Angle; disabled
crv_cp = CurveClosestPoint(Point=eval.Point, Curve=arc_5)  # -> Point, Parameter, Distance; disabled
ln = Line(StartPoint=eval.Point, EndPoint=crv_cp.Point)  # disabled
midpt = CurveMiddle(Curve=ln)  # disabled
item_7 = ListItem(List=simplify(midpt), Index=0, Wrap=True)  # -> Item, Item1, Item2; disabled

# ---- group: Interior Walls
interior_walls = Brep([<brep referenced from the Rhino model> x38])  # disabled
gate_16 = StreamGate(Stream=interior_walls, Gate=list)  # -> Target0, Target1; disabled
getbottomface_3 = GetBottomFace(B=gate_16.Target0)  # disabled
bottom_face_3 = Surface(flatten(getbottomface_3))  # disabled
get_longest_edge_curves_3 = GetLongestEdgeCurves(B=bottom_face_3)  # -> i, item_1; disabled
getwallheight_3 = GetWallHeight(C=gate_16.Target0)  # disabled
crv_5 = Curve(flatten(get_longest_edge_curves_3.item_1))  # disabled
crv_6 = Curve(flatten(get_longest_edge_curves_3.i))  # disabled
height_5 = Number(getwallheight_3)  # disabled
wll_6 = WallLocationLine({"Wall Centerline": 0, "Core Centerline": 1, "Finish (Exterior Face)": 2, "Finish (Interior Face)": 3, "Core (Exterior Face)": 4, "Core (Interior Face)": 5}, selected="Core Centerline")  # disabled
toggle_2 = BooleanToggle(False)  # disabled

# ---- group: Interior Walls / Evaluate Arc/Line
len_4 = Length(Curve=crv_6)  # disabled
end_4 = EndPoints(Curve=crv_6)  # -> Start, End; disabled
dist_2 = Distance(PointA=end_4.Start, PointB=end_4.End)  # disabled
smaller_2 = SmallerThan(FirstNumber=expr("round(x,2)", dist_2), SecondNumber=expr("round(x,2)", len_4))  # -> SmallerThan, OrEqualTo; disabled

# ---- group: Interior Walls
cull_5 = CullPattern(List=crv_6, CullPattern=smaller_2.SmallerThan)  # disabled
cull_6 = CullPattern(List=crv_5, CullPattern=smaller_2.SmallerThan)  # disabled
arc_6 = Curve(graft(cull_5))  # disabled
arc_7 = Curve(graft(cull_6))  # disabled
eval_2 = EvaluateCurve(Curve=reparameterize(arc_6), Parameter=[0, 0.5, 1])  # -> Point, Tangent, Angle; disabled
crv_cp_2 = CurveClosestPoint(Point=eval_2.Point, Curve=arc_7)  # -> Point, Parameter, Distance; disabled
ln_2 = Line(StartPoint=eval_2.Point, EndPoint=crv_cp_2.Point)  # disabled
midpt_2 = CurveMiddle(Curve=ln_2)  # disabled
item_8 = ListItem(List=simplify(midpt_2), Index=0, Wrap=True)  # -> Item, Item1, Item2; disabled

# ---- group: Parapets
parapets = Brep([<brep referenced from the Rhino model> x14])  # disabled
gate_17 = StreamGate(Stream=parapets, Gate=list)  # -> Target0, Target1; disabled
getbottomface_4 = GetBottomFace(B=gate_17.Target0)  # disabled
bottom_face_4 = Surface(flatten(getbottomface_4))  # disabled
get_longest_edge_curves_4 = GetLongestEdgeCurves(B=bottom_face_4)  # -> i, item_1; disabled
getwallheight_4 = GetWallHeight(C=gate_17.Target0)  # disabled
crv_7 = Curve(flatten(get_longest_edge_curves_4.item_1))  # disabled
crv_8 = Curve(flatten(get_longest_edge_curves_4.i))  # disabled
height_6 = Number(getwallheight_4)  # disabled
wll_7 = WallLocationLine({"Wall Centerline": 0, "Core Centerline": 1, "Finish (Exterior Face)": 2, "Finish (Interior Face)": 3, "Core (Exterior Face)": 4, "Core (Interior Face)": 5}, selected="Core Centerline")  # disabled
toggle_3 = BooleanToggle(False)  # disabled

# ---- group: Parapets / Evaluate Arc/Line
len_5 = Length(Curve=crv_8)  # disabled
end_5 = EndPoints(Curve=crv_8)  # -> Start, End; disabled
dist_3 = Distance(PointA=end_5.Start, PointB=end_5.End)  # disabled
smaller_3 = SmallerThan(FirstNumber=expr("round(x,2)", dist_3), SecondNumber=expr("round(x,2)", len_5))  # -> SmallerThan, OrEqualTo; disabled

# ---- group: Parapets
cull_7 = CullPattern(List=crv_8, CullPattern=smaller_3.SmallerThan)  # disabled
cull_8 = CullPattern(List=crv_7, CullPattern=smaller_3.SmallerThan)  # disabled
arc_8 = Curve(graft(cull_7))  # disabled
arc_9 = Curve(graft(cull_8))  # disabled
eval_3 = EvaluateCurve(Curve=reparameterize(arc_8), Parameter=[0, 0.5, 1])  # -> Point, Tangent, Angle; disabled
crv_cp_3 = CurveClosestPoint(Point=eval_3.Point, Curve=arc_9)  # -> Point, Parameter, Distance; disabled
ln_3 = Line(StartPoint=eval_3.Point, EndPoint=crv_cp_3.Point)  # disabled
midpt_3 = CurveMiddle(Curve=ln_3)  # disabled
item_9 = ListItem(List=simplify(midpt_3), Index=0, Wrap=True)  # -> Item, Item1, Item2; disabled

# ---- group: Interior Walls (continued)
not_2 = GateNot(A=smaller_2.SmallerThan)  # disabled
arc_10 = Arc3Pt(PointA=item_8.Item, PointB=item_8.Item1, PointC=item_8.Item2)  # -> Arc, Plane, Radius; disabled

cull_9 = CullPattern(List=crv_6, CullPattern=not_2)  # disabled
cull_10 = CullPattern(List=crv_5, CullPattern=not_2)  # disabled
line = Curve(graft(cull_9))  # disabled
line_2 = Curve(graft(cull_10))  # disabled
eval_4 = EvaluateCurve(Curve=reparameterize(line), Parameter=[0, 1])  # -> Point, Tangent, Angle; disabled
crv_cp_4 = CurveClosestPoint(Point=eval_4.Point, Curve=line_2)  # -> Point, Parameter, Distance; disabled
ln_4 = Line(StartPoint=eval_4.Point, EndPoint=crv_cp_4.Point)  # disabled
midpt_4 = CurveMiddle(Curve=ln_4)  # disabled
item_10 = ListItem(List=simplify(midpt_4), Index=0, Wrap=True)  # -> Item, Item1; disabled

cull_11 = CullPattern(List=height_5, CullPattern=not_2)  # disabled
cull_12 = CullPattern(List=height_5, CullPattern=smaller_2.SmallerThan)  # disabled
arc_11 = Number(flatten(cull_12))  # disabled
line_3 = Number(flatten(cull_11))  # disabled
merge = Merge(Data1=arc_11, Data2=line_3)  # -> graft(Result); disabled

# ---- group: Parapets (continued)
not_3 = GateNot(A=smaller_3.SmallerThan)  # disabled
arc_12 = Arc3Pt(PointA=item_9.Item, PointB=item_9.Item1, PointC=item_9.Item2)  # -> Arc, Plane, Radius; disabled

cull_13 = CullPattern(List=crv_8, CullPattern=not_3)  # disabled
cull_14 = CullPattern(List=crv_7, CullPattern=not_3)  # disabled
line_4 = Curve(graft(cull_13))  # disabled
line_5 = Curve(graft(cull_14))  # disabled
eval_5 = EvaluateCurve(Curve=reparameterize(line_4), Parameter=[0, 1])  # -> Point, Tangent, Angle; disabled
crv_cp_5 = CurveClosestPoint(Point=eval_5.Point, Curve=line_5)  # -> Point, Parameter, Distance; disabled
ln_5 = Line(StartPoint=eval_5.Point, EndPoint=crv_cp_5.Point)  # disabled
midpt_5 = CurveMiddle(Curve=ln_5)  # disabled
item_11 = ListItem(List=simplify(midpt_5), Index=0, Wrap=True)  # -> Item, Item1; disabled

cull_15 = CullPattern(List=height_6, CullPattern=not_3)  # disabled
cull_16 = CullPattern(List=height_6, CullPattern=smaller_3.SmallerThan)  # disabled
arc_13 = Number(flatten(cull_16))  # disabled
line_6 = Number(flatten(cull_15))  # disabled
merge_2 = Merge(Data1=arc_13, Data2=line_6)  # -> graft(Result); disabled

# ---- group: Exterior Concrete Walls (continued)
not_4 = GateNot(A=smaller.SmallerThan)  # disabled
arc_14 = Arc3Pt(PointA=item_7.Item, PointB=item_7.Item1, PointC=item_7.Item2)  # -> Arc, Plane, Radius; disabled

cull_17 = CullPattern(List=crv_4, CullPattern=not_4)  # disabled
cull_18 = CullPattern(List=crv_3, CullPattern=not_4)  # disabled
line_7 = Curve(graft(cull_17))  # disabled
line_8 = Curve(graft(cull_18))  # disabled
eval_6 = EvaluateCurve(Curve=reparameterize(line_7), Parameter=[0, 1])  # -> Point, Tangent, Angle; disabled
crv_cp_6 = CurveClosestPoint(Point=eval_6.Point, Curve=line_8)  # -> Point, Parameter, Distance; disabled
ln_6 = Line(StartPoint=eval_6.Point, EndPoint=crv_cp_6.Point)  # disabled
midpt_6 = CurveMiddle(Curve=ln_6)  # disabled
item_12 = ListItem(List=simplify(midpt_6), Index=0, Wrap=True)  # -> Item, Item1; disabled

cull_19 = CullPattern(List=height_4, CullPattern=not_4)  # disabled
cull_20 = CullPattern(List=height_4, CullPattern=smaller.SmallerThan)  # disabled
arc_15 = Number(flatten(cull_20))  # disabled
line_9 = Number(flatten(cull_19))  # disabled
merge_3 = Merge(Data1=arc_15, Data2=line_9)  # -> graft(Result); disabled

# ---- group: Exterior Walls - Brick (continued)
evalsrf_3 = EvaluateSurface(Surface=walls_by_profile_3, Point=md_slider)  # -> Point, Normal, UDirection, VDirection, Frame; disabled
project_3 = Project(Geometry=join_3, Plane=evalsrf_3.Frame)  # -> Geometry, Transform; disabled
wallcrv_3 = AddWallCurve(
    Curve=simplify_7.Curve,
    Type=<hostobjecttype referenced from the Revit model>,
    Height=graft(height_3),
    LocationLine=wll_4,
    TrackingMode=2)  # disabled

# ----
simplify_8 = SimplifyCurve(Curve=project_3.Geometry)  # -> simplify(Curve), Simplified; disabled

# ---- group: Exterior Walls - Brick (continued)
wallprfl_3 = AddWallProfile(Profile=simplify_8.Curve, Type=<hostobjecttype referenced from the Revit model>, LocationLine=wll_4, TrackingMode=2)  # disabled

# ---- group: Interior Walls (continued)
ln_7 = Line(StartPoint=item_10.Item, EndPoint=item_10.Item1)  # disabled
merge_4 = Merge(Data1=flatten(arc_10.Arc), Data2=flatten(ln_7))  # -> graft(Result); disabled

# ----
simplify_9 = SimplifyCurve(Curve=merge_4)  # -> simplify(Curve), Simplified; disabled

# ---- group: Interior Walls (continued)
wallcrv_4 = AddWallCurve(
    Curve=simplify_9.Curve,
    Type=<hostobjecttype referenced from the Revit model>,
    Height=graft(merge),
    LocationLine=wll_6,
    AllowJoins=toggle_2,
    TrackingMode=2)  # disabled

# ---- group: Parapets (continued)
ln_8 = Line(StartPoint=item_11.Item, EndPoint=item_11.Item1)  # disabled
merge_5 = Merge(Data1=flatten(arc_12.Arc), Data2=flatten(ln_8))  # -> graft(Result); disabled

# ----
simplify_10 = SimplifyCurve(Curve=merge_5)  # -> simplify(Curve), Simplified; disabled

# ---- group: Parapets (continued)
wallcrv_5 = AddWallCurve(
    Curve=simplify_10.Curve,
    Type=<hostobjecttype referenced from the Revit model>,
    Height=graft(merge_2),
    LocationLine=wll_7,
    AllowJoins=toggle_3,
    TrackingMode=2)  # disabled

# ---- group: Exterior Concrete Walls (continued)
ln_9 = Line(StartPoint=item_12.Item, EndPoint=item_12.Item1)  # disabled
merge_6 = Merge(Data1=flatten(arc_14.Arc), Data2=flatten(ln_9))  # -> graft(Result); disabled

# ----
simplify_11 = SimplifyCurve(Curve=merge_6)  # -> simplify(Curve), Simplified; disabled

# ---- group: Exterior Concrete Walls (continued)
wallcrv_6 = AddWallCurve(
    Curve=simplify_11.Curve,
    Type=<hostobjecttype referenced from the Revit model>,
    Height=graft(merge_3),
    LocationLine=wll_5,
    AllowJoins=toggle,
    TrackingMode=2)  # disabled

# ==== cluster BrepTopBoundary
B = ClusterInput()
debrep = DeconstructBrep(Brep=B)  # -> Faces, Edges, Vertices
md_slider = MDSlider(SliderMode=0, slider_value=Point(0.5, 0.5, 0.5), x_domain=Domain(0, 1), y_domain=Domain(0, 1), z_domain=Domain(0, 1))
evalsrf = EvaluateSurface(Surface=reparameterize(debrep.Faces), Point=md_slider)  # -> Point, Normal, UDirection, VDirection, Frame
devec = DeconstructVector(Vector=evalsrf.Normal)  # -> XComponent, YComponent, simplify(ZComponent)
equals = Equality(FirstNumber=expr("round(x)", devec.ZComponent), SecondNumber=1)  # -> Equality, Inequality
panel = Panel(devec.ZComponent)
cull = CullPattern(List=debrep.Faces, CullPattern=equals.Equality)
xy = XYPlane(Origin=Point(0, 0, 0))
edges = BrepEdges(Brep=cull)  # -> Naked, Interior, NonManifold
project = Project(Geometry=edges.Naked, Plane=xy)  # -> Geometry, Transform
join = JoinCurves(Curves=project.Geometry, Preserve=False)  # -> simplify(Curves)
C = ClusterOutput(join)

# ==== cluster GetLargestFaces
B = ClusterInput()

debrep = DeconstructBrep(Brep=B)  # -> Faces, Edges, Vertices
area = Area(Geometry=debrep.Faces)  # -> Area, Centroid
sort = SortList(Keys=area.Area, ValuesA=debrep.Faces)  # -> Keys, ValuesA
rev = ReverseList(List=sort.ValuesA)
item = ListItem(List=rev, Index=0, Wrap=True)  # -> Item, Item1

i = ClusterOutput(item.Item)
item_1 = ClusterOutput(item.Item1)

# ==== cluster GetBottomFace
B = ClusterInput()
debrep = DeconstructBrep(Brep=B)  # -> Faces, Edges, Vertices
md_slider = MDSlider(SliderMode=0, slider_value=Point(0.5, 0.5, 0.5), x_domain=Domain(0, 1), y_domain=Domain(0, 1), z_domain=Domain(0, 1))
evalsrf = EvaluateSurface(Surface=reparameterize(debrep.Faces), Point=md_slider)  # -> Point, Normal, UDirection, VDirection, Frame
devec = DeconstructVector(Vector=evalsrf.Normal)  # -> XComponent, YComponent, simplify(ZComponent)
equals = Equality(FirstNumber=expr("round(x)", devec.ZComponent), SecondNumber=-1)  # -> Equality, Inequality
cull = CullPattern(List=debrep.Faces, CullPattern=equals.Equality)
L = ClusterOutput(cull)

# ==== cluster GetLongestEdgeCurves
B = ClusterInput()
edges = BrepEdges(Brep=B)  # -> Naked, Interior, NonManifold
len = Length(Curve=edges.Naked)
sort = SortList(Keys=len, ValuesA=edges.Naked)  # -> Keys, ValuesA
rev = ReverseList(List=sort.ValuesA)
item = ListItem(List=rev, Index=0, Wrap=True)  # -> Item, Item1
i = ClusterOutput(item.Item)
item_1 = ClusterOutput(item.Item1)

# ==== cluster Convert2Arc
C = ClusterInput()
curvepoint = PointOnCurve(C, parameter=0.5)
end = EndPoints(Curve=C)  # -> Start, End
arc = Arc3Pt(PointA=end.Start, PointB=curvepoint, PointC=end.End)  # -> Arc, Plane, Radius
A = ClusterOutput(arc.Arc)

# ==== cluster RebuildMidArc
C = ClusterInput()
C_2 = ClusterInput()
eval = EvaluateCurve(Curve=reparameterize(C), Parameter=[0, 0.5, 1])  # -> Point, Tangent, Angle
crv_cp = CurveClosestPoint(Point=eval.Point, Curve=C_2)  # -> Point, Parameter, Distance
ln = Line(StartPoint=eval.Point, EndPoint=crv_cp.Point)
midpt = CurveMiddle(Curve=ln)
item = ListItem(List=midpt, Index=0, Wrap=True)  # -> Item, Item1, Item2
i = ClusterOutput(item.Item)
item_1 = ClusterOutput(item.Item1)
item_2 = ClusterOutput(item.Item2)

# ==== cluster GetWallHeight
C = ClusterInput()
bbox = BoundingBox(Content=C, Plane=PlaneXY(0, 0, 0))  # -> Box, Box_2
box_corners = BoxCorners(Box=bbox.Box)  # -> CornerA, CornerB, CornerC, CornerD, CornerE, CornerF, CornerG, CornerH
dist = Distance(PointA=box_corners.CornerA, PointB=box_corners.CornerE)
expression = Expression(x=dist, Expression="Round(x,2)")
R = ClusterOutput(expression)

# ==== cluster TweenSurface
G = ClusterInput()
G_2 = ClusterInput()
area = Area(Geometry=G)  # -> Area, Centroid
area_2 = Area(Geometry=G_2)  # -> Area, Centroid
ln = Line(StartPoint=area.Centroid, EndPoint=area_2.Centroid)
midpt = CurveMiddle(Curve=ln)
orient = Orient(Geometry=G, Source=area.Centroid, Target=midpt)  # -> Geometry, Transform
G_3 = ClusterOutput(orient.Geometry)
