# Grasshopper definition Interoperable_Revit_Rhino Import With Material.gh (Grasshopper 1.0.7)
# plug-ins: Rhino.Inside for Autodesk Revit

_01_arch_brick_screen = Brep([<brep referenced from the Rhino model> x12])  # disabled

# ---- group: SDA Import
categories = DirectShapeCategories("autodesk.revit.category.family:genericModel-1.0.0", SearchPattern="GENERIC")  # disabled
categories_2 = DirectShapeCategories("autodesk.revit.category.local:roofs-1.0.0", SearchPattern="ROOF")  # disabled
_01_arch_form = Brep([<brep referenced from the Rhino model> x8])  # disabled
_01_arch_roof = Brep(<brep referenced from the Rhino model>)  # disabled
panel = Panel("01_ARCH_FORM")  # disabled
panel_2 = Panel("01_ARCH_ROOF")  # disabled
swatch = ColourSwatch(SwatchColor=RGB(122, 92, 87))  # disabled
swatch_2 = ColourSwatch(SwatchColor=RGB(122, 92, 87))  # disabled
material = AddMaterial(Name=panel, TrackingMode=2)  # disabled
material_2 = AddMaterial(Name=panel_2, TrackingMode=2)  # disabled
cluster = Cluster(M_2=material, C=swatch, M=material)  # disabled
cluster_2 = Cluster(M_2=material_2, C=swatch_2, M=material_2)  # disabled
material_3 = Material(cluster)  # disabled
material_4 = Material(cluster_2)  # disabled
geodshape = AddGeometryDirectShape(Category=categories, Geometry=_01_arch_form, Material=material_3, TrackingMode=2)  # disabled
geodshape_2 = AddGeometryDirectShape(Category=categories_2, Geometry=_01_arch_roof, Material=material_4, TrackingMode=2)  # disabled

# ---- group: 01_ARCH
_01_arch_int_walls = Brep([<brep referenced from the Rhino model> x4])  # disabled
categories_3 = DirectShapeCategories("autodesk.revit.category.local:walls-1.0.0", SearchPattern="WALLS")  # disabled
categories_4 = DirectShapeCategories("autodesk.revit.category.local:walls-1.0.0", SearchPattern="WALLS")  # disabled
_01_arch_glazing = Brep([<brep referenced from the Rhino model> x44])  # disabled
categories_5 = DirectShapeCategories("autodesk.revit.category.local:stairs-1.0.0", SearchPattern="STAIRS")  # disabled
_01_arch_mullions = Brep([<brep referenced from the Rhino model> x979])  # disabled
_01_arch_stairs = Brep([<brep referenced from the Rhino model> x147])  # disabled
categories_6 = DirectShapeCategories("autodesk.revit.category.local:curtainWallMullions-1.0.0", SearchPattern="MULLION")  # disabled
_01_arch_ext_walls = Brep([<brep referenced from the Rhino model> x7])  # disabled
categories_7 = DirectShapeCategories("autodesk.revit.category.local:walls-1.0.0", SearchPattern="WALLS")  # disabled
categories_8 = DirectShapeCategories("autodesk.revit.category.local:walls-1.0.0", SearchPattern="WALLS")  # disabled
_01_arch_cores = Brep([<brep referenced from the Rhino model> x9])  # disabled
categories_9 = DirectShapeCategories("autodesk.revit.category.local:floors-1.0.0", SearchPattern="FLOORS")  # disabled
_01_arch_floors = Brep([<brep referenced from the Rhino model> x3])  # disabled
categories_10 = DirectShapeCategories("autodesk.revit.category.local:floors-1.0.0", SearchPattern="FLOORS")  # disabled
_01_arch_runway = Brep([<brep referenced from the Rhino model> x14])  # disabled
categories_11 = DirectShapeCategories("autodesk.revit.category.family:genericModel-1.0.0", SearchPattern="GENERIC")  # disabled
_01_arch_brick_walls = Mesh([<mesh referenced from the Rhino model> x5000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])  # disabled
panel_3 = Panel("01_ARCH_INT. WALLS")  # disabled
panel_4 = Panel("01_ARCH_GLAZING")  # disabled
panel_5 = Panel("01_ARCH_STAIRS")  # disabled
panel_6 = Panel("01_ARCH_MULLIONS")  # disabled
panel_7 = Panel("01_ARCH_CORES")  # disabled
panel_8 = Panel("01_ARCH_CORES")  # disabled
panel_9 = Panel("01_ARCH_FLOORS")  # disabled
panel_10 = Panel("01_ARCH_RUNWAY")  # disabled
panel_11 = Panel("01_ARCH_BRICK WALLS")  # disabled
swatch_3 = ColourSwatch(SwatchColor=RGB(122, 92, 87))  # disabled
swatch_4 = ColourSwatch(SwatchColor=RGB(122, 92, 87))  # disabled
swatch_5 = ColourSwatch(SwatchColor=RGB(122, 92, 87))  # disabled
swatch_6 = ColourSwatch(SwatchColor=RGB(122, 92, 87))  # disabled
swatch_7 = ColourSwatch(SwatchColor=RGB(122, 92, 87))  # disabled
swatch_8 = ColourSwatch(SwatchColor=RGB(122, 92, 87))  # disabled
material_5 = AddMaterial(Name=panel_3, TrackingMode=2)  # disabled
material_6 = AddMaterial(Name=panel_5, TrackingMode=2)  # disabled
material_7 = AddMaterial(Name=panel_4, TrackingMode=2)  # disabled
swatch_9 = ColourSwatch(SwatchColor=RGB(122, 92, 87))  # disabled
material_8 = AddMaterial(Name=panel_6, TrackingMode=2)  # disabled
swatch_10 = ColourSwatch(SwatchColor=RGB(122, 92, 87))  # disabled
swatch_11 = ColourSwatch(SwatchColor=RGB(191, 159, 153))  # disabled
material_9 = AddMaterial(Name=panel_7, TrackingMode=2)  # disabled
material_10 = AddMaterial(Name=panel_8, TrackingMode=2)  # disabled
material_11 = AddMaterial(Name=panel_9, TrackingMode=2)  # disabled
material_12 = AddMaterial(Name=panel_10, TrackingMode=2)  # disabled
material_13 = AddMaterial(Name=panel_11, TrackingMode=2)  # disabled
cluster_3 = Cluster(M_2=material_5, C=swatch_3, M=material_5)  # disabled
cluster_4 = Cluster(M_2=material_6, C=swatch_5, M=material_6)  # disabled
cluster_5 = Cluster(M_2=material_7, C=swatch_4, M=material_7)  # disabled
cluster_6 = Cluster(M_2=material_8, C=swatch_6, M=material_8)  # disabled
cluster_7 = Cluster(M_2=material_9, C=swatch_7, M=material_9)  # disabled
cluster_8 = Cluster(M_2=material_10, C=swatch_8, M=material_10)  # disabled
cluster_9 = Cluster(M_2=material_11, C=swatch_9, M=material_11)  # disabled
cluster_10 = Cluster(M_2=material_12, C=swatch_10, M=material_12)  # disabled
cluster_11 = Cluster(M_2=material_13, C=swatch_11, M=material_13)  # disabled
material_14 = Material(cluster_3)  # disabled
material_15 = Material(cluster_5)  # disabled
material_16 = Material(cluster_4)  # disabled
material_17 = Material(cluster_6)  # disabled
material_18 = Material(cluster_7)  # disabled
material_19 = Material(cluster_8)  # disabled
material_20 = Material(cluster_9)  # disabled
material_21 = Material(cluster_10)  # disabled
material_22 = Material(cluster_11)  # disabled
geodshape_3 = AddGeometryDirectShape(Category=categories_3, Geometry=_01_arch_int_walls, Material=material_14, TrackingMode=2)  # disabled
geodshape_4 = AddGeometryDirectShape(Category=categories_5, Geometry=_01_arch_stairs, Material=material_16, TrackingMode=2)  # disabled
geodshape_5 = AddGeometryDirectShape(Category=categories_4, Geometry=_01_arch_glazing, Material=material_15, TrackingMode=2)  # disabled
geodshape_6 = AddGeometryDirectShape(Category=categories_6, Geometry=_01_arch_mullions, Material=material_17, TrackingMode=2)  # disabled
geodshape_7 = AddGeometryDirectShape(Category=categories_7, Geometry=_01_arch_cores, Material=material_18, TrackingMode=2)  # disabled
geodshape_8 = AddGeometryDirectShape(Category=categories_8, Geometry=_01_arch_ext_walls, Material=material_19, TrackingMode=2)  # disabled
geodshape_9 = AddGeometryDirectShape(Category=categories_9, Geometry=_01_arch_floors, Material=material_20, TrackingMode=2)  # disabled
geodshape_10 = AddGeometryDirectShape(Category=categories_10, Geometry=_01_arch_runway, Material=material_21, TrackingMode=2)  # disabled
geodshape_11 = AddGeometryDirectShape(Category=categories_11, Geometry=_01_arch_brick_screen, Material=material_22, TrackingMode=2)  # disabled

# ----
_01_arch_site_walls = Brep([<brep referenced from the Rhino model> x14])  # disabled
categories_12 = DirectShapeCategories("autodesk.revit.category.local:walls-1.0.0", SearchPattern="WALLS")  # disabled
panel_12 = Panel("01_ARCH_SITE WALLS")  # disabled
swatch_12 = ColourSwatch(SwatchColor=RGB(122, 92, 87))  # disabled
material_23 = AddMaterial(Name=panel_12, TrackingMode=2)  # disabled
cluster_12 = Cluster(M_2=material_23, C=swatch_12, M=material_23)  # disabled
material_24 = Material(cluster_12)  # disabled
geodshape_12 = AddGeometryDirectShape(Category=categories_12, Geometry=_01_arch_site_walls, Material=material_24, TrackingMode=2)  # disabled

categories_13 = DirectShapeCategories("autodesk.revit.category.local:floors-1.0.0", SearchPattern="FLOORS")  # disabled
_01_arch_water = Brep([<brep referenced from the Rhino model> x7])  # disabled
panel_13 = Panel("01_ARCH_WATER")  # disabled
swatch_13 = ColourSwatch(SwatchColor=RGB(122, 92, 87))  # disabled
material_25 = AddMaterial(Name=panel_13, TrackingMode=2)  # disabled
cluster_13 = Cluster(M_2=material_25, C=swatch_13, M=material_25)  # disabled
material_26 = Material(cluster_13)  # disabled
geodshape_13 = AddGeometryDirectShape(Category=categories_13, Geometry=_01_arch_water, Material=material_26, TrackingMode=2)  # disabled

# ---- group: SDA Import
_01_arch_pavement = Brep(<brep referenced from the Rhino model>)  # disabled
categories_14 = DirectShapeCategories("autodesk.revit.category.local:floors-1.0.0", SearchPattern="FLOOR")  # disabled
categories_15 = DirectShapeCategories("autodesk.revit.category.local:topography-1.0.0", SearchPattern="TOPO")  # disabled
_01_arch_site = Brep([<brep referenced from the Rhino model> x2])  # disabled
panel_14 = Panel("01_ARCH_PAVEMENT")  # disabled
panel_15 = Panel("01_ARCH_SITE")  # disabled
swatch_14 = ColourSwatch(SwatchColor=RGB(122, 92, 87))  # disabled
swatch_15 = ColourSwatch(SwatchColor=RGB(122, 92, 87))  # disabled
material_27 = AddMaterial(Name=panel_14, TrackingMode=2)  # disabled
material_28 = AddMaterial(Name=panel_15, TrackingMode=2)  # disabled
cluster_14 = Cluster(M_2=material_27, C=swatch_14, M=material_27)  # disabled
cluster_15 = Cluster(M_2=material_28, C=swatch_15, M=material_28)  # disabled
material_29 = Material(cluster_14)  # disabled
material_30 = Material(cluster_15)  # disabled
geodshape_14 = AddGeometryDirectShape(Category=categories_14, Geometry=_01_arch_pavement, Material=material_29, TrackingMode=2)  # disabled
geodshape_15 = AddGeometryDirectShape(Category=categories_15, Geometry=_01_arch_site, Material=material_30, TrackingMode=2)  # disabled

# ----
geodshape_16 = AddGeometryDirectShape(TrackingMode=2)  # disabled

# ==== cluster Cluster
M = ClusterInput()
M_2 = ClusterInput()
C = ClusterInput()

# ---- group: Creates Graphic Color
identity = MaterialIdentity(Material=M)  # -> Name, Description, Class, Comments, Manufacturer, Model, Cost, URL, Keynote, Mark
graphics = MaterialGraphics(Material=M_2, Color=C)  # -> Material, UseRenderAppearance, Color, Transparency, SurfaceForegroundPattern, SurfaceForegroundColor, SurfaceBackgroundPattern, SurfaceBackgroundColor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

# ----
M_3 = ClusterOutput(graphics.Material)
