# Grasshopper definition Interoperable_Revit_Rhino Import.gh (Grasshopper 1.0.7)
# plug-ins: Rhino.Inside for Autodesk Revit

wall = Wall([<wall referenced from the Revit model> x2])
category = Category(<category referenced from the Revit model>)
walls = Brep(graft([<brep referenced from the Rhino model> x25]))  # disabled
windows = Brep(graft([<brep referenced from the Rhino model> x2]))  # disabled
doors = Brep(graft([<brep referenced from the Rhino model> x2]))  # disabled
generic_models = Brep(<brep referenced from the Rhino model>)  # disabled
generic_models_2 = Brep([<brep referenced from the Rhino model> x120])  # disabled
categories = DirectShapeCategories("autodesk.revit.category.local:walls-1.0.0")  # disabled
categories_2 = DirectShapeCategories("autodesk.revit.category.family:windows-1.0.0")  # disabled
categories_3 = DirectShapeCategories()  # disabled
categories_4 = DirectShapeCategories("autodesk.revit.category.local:topography-1.0.0", SearchPattern="TOPO")
categories_5 = DirectShapeCategories("autodesk.revit.category.family:genericModel-1.0.0", SearchPattern="GENERIC MODEL")
geodshape = AddGeometryDirectShape(Name="Trellis", Category=categories_4, Geometry=generic_models, TrackingMode=2)  # disabled
geodshape_2 = AddGeometryDirectShape(Name="Trellis", Category=categories, Geometry=walls, TrackingMode=2)  # disabled
geodshape_3 = AddGeometryDirectShape(Name="Trellis", Category=categories_2, Geometry=windows, TrackingMode=2)  # disabled
geodshape_4 = AddGeometryDirectShape(Name="Trellis", Category=categories_5, Geometry=generic_models_2, TrackingMode=2)
geodshape_5 = AddGeometryDirectShape(Name="Trellis", Category=categories_3, Geometry=doors, TrackingMode=2)  # disabled
