# Grasshopper definition d3640c7622.gh (Grasshopper 1.0.7)

surface = Surface(graft(<surface referenced from the Rhino model>))
series = Series(Start=Slider(0, range=0..100), Step=Slider(10, range=0..100), Count=Slider(8, range=0..100))
panel = Panel(series)

md_slider = MDSlider(SliderMode=0, slider_value=Point(0.5, 0.5, 0.5), x_domain=Domain(0, 1), y_domain=Domain(0, 1), z_domain=Domain(0, 1))
evaluate_surface = EvaluateSurface(Surface=surface, Point=md_slider)  # -> Point, Normal, UDirection, VDirection, Frame

deconstruct_brep = DeconstructBrep(Brep=surface)  # -> Faces, Edges, Vertices
list_item = ListItem(List=deconstruct_brep.Edges, Index=0, Wrap=True)  # -> Item, Item1, Item2, Item3
curve = Curve(reparameterize(list_item.Item2))
curve_2 = Curve(reparameterize(list_item.Item3))
flip_curve = FlipCurve(Curve=curve_2)  # -> reparameterize(Curve), Flag

list_length = ListLength(List=series)
expression = Expression(x=list_length, y=Slider(0.4, range=0..1), Expression="x*y")

random_reduce = RandomReduce(List=series, Reduction=expression, Seed=Slider(7, range=0..10))
bounds = Bounds(Numbers=random_reduce)

remap_numbers = RemapNumbers(Value=random_reduce, Source=bounds, Target=Domain(0, 1))  # -> Mapped, Clipped
insert_items = InsertItems(List=remap_numbers.Mapped, Item=0, Indices=0, Wrap=True)
insert_items_2 = InsertItems(List=insert_items, Item=1, Indices=-1, Wrap=True)

evaluate_curve = EvaluateCurve(Curve=curve, Parameter=insert_items_2)  # -> flatten(Point), Tangent, Angle
evaluate_curve_2 = EvaluateCurve(Curve=flip_curve.Curve, Parameter=insert_items_2)  # -> flatten(Point), Tangent, Angle
sort_along_curve = SortAlongCurve(Points=evaluate_curve.Point, Curve=curve)  # -> Points, Indices
sort_along_curve_2 = SortAlongCurve(Points=evaluate_curve_2.Point, Curve=flip_curve.Curve)  # -> Points, Indices

line = Line(StartPoint=sort_along_curve.Points, EndPoint=sort_along_curve_2.Points)
shift_list = ShiftList(List=line, Shift=-1, Wrap=False)
shift_list_2 = ShiftList(List=line, Shift=1, Wrap=False)
merge = Merge(Data1=graft(shift_list_2), Data2=graft(shift_list))
loft = Loft(Curves=merge, Options={Adjust=False, Closed=False, LoftEnds=0, LoftSimp=0, LoftType=0, Rebuild=10, Refit=0.01})

amplitude = Amplitude(Vector=evaluate_surface.Normal, Amplitude=Slider(1, range=0..100))
extrude = Extrude(Base=loft, Direction=amplitude)  # -> graft(Extrusion)
bounding_box = BoundingBox(Content=extrude, Plane=evaluate_surface.Frame, UnionBox=True)  # -> Box, Box_2
geometry = Geometry(<brep referenced from the Rhino model>)
bounding_box_2 = BoundingBox(Content=geometry, Plane=PlaneXY(0, 0, 0))  # -> Box, Box_2
box_morph = BoxMorph(Geometry=geometry, Reference=bounding_box_2.Box, Target=bounding_box.Box)
